# Grasshopper definition CA grasshopper.gh (Grasshopper 1.0.7)

office = Brep([<brep referenced from the Rhino model> x2088])
restaurant = Brep([<brep referenced from the Rhino model> x36])
commerce = Brep([<brep referenced from the Rhino model> x7])
education = Brep()
residence = Brep([<brep referenced from the Rhino model> x669])
office_2 = Brep([<brep referenced from the Rhino model> x1771])
restaurant_2 = Brep([<brep referenced from the Rhino model> x222])
commerce_2 = Brep([<brep referenced from the Rhino model> x1013])
education_2 = Brep([<brep referenced from the Rhino model> x8])
residence_2 = Brep([<brep referenced from the Rhino model> x562])
brep = Brep([<brep referenced from the Rhino model> x777])
office_3 = Brep([<brep referenced from the Rhino model> x1110])
office_4 = Brep([<brep referenced from the Rhino model> x3838])
restaurant_3 = Brep([<brep referenced from the Rhino model> x6])
restaurant_4 = Brep([<brep referenced from the Rhino model> x223])
commerce_3 = Brep([<brep referenced from the Rhino model> x39])
commerce_4 = Brep([<brep referenced from the Rhino model> x105])
education_3 = Brep()
education_4 = Brep([<brep referenced from the Rhino model> x307])
residence_3 = Brep()
residence_4 = Brep([<brep referenced from the Rhino model> x510])
office_5 = Brep([<brep referenced from the Rhino model> x1233])
brep_2 = Brep([<brep referenced from the Rhino model> x1082])
restaurant_5 = Brep([<brep referenced from the Rhino model> x91])
office_6 = Brep([<brep referenced from the Rhino model> x303])
commerce_5 = Brep([<brep referenced from the Rhino model> x654])
restaurant_6 = Brep([<brep referenced from the Rhino model> x26])
commerce_6 = Brep([<brep referenced from the Rhino model> x43])
office_7 = Brep([<brep referenced from the Rhino model> x1689])
education_5 = Brep()
restaurant_7 = Brep([<brep referenced from the Rhino model> x26])
education_6 = Brep([<brep referenced from the Rhino model> x349])
commerce_7 = Brep([<brep referenced from the Rhino model> x80])
residence_5 = Brep([<brep referenced from the Rhino model> x578])
residence_6 = Brep([<brep referenced from the Rhino model> x722])
education_7 = Brep()
residence_7 = Brep()
number_slider = Slider(12, range=1..20)
evaluate_box = EvaluateBox(Box=office, UParameter=0.5, VParameter=0.5, WParameter=0.5)  # -> Plane, Point, Include
evaluate_box_2 = EvaluateBox(Box=restaurant, UParameter=0.5, VParameter=0.5, WParameter=0.5)  # -> Plane, Point, Include
evaluate_box_3 = EvaluateBox(Box=commerce, UParameter=0.5, VParameter=0.5, WParameter=0.5)  # -> Plane, Point, Include
evaluate_box_4 = EvaluateBox(Box=education, UParameter=0.5, VParameter=0.5, WParameter=0.5)  # -> Plane, Point, Include
evaluate_box_5 = EvaluateBox(Box=residence, UParameter=0.5, VParameter=0.5, WParameter=0.5)  # -> Plane, Point, Include
office_8 = Brep([<brep referenced from the Rhino model> x52])
restaurant_8 = Brep([<brep referenced from the Rhino model> x83])
evaluate_box_6 = EvaluateBox(Box=office_2, UParameter=0.5, VParameter=0.5, WParameter=0.5)  # -> Plane, Point, Include
evaluate_box_7 = EvaluateBox(Box=restaurant_2, UParameter=0.5, VParameter=0.5, WParameter=0.5)  # -> Plane, Point, Include
commerce_8 = Brep([<brep referenced from the Rhino model> x1404])
evaluate_box_8 = EvaluateBox(Box=commerce_2, UParameter=0.5, VParameter=0.5, WParameter=0.5)  # -> Plane, Point, Include
evaluate_box_9 = EvaluateBox(Box=education_2, UParameter=0.5, VParameter=0.5, WParameter=0.5)  # -> Plane, Point, Include
residence_8 = Brep([<brep referenced from the Rhino model> x20])
evaluate_box_10 = EvaluateBox(Box=residence_2, UParameter=0.5, VParameter=0.5, WParameter=0.5)  # -> Plane, Point, Include
brep_3 = Brep([<brep referenced from the Rhino model> x1016])
brep_4 = Brep([<brep referenced from the Rhino model> x788])
office_9 = Brep([<brep referenced from the Rhino model> x456])
restaurant_9 = Brep([<brep referenced from the Rhino model> x397])
commerce_9 = Brep([<brep referenced from the Rhino model> x777])
brep_5 = Brep([<brep referenced from the Rhino model> x917])
education_8 = Brep()
brep_6 = Brep([<brep referenced from the Rhino model> x902])
residence_9 = Brep([<brep referenced from the Rhino model> x337])
education_9 = Brep()
brep_7 = Brep()
brep_8 = Brep([<brep referenced from the Rhino model> x764])
office_10 = Brep([<brep referenced from the Rhino model> x2522])
restaurant_10 = Brep([<brep referenced from the Rhino model> x53])
commerce_10 = Brep([<brep referenced from the Rhino model> x65])
education_10 = Brep()
residence_10 = Brep([<brep referenced from the Rhino model> x980])
office_11 = Brep([<brep referenced from the Rhino model> x4408])
restaurant_11 = Brep([<brep referenced from the Rhino model> x83])
commerce_11 = Brep([<brep referenced from the Rhino model> x423])
education_11 = Brep()
evaluate_box_11 = EvaluateBox(Box=office_4, UParameter=0.5, VParameter=0.5, WParameter=0.5)  # -> Plane, Point, Include
evaluate_box_12 = EvaluateBox(Box=restaurant_4, UParameter=0.5, VParameter=0.5, WParameter=0.5)  # -> Plane, Point, Include
evaluate_box_13 = EvaluateBox(Box=office_3, UParameter=0.5, VParameter=0.5, WParameter=0.5)  # -> Plane, Point, Include
evaluate_box_14 = EvaluateBox(Box=restaurant_3, UParameter=0.5, VParameter=0.5, WParameter=0.5)  # -> Plane, Point, Include
residence_11 = Brep([<brep referenced from the Rhino model> x382])
evaluate_box_15 = EvaluateBox(Box=commerce_4, UParameter=0.5, VParameter=0.5, WParameter=0.5)  # -> Plane, Point, Include
evaluate_box_16 = EvaluateBox(Box=commerce_3, UParameter=0.5, VParameter=0.5, WParameter=0.5)  # -> Plane, Point, Include
office_12 = Brep([<brep referenced from the Rhino model> x3841])
evaluate_box_17 = EvaluateBox(Box=education_3, UParameter=0.5, VParameter=0.5, WParameter=0.5)  # -> Plane, Point, Include
restaurant_12 = Brep([<brep referenced from the Rhino model> x221])
commerce_12 = Brep([<brep referenced from the Rhino model> x115])
evaluate_box_18 = EvaluateBox(Box=education_4, UParameter=0.5, VParameter=0.5, WParameter=0.5)  # -> Plane, Point, Include
evaluate_box_19 = EvaluateBox(Box=residence_4, UParameter=0.5, VParameter=0.5, WParameter=0.5)  # -> Plane, Point, Include
brep_9 = Brep([<brep referenced from the Rhino model> x342])
evaluate_box_20 = EvaluateBox(Box=residence_3, UParameter=0.5, VParameter=0.5, WParameter=0.5)  # -> Plane, Point, Include
education_12 = Brep()
evaluate_box_21 = EvaluateBox(Box=office_6, UParameter=0.5, VParameter=0.5, WParameter=0.5)  # -> Plane, Point, Include
evaluate_box_22 = EvaluateBox(Box=restaurant_6, UParameter=0.5, VParameter=0.5, WParameter=0.5)  # -> Plane, Point, Include
evaluate_box_23 = EvaluateBox(Box=office_5, UParameter=0.5, VParameter=0.5, WParameter=0.5)  # -> Plane, Point, Include
evaluate_box_24 = EvaluateBox(Box=restaurant_5, UParameter=0.5, VParameter=0.5, WParameter=0.5)  # -> Plane, Point, Include
residence_12 = Brep([<brep referenced from the Rhino model> x836])
evaluate_box_25 = EvaluateBox(Box=commerce_6, UParameter=0.5, VParameter=0.5, WParameter=0.5)  # -> Plane, Point, Include
evaluate_box_26 = EvaluateBox(Box=commerce_5, UParameter=0.5, VParameter=0.5, WParameter=0.5)  # -> Plane, Point, Include
evaluate_box_27 = EvaluateBox(Box=education_6, UParameter=0.5, VParameter=0.5, WParameter=0.5)  # -> Plane, Point, Include
evaluate_box_28 = EvaluateBox(Box=office_7, UParameter=0.5, VParameter=0.5, WParameter=0.5)  # -> Plane, Point, Include
evaluate_box_29 = EvaluateBox(Box=restaurant_7, UParameter=0.5, VParameter=0.5, WParameter=0.5)  # -> Plane, Point, Include
evaluate_box_30 = EvaluateBox(Box=education_5, UParameter=0.5, VParameter=0.5, WParameter=0.5)  # -> Plane, Point, Include
evaluate_box_31 = EvaluateBox(Box=commerce_7, UParameter=0.5, VParameter=0.5, WParameter=0.5)  # -> Plane, Point, Include
evaluate_box_32 = EvaluateBox(Box=residence_6, UParameter=0.5, VParameter=0.5, WParameter=0.5)  # -> Plane, Point, Include
evaluate_box_33 = EvaluateBox(Box=residence_5, UParameter=0.5, VParameter=0.5, WParameter=0.5)  # -> Plane, Point, Include
evaluate_box_34 = EvaluateBox(Box=education_7, UParameter=0.5, VParameter=0.5, WParameter=0.5)  # -> Plane, Point, Include
evaluate_box_35 = EvaluateBox(Box=residence_7, UParameter=0.5, VParameter=0.5, WParameter=0.5)  # -> Plane, Point, Include
brep_10 = Brep([<brep referenced from the Rhino model> x703])
brep_11 = Brep([<brep referenced from the Rhino model> x1146])
evaluate_box_36 = EvaluateBox(Box=office_8, UParameter=0.5, VParameter=0.5, WParameter=0.5)  # -> Plane, Point, Include
evaluate_box_37 = EvaluateBox(Box=restaurant_8, UParameter=0.5, VParameter=0.5, WParameter=0.5)  # -> Plane, Point, Include
evaluate_box_38 = EvaluateBox(Box=commerce_8, UParameter=0.5, VParameter=0.5, WParameter=0.5)  # -> Plane, Point, Include
area = Area(Geometry=brep)  # -> Area, Centroid
brep_12 = Brep([<brep referenced from the Rhino model> x912])
evaluate_box_39 = EvaluateBox(Box=residence_8, UParameter=0.5, VParameter=0.5, WParameter=0.5)  # -> Plane, Point, Include
evaluate_box_40 = EvaluateBox(Box=office_9, UParameter=0.5, VParameter=0.5, WParameter=0.5)  # -> Plane, Point, Include
evaluate_box_41 = EvaluateBox(Box=restaurant_9, UParameter=0.5, VParameter=0.5, WParameter=0.5)  # -> Plane, Point, Include
brep_13 = Brep([<brep referenced from the Rhino model> x971])
evaluate_box_42 = EvaluateBox(Box=commerce_9, UParameter=0.5, VParameter=0.5, WParameter=0.5)  # -> Plane, Point, Include
evaluate_box_43 = EvaluateBox(Box=education_8, UParameter=0.5, VParameter=0.5, WParameter=0.5)  # -> Plane, Point, Include
area_2 = Area(Geometry=brep_2)  # -> Area, Centroid
evaluate_box_44 = EvaluateBox(Box=residence_9, UParameter=0.5, VParameter=0.5, WParameter=0.5)  # -> Plane, Point, Include
evaluate_box_45 = EvaluateBox(Box=education_9, UParameter=0.5, VParameter=0.5, WParameter=0.5)  # -> Plane, Point, Include
evaluate_box_46 = EvaluateBox(Box=brep_7, UParameter=0.5, VParameter=0.5, WParameter=0.5)  # -> Plane, Point, Include
evaluate_box_47 = EvaluateBox(Box=office_10, UParameter=0.5, VParameter=0.5, WParameter=0.5)  # -> Plane, Point, Include
evaluate_box_48 = EvaluateBox(Box=restaurant_10, UParameter=0.5, VParameter=0.5, WParameter=0.5)  # -> Plane, Point, Include
evaluate_box_49 = EvaluateBox(Box=commerce_10, UParameter=0.5, VParameter=0.5, WParameter=0.5)  # -> Plane, Point, Include
point = Point(evaluate_box.Point)
point_2 = Point(evaluate_box_2.Point)
point_3 = Point(evaluate_box_3.Point)
evaluate_box_50 = EvaluateBox(Box=education_10, UParameter=0.5, VParameter=0.5, WParameter=0.5)  # -> Plane, Point, Include
evaluate_box_51 = EvaluateBox(Box=residence_10, UParameter=0.5, VParameter=0.5, WParameter=0.5)  # -> Plane, Point, Include
point_4 = Point(evaluate_box_4.Point)
point_5 = Point(evaluate_box_5.Point)
evaluate_box_52 = EvaluateBox(Box=office_11, UParameter=0.5, VParameter=0.5, WParameter=0.5)  # -> Plane, Point, Include
evaluate_box_53 = EvaluateBox(Box=restaurant_11, UParameter=0.5, VParameter=0.5, WParameter=0.5)  # -> Plane, Point, Include
evaluate_box_54 = EvaluateBox(Box=commerce_11, UParameter=0.5, VParameter=0.5, WParameter=0.5)  # -> Plane, Point, Include
evaluate_box_55 = EvaluateBox(Box=education_11, UParameter=0.5, VParameter=0.5, WParameter=0.5)  # -> Plane, Point, Include
evaluate_box_56 = EvaluateBox(Box=residence_11, UParameter=0.5, VParameter=0.5, WParameter=0.5)  # -> Plane, Point, Include
evaluate_box_57 = EvaluateBox(Box=office_12, UParameter=0.5, VParameter=0.5, WParameter=0.5)  # -> Plane, Point, Include
evaluate_box_58 = EvaluateBox(Box=restaurant_12, UParameter=0.5, VParameter=0.5, WParameter=0.5)  # -> Plane, Point, Include
evaluate_box_59 = EvaluateBox(Box=commerce_12, UParameter=0.5, VParameter=0.5, WParameter=0.5)  # -> Plane, Point, Include
point_6 = Point(evaluate_box_6.Point)
evaluate_box_60 = EvaluateBox(Box=education_12, UParameter=0.5, VParameter=0.5, WParameter=0.5)  # -> Plane, Point, Include
point_7 = Point(evaluate_box_7.Point)
point_8 = Point(evaluate_box_8.Point)
evaluate_box_61 = EvaluateBox(Box=residence_12, UParameter=0.5, VParameter=0.5, WParameter=0.5)  # -> Plane, Point, Include
point_9 = Point(evaluate_box_9.Point)
point_10 = Point(evaluate_box_10.Point)
area_3 = Area(Geometry=brep_3)  # -> Area, Centroid
area_4 = Area(Geometry=brep_4)  # -> Area, Centroid
area_5 = Area(Geometry=brep_6)  # -> Area, Centroid
area_6 = Area(Geometry=brep_5)  # -> Area, Centroid
area_7 = Area(Geometry=brep_8)  # -> Area, Centroid
office_13 = Brep([<brep referenced from the Rhino model> x1925])
restaurant_13 = Brep([<brep referenced from the Rhino model> x81])
commerce_13 = Brep([<brep referenced from the Rhino model> x129])
education_13 = Brep([<brep referenced from the Rhino model> x80])
residence_13 = Brep([<brep referenced from the Rhino model> x437])
deconstruct = Deconstruct(Point=point)  # -> XComponent, YComponent, ZComponent
deconstruct_2 = Deconstruct(Point=point_2)  # -> XComponent, YComponent, ZComponent
point_11 = Point(evaluate_box_13.Point)
point_12 = Point(evaluate_box_11.Point)
point_13 = Point(evaluate_box_14.Point)
deconstruct_3 = Deconstruct(Point=point_3)  # -> XComponent, YComponent, ZComponent
point_14 = Point(evaluate_box_12.Point)
point_15 = Point(evaluate_box_16.Point)
point_16 = Point(evaluate_box_15.Point)
deconstruct_4 = Deconstruct(Point=point_4)  # -> XComponent, YComponent, ZComponent
point_17 = Point(evaluate_box_18.Point)
point_18 = Point(evaluate_box_17.Point)
deconstruct_5 = Deconstruct(Point=point_5)  # -> XComponent, YComponent, ZComponent
point_19 = Point(evaluate_box_19.Point)
point_20 = Point(evaluate_box_20.Point)
point_21 = Point(evaluate_box_23.Point)
point_22 = Point(evaluate_box_24.Point)
point_23 = Point(evaluate_box_21.Point)
point_24 = Point(evaluate_box_26.Point)
point_25 = Point(evaluate_box_22.Point)
area_8 = Area(Geometry=brep_9)  # -> Area, Centroid
point_26 = Point(evaluate_box_25.Point)
point_27 = Point(evaluate_box_28.Point)
point_28 = Point(evaluate_box_30.Point)
point_29 = Point(evaluate_box_29.Point)
point_30 = Point(evaluate_box_27.Point)
point_31 = Point(evaluate_box_31.Point)
deconstruct_6 = Deconstruct(Point=point_6)  # -> XComponent, YComponent, ZComponent
deconstruct_7 = Deconstruct(Point=point_7)  # -> XComponent, YComponent, ZComponent
point_32 = Point(evaluate_box_33.Point)
deconstruct_8 = Deconstruct(Point=point_8)  # -> XComponent, YComponent, ZComponent
point_33 = Point(evaluate_box_32.Point)
point_34 = Point(evaluate_box_34.Point)
deconstruct_9 = Deconstruct(Point=point_9)  # -> XComponent, YComponent, ZComponent
point_35 = Point(evaluate_box_35.Point)
deconstruct_10 = Deconstruct(Point=point_10)  # -> XComponent, YComponent, ZComponent
area_9 = Area(Geometry=brep_10)  # -> Area, Centroid
point_36 = Point(evaluate_box_36.Point)
area_10 = Area(Geometry=brep_11)  # -> Area, Centroid
brep_14 = Brep([<brep referenced from the Rhino model> x1209])
point_37 = Point(evaluate_box_37.Point)
point_38 = Point(evaluate_box_38.Point)
point_39 = Point(area.Centroid)
point_40 = Point(evaluate_box_39.Point)
area_11 = Area(Geometry=brep_12)  # -> Area, Centroid
area_12 = Area(Geometry=brep_13)  # -> Area, Centroid
point_41 = Point(evaluate_box_40.Point)
point_42 = Point(evaluate_box_41.Point)
deconstruct_11 = Deconstruct(Point=point_12)  # -> XComponent, YComponent, ZComponent
deconstruct_12 = Deconstruct(Point=point_14)  # -> XComponent, YComponent, ZComponent
point_43 = Point(evaluate_box_42.Point)
deconstruct_13 = Deconstruct(Point=point_11)  # -> XComponent, YComponent, ZComponent
deconstruct_14 = Deconstruct(Point=point_13)  # -> XComponent, YComponent, ZComponent
deconstruct_15 = Deconstruct(Point=point_16)  # -> XComponent, YComponent, ZComponent
deconstruct_16 = Deconstruct(Point=point_15)  # -> XComponent, YComponent, ZComponent
point_44 = Point(evaluate_box_43.Point)
deconstruct_17 = Deconstruct(Point=point_18)  # -> XComponent, YComponent, ZComponent
point_45 = Point(area_2.Centroid)
point_46 = Point(evaluate_box_44.Point)
point_47 = Point(evaluate_box_45.Point)
deconstruct_18 = Deconstruct(Point=point_17)  # -> XComponent, YComponent, ZComponent
point_48 = Point(evaluate_box_46.Point)
deconstruct_19 = Deconstruct(Point=point_19)  # -> XComponent, YComponent, ZComponent
deconstruct_20 = Deconstruct(Point=point_20)  # -> XComponent, YComponent, ZComponent
deconstruct_21 = Deconstruct(Point=point_23)  # -> XComponent, YComponent, ZComponent
deconstruct_22 = Deconstruct(Point=point_25)  # -> XComponent, YComponent, ZComponent
deconstruct_23 = Deconstruct(Point=point_21)  # -> XComponent, YComponent, ZComponent
deconstruct_24 = Deconstruct(Point=point_22)  # -> XComponent, YComponent, ZComponent
deconstruct_25 = Deconstruct(Point=point_26)  # -> XComponent, YComponent, ZComponent
deconstruct_26 = Deconstruct(Point=point_24)  # -> XComponent, YComponent, ZComponent
deconstruct_27 = Deconstruct(Point=point_30)  # -> XComponent, YComponent, ZComponent
deconstruct_28 = Deconstruct(Point=point_27)  # -> XComponent, YComponent, ZComponent
deconstruct_29 = Deconstruct(Point=point_29)  # -> XComponent, YComponent, ZComponent
deconstruct_30 = Deconstruct(Point=point_28)  # -> XComponent, YComponent, ZComponent
deconstruct_31 = Deconstruct(Point=point_31)  # -> XComponent, YComponent, ZComponent
deconstruct_32 = Deconstruct(Point=point_33)  # -> XComponent, YComponent, ZComponent
deconstruct_33 = Deconstruct(Point=point_32)  # -> XComponent, YComponent, ZComponent
deconstruct_34 = Deconstruct(Point=point_34)  # -> XComponent, YComponent, ZComponent
point_49 = Point(evaluate_box_47.Point)
point_50 = Point(evaluate_box_48.Point)
evaluate_box_62 = EvaluateBox(Box=office_13, UParameter=0.5, VParameter=0.5, WParameter=0.5)  # -> Plane, Point, Include
evaluate_box_63 = EvaluateBox(Box=restaurant_13, UParameter=0.5, VParameter=0.5, WParameter=0.5)  # -> Plane, Point, Include
point_51 = Point(evaluate_box_49.Point)
deconstruct_35 = Deconstruct(Point=point_35)  # -> XComponent, YComponent, ZComponent
evaluate_box_64 = EvaluateBox(Box=commerce_13, UParameter=0.5, VParameter=0.5, WParameter=0.5)  # -> Plane, Point, Include
point_52 = Point(evaluate_box_50.Point)
evaluate_box_65 = EvaluateBox(Box=education_13, UParameter=0.5, VParameter=0.5, WParameter=0.5)  # -> Plane, Point, Include
point_53 = Point(evaluate_box_51.Point)
evaluate_box_66 = EvaluateBox(Box=residence_13, UParameter=0.5, VParameter=0.5, WParameter=0.5)  # -> Plane, Point, Include
point_54 = Point(evaluate_box_52.Point)
point_55 = Point(evaluate_box_53.Point)
point_56 = Point(evaluate_box_54.Point)
point_57 = Point(evaluate_box_55.Point)
point_58 = Point(evaluate_box_56.Point)
point_59 = Point(evaluate_box_57.Point)
point_60 = Point(evaluate_box_58.Point)
point_61 = Point(evaluate_box_59.Point)
point_62 = Point(evaluate_box_60.Point)
point_63 = Point(evaluate_box_61.Point)
deconstruct_36 = Deconstruct(Point=point_36)  # -> XComponent, YComponent, ZComponent
deconstruct_37 = Deconstruct(Point=point_37)  # -> XComponent, YComponent, ZComponent
deconstruct_38 = Deconstruct(Point=point_38)  # -> XComponent, YComponent, ZComponent
deconstruct_39 = Deconstruct(Point=point_40)  # -> XComponent, YComponent, ZComponent
point_64 = Point(area_3.Centroid)
point_65 = Point(area_4.Centroid)
deconstruct_40 = Deconstruct(Point=point_39)  # -> XComponent, YComponent, ZComponent
deconstruct_41 = Deconstruct(Point=point_41)  # -> XComponent, YComponent, ZComponent
deconstruct_42 = Deconstruct(Point=point_42)  # -> XComponent, YComponent, ZComponent
point_66 = Point(area_6.Centroid)
deconstruct_43 = Deconstruct(Point=point_43)  # -> XComponent, YComponent, ZComponent
point_67 = Point(area_5.Centroid)
deconstruct_44 = Deconstruct(Point=point_44)  # -> XComponent, YComponent, ZComponent
point_68 = Point(area_7.Centroid)
deconstruct_45 = Deconstruct(Point=point_46)  # -> XComponent, YComponent, ZComponent
deconstruct_46 = Deconstruct(Point=point_45)  # -> XComponent, YComponent, ZComponent
deconstruct_47 = Deconstruct(Point=point_47)  # -> XComponent, YComponent, ZComponent
deconstruct_48 = Deconstruct(Point=point_48)  # -> XComponent, YComponent, ZComponent
deconstruct_49 = Deconstruct(Point=point_49)  # -> XComponent, YComponent, ZComponent
deconstruct_50 = Deconstruct(Point=point_50)  # -> XComponent, YComponent, ZComponent
deconstruct_51 = Deconstruct(Point=point_51)  # -> XComponent, YComponent, ZComponent
deconstruct_52 = Deconstruct(Point=point_52)  # -> XComponent, YComponent, ZComponent
deconstruct_53 = Deconstruct(Point=point_53)  # -> XComponent, YComponent, ZComponent
deconstruct_54 = Deconstruct(Point=point_54)  # -> XComponent, YComponent, ZComponent
deconstruct_55 = Deconstruct(Point=point_55)  # -> XComponent, YComponent, ZComponent
deconstruct_56 = Deconstruct(Point=point_56)  # -> XComponent, YComponent, ZComponent
deconstruct_57 = Deconstruct(Point=point_57)  # -> XComponent, YComponent, ZComponent
deconstruct_58 = Deconstruct(Point=point_58)  # -> XComponent, YComponent, ZComponent
deconstruct_59 = Deconstruct(Point=point_59)  # -> XComponent, YComponent, ZComponent
deconstruct_60 = Deconstruct(Point=point_60)  # -> XComponent, YComponent, ZComponent
point_69 = Point(area_8.Centroid)
deconstruct_61 = Deconstruct(Point=point_61)  # -> XComponent, YComponent, ZComponent
deconstruct_62 = Deconstruct(Point=point_62)  # -> XComponent, YComponent, ZComponent
deconstruct_63 = Deconstruct(Point=point_63)  # -> XComponent, YComponent, ZComponent
point_70 = Point(area_9.Centroid)
deconstruct_64 = Deconstruct(Point=point_64)  # -> XComponent, YComponent, ZComponent
deconstruct_65 = Deconstruct(Point=point_65)  # -> XComponent, YComponent, ZComponent
deconstruct_66 = Deconstruct(Point=point_67)  # -> XComponent, YComponent, ZComponent
deconstruct_67 = Deconstruct(Point=point_66)  # -> XComponent, YComponent, ZComponent
deconstruct_68 = Deconstruct(Point=point_68)  # -> XComponent, YComponent, ZComponent
area_13 = Area(Geometry=brep_14)  # -> Area, Centroid
point_71 = Point(area_10.Centroid)
office_14 = Brep([<brep referenced from the Rhino model> x2628])
point_72 = Point(area_11.Centroid)
restaurant_14 = Brep([<brep referenced from the Rhino model> x105])
commerce_14 = Brep([<brep referenced from the Rhino model> x186])
education_14 = Brep()
residence_14 = Brep([<brep referenced from the Rhino model> x29])
point_73 = Point(area_12.Centroid)
deconstruct_69 = Deconstruct(Point=point_69)  # -> XComponent, YComponent, ZComponent
point_74 = Point(evaluate_box_62.Point)
point_75 = Point(evaluate_box_63.Point)
point_76 = Point(evaluate_box_64.Point)
number_slider_2 = Slider(10, range=1..20)
point_77 = Point(evaluate_box_65.Point)
point_78 = Point(evaluate_box_66.Point)
deconstruct_70 = Deconstruct(Point=point_70)  # -> XComponent, YComponent, ZComponent
list_length = ListLength(List=point)
list_length_2 = ListLength(List=point_2)
list_length_3 = ListLength(List=point_3)
list_length_4 = ListLength(List=point_4)
number_slider_3 = Slider(10, range=1..20)
list_length_5 = ListLength(List=point_5)
list_length_6 = ListLength(List=point_6)
deconstruct_71 = Deconstruct(Point=point_71)  # -> XComponent, YComponent, ZComponent
brep_15 = Brep([<brep referenced from the Rhino model> x638])
list_length_7 = ListLength(List=point_7)
list_length_8 = ListLength(List=point_8)
list_length_9 = ListLength(List=point_9)
list_length_10 = ListLength(List=point_10)
deconstruct_72 = Deconstruct(Point=point_72)  # -> XComponent, YComponent, ZComponent
deconstruct_73 = Deconstruct(Point=point_73)  # -> XComponent, YComponent, ZComponent
ghpython_script = GhPythonScript(x=deconstruct_47.XComponent, y=deconstruct_47.YComponent, z=deconstruct_47.ZComponent)  # -> out, a, b; inputs x: list; unedited script template
ghpython_script_2 = GhPythonScript(x=deconstruct_48.XComponent, y=deconstruct_48.YComponent, z=deconstruct_48.ZComponent)  # -> out, a, b; inputs x: list; unedited script template
deconstruct_74 = Deconstruct(Point=point_74)  # -> XComponent, YComponent, ZComponent
deconstruct_75 = Deconstruct(Point=point_75)  # -> XComponent, YComponent, ZComponent
deconstruct_76 = Deconstruct(Point=point_76)  # -> XComponent, YComponent, ZComponent
evaluate_box_67 = EvaluateBox(Box=office_14, UParameter=0.5, VParameter=0.5, WParameter=0.5)  # -> Plane, Point, Include
evaluate_box_68 = EvaluateBox(Box=restaurant_14, UParameter=0.5, VParameter=0.5, WParameter=0.5)  # -> Plane, Point, Include
evaluate_box_69 = EvaluateBox(Box=commerce_14, UParameter=0.5, VParameter=0.5, WParameter=0.5)  # -> Plane, Point, Include
deconstruct_77 = Deconstruct(Point=point_77)  # -> XComponent, YComponent, ZComponent
number_slider_4 = Slider(10, range=1..20)
number_slider_5 = Slider(10, range=1..20)
evaluate_box_70 = EvaluateBox(Box=education_14, UParameter=0.5, VParameter=0.5, WParameter=0.5)  # -> Plane, Point, Include
deconstruct_78 = Deconstruct(Point=point_78)  # -> XComponent, YComponent, ZComponent
evaluate_box_71 = EvaluateBox(Box=residence_14, UParameter=0.5, VParameter=0.5, WParameter=0.5)  # -> Plane, Point, Include
list_length_11 = ListLength(List=point_20)
number_slider_6 = Slider(10, range=1..20)
list_length_12 = ListLength(List=point_12)
number_slider_7 = Slider(10, range=1..20)
list_length_13 = ListLength(List=point_11)
list_length_14 = ListLength(List=point_14)
number_slider_8 = Slider(10, range=1..20)
list_length_15 = ListLength(List=point_16)
list_length_16 = ListLength(List=point_18)
list_length_17 = ListLength(List=point_13)
list_length_18 = ListLength(List=point_15)
list_length_19 = ListLength(List=point_17)
list_length_20 = ListLength(List=point_19)
list_length_21 = ListLength(List=point_23)
list_length_22 = ListLength(List=point_21)
list_length_23 = ListLength(List=point_25)
list_length_24 = ListLength(List=point_27)
list_length_25 = ListLength(List=point_22)
list_length_26 = ListLength(List=point_26)
list_length_27 = ListLength(List=point_30)
list_length_28 = ListLength(List=point_24)
list_length_29 = ListLength(List=point_28)
list_length_30 = ListLength(List=point_33)
list_length_31 = ListLength(List=point_29)
list_length_32 = ListLength(List=point_32)
list_length_33 = ListLength(List=point_31)
list_length_34 = ListLength(List=point_34)
list_length_35 = ListLength(List=point_35)
number_slider_9 = Slider(10, range=1..20)
point_79 = Point(area_13.Centroid)
number_slider_10 = Slider(10, range=1..20)
list_length_36 = ListLength(List=point_41)
list_length_37 = ListLength(List=point_42)
list_length_38 = ListLength(List=point_43)
list_length_39 = ListLength(List=point_44)
list_length_40 = ListLength(List=point_46)
number_slider_11 = Slider(10, range=1..20)
list_length_41 = ListLength(List=point_49)
number_slider_12 = Slider(10, range=1..20)
list_length_42 = ListLength(List=point_50)
list_length_43 = ListLength(List=point_51)
list_length_44 = ListLength(List=point_52)
list_length_45 = ListLength(List=point_53)
number_slider_13 = Slider(10, range=1..20)
list_length_46 = ListLength(List=point_54)
list_length_47 = ListLength(List=point_55)
list_length_48 = ListLength(List=point_56)
list_length_49 = ListLength(List=point_57)
list_length_50 = ListLength(List=point_59)
list_length_51 = ListLength(List=point_58)
list_length_52 = ListLength(List=point_60)
list_length_53 = ListLength(List=point_61)
list_length_54 = ListLength(List=point_62)
area_14 = Area(Geometry=brep_15)  # -> Area, Centroid
deconstruct_79 = Deconstruct(Point=point_79)  # -> XComponent, YComponent, ZComponent
list_length_55 = ListLength(List=point_63)
ghpython_script_3 = GhPythonScript(office=list_length, restaurant=list_length_2, market=list_length_3, residence=list_length_5, education=list_length_4)  # -> out, food, ffood, officesp, furniture, daily
# ---------- ghpython_script_3: Python ----------
__author__ = "laoma"
__version__ = "2022.03.16"

import rhinoscriptsyntax as rs
if residence==None:
    residence=0
if education==None:
    education=0
food=20*0.0013*office+(0.0008*20*market)+(0.15*15*restaurant)+(0.005*8*residence)+(0.0018*50*education)
ffood=20*0.001*office+(0.0006*20*market)+(0.09*15*restaurant)+(0.003*8*residence)+(0.001*50*education)
officesp=20*0.0063*office+(0.0017*20*market)+(0.0008*15*restaurant)+(0.0003*8*residence)+(0.009*50*education)
furniture=20*0.746*office+(0.221*20*market)+(1.113*15*restaurant)+(1.113*8*residence)+(0.294*50*education)
daily=20*0.017*office+(0.55*20*market)+(0.005*15*restaurant)+(0.021*8*residence)+(0.007*50*education)
# ---------- end ghpython_script_3 ----------
point_80 = Point(evaluate_box_67.Point)
point_81 = Point(evaluate_box_68.Point)
point_82 = Point(evaluate_box_69.Point)
point_83 = Point(evaluate_box_70.Point)
point_84 = Point(evaluate_box_71.Point)
ghpython_script_4 = GhPythonScript(office=list_length_6, restaurant=list_length_7, market=list_length_8, residence=list_length_10, education=list_length_9)  # -> out, food, ffood, officesp, furniture, daily; same code as ghpython_script_3
ghpython_script_5 = GhPythonScript(
    office=list_length_13,
    restaurant=list_length_17,
    market=list_length_18,
    residence=list_length_11,
    education=list_length_19)  # -> out, food, ffood, officesp, furniture, daily
# ---------- ghpython_script_5: Python ----------
__author__ = "laoma"
__version__ = "2022.03.16"

import rhinoscriptsyntax as rs
if residence==None:
    residence=0
food=20*0.0013*office+(0.0008*20*market)+(0.15*15*restaurant)+(0.005*8*residence)+(0.0018*50*education)
ffood=20*0.001*office+(0.0006*20*market)+(0.09*15*restaurant)+(0.003*8*residence)+(0.001*50*education)
officesp=20*0.0063*office+(0.0017*20*market)+(0.0008*15*restaurant)+(0.0003*8*residence)+(0.009*50*education)
furniture=20*0.746*office+(0.221*20*market)+(1.113*15*restaurant)+(1.113*8*residence)+(0.294*50*education)
daily=20*0.017*office+(0.55*20*market)+(0.005*15*restaurant)+(0.021*8*residence)+(0.007*50*education)
# ---------- end ghpython_script_5 ----------
ghpython_script_6 = GhPythonScript(
    X=deconstruct_40.XComponent,
    Y=deconstruct_40.YComponent,
    Z=deconstruct_40.ZComponent,
    officeX=deconstruct.XComponent,
    officeY=deconstruct.YComponent,
    officeZ=deconstruct.ZComponent,
    restaurantX=deconstruct_2.XComponent,
    restaurantY=deconstruct_2.YComponent,
    restaurantZ=deconstruct_2.ZComponent,
    commerceX=deconstruct_3.XComponent,
    commerceY=deconstruct_3.YComponent,
    commerceZ=deconstruct_3.ZComponent,
    residenceX=deconstruct_5.XComponent,
    residenceY=deconstruct_5.YComponent,
    residenceZ=deconstruct_5.ZComponent,
    generation=number_slider,
    Food=ghpython_script_3.food,
    Frozen_food=ghpython_script_3.ffood,
    Office_supplies=ghpython_script_3.officesp,
    Furniture=ghpython_script_3.furniture,
    Daily_necessities=ghpython_script_3.daily)  # -> out, officepoints, restaurantpoints, marketpoints, residencepoints, educationpoints, voidpoints; inputs X: list, Y: list, Z: list, officeX: list, officeY: list, officeZ: list, restaurantX: list, restaurantY: list, restaurantZ: list, commerceX: list, commerceY: list, commerceZ: list, residenceX: list, residenceY: list, residenceZ: list, educationX: list, educationY: list, educationZ: list
# ---------- ghpython_script_6: Python ----------
__author__ = "laoma"
__version__ = "2022.03.12"

import rhinoscriptsyntax as rs
import random
from ghpythonlib.componentbase import executingcomponent as component
import Grasshopper, GhPython
import Rhino.Geometry as rg


class Cell:
  def __init__(self, x, y, z):
    self.x = x
    self.y = y
    self.z = z
    self.type = None

class Cell_void(Cell):
    def __init__(self, x, y, z):
        self.x = x
        self.y = y
        self.z = z
        self.type = 'void'
        self.neighbours = []
        self.food=0
        self.ffood=0
        self.office_supplies=0
        self.furniture=0
        self.daily=0

    def behaviour(self):
        return 'void'


    def getNeighbourCoordinates(self):
        neighbours = []
        list1=[-10,0,10]
        list2=[-4,0,4]
        for i in list1:
            for j in list1:
                for k in list2:
                    neighbours.append([self.x+i, self.y+j, self.z+k])
        neighbours.remove([self.x,self.y,self.z])
        return neighbours

class Cell_office(Cell):
    def __init__(self, x, y, z):
        self.x = x
        self.y = y
        self.z = z
        self.type = 'office'
        self.neighbours = []
        self.food=0.0013*20
        self.ffood=0.001*20
        self.office_supplies=0.0063*20
        self.furniture=0.746*20
        self.daily=0.017*20

    def behaviour(self):
        nrlive = 0
        resi=0
        for n in self.neighbours:
            if n.type == 'office':
                nrlive += 1
            if n.type =='residence':
                resi+=1
        if nrlive<=7:
            return 'office'
        elif 10<=nrlive<=12:
            return 'residence'
        elif nrlive>=20:
            return 'void'
        else:
            return 'office'


    def getNeighbourCoordinates(self):
        neighbours = []
        list1=[-10,0,10]
        list2=[-4,0,4]
        for i in list1:
            for j in list1:
                for k in list2:
                    neighbours.append([self.x+i, self.y+j, self.z+k])
        neighbours.remove([self.x,self.y,self.z])
        return neighbours

class Cell_restaurant(Cell):
    def __init__(self, x, y, z):
        self.x = x
        self.y = y
        self.z = z
        self.type = 'restaurant'
        self.neighbours = []
        self.food=0.15*15
        self.ffood=0.09*15
        self.office_supplies=0.0008*15
        self.furniture=0.375*15
        self.daily=0.005*15

    def behaviour(self):
        nrlive = 0
        for n in self.neighbours:
            if n.type == 'restaurant':
                nrlive += 1
        if nrlive <=3:
            return 'market'
        elif 11<=nrlive<=17:
            return 'market'

        elif nrlive>=22:
            return 'void'
        else:
            return 'restaurant'

    def getNeighbourCoordinates(self):
        neighbours = []
        list1=[-10,0,10]
        list2=[-4,0,4]
        for i in list1:
            for j in list1:
                for k in list2:
                    neighbours.append([self.x+i, self.y+j, self.z+k])
        neighbours.remove([self.x,self.y,self.z])
        return neighbours

class Cell_market(Cell):
    def __init__(self, x, y, z):
        self.x = x
        self.y = y
        self.z = z
        self.type = 'market'
        self.neighbours = []
        self.food=0.0008*20
        self.ffood=0.0006*20
        self.office_supplies=0.0017*20
        self.furniture=0.221*20
        self.daily=0.55*20

    def behaviour(self):
        nrlive = 0
        for n in self.neighbours:
            if n.type == 'market':
                nrlive += 1
        if nrlive <=3:
            return 'residence'
        elif 8<=nrlive<=17:
            return 'restaurant'
        elif nrlive>=18:
            return 'void'

        else:
            return 'market'

    def getNeighbourCoordinates(self):
        neighbours = []
        list1=[-10,0,10]
        list2=[-4,0,4]
        for i in list1:
            for j in list1:
                for k in list2:
                    neighbours.append([self.x+i, self.y+j, self.z+k])
        neighbours.remove([self.x,self.y,self.z])
        return neighbours

class Cell_residence(Cell):
    def __init__(self, x, y, z):
        self.x = x
        self.y = y
        self.z = z
        self.type = 'residence'
        self.neighbours = []
        self.food=0.005*8
        self.ffood=0.003*8
        self.office_supplies=0.0003*8
        self.furniture=1.113*8
        self.daily=0.021*8

    def behaviour(self):
        nrlive = 0
        for n in self.neighbours:
            if n.type == 'residence':
                nrlive += 1
        if nrlive <=3:
            return 'office'
        elif 11<=nrlive<=13:
            return 'market'
        elif nrlive>=18:
            return 'void'
        else:
            return 'residence'

    def getNeighbourCoordinates(self):
        neighbours = []
        list1=[-10,0,10]
        list2=[-4,0,4]
        for i in list1:
            for j in list1:
                for k in list2:
                    neighbours.append([self.x+i, self.y+j, self.z+k])
        neighbours.remove([self.x,self.y,self.z])
        return neighbours

class Cell_education(Cell):
    def __init__(self, x, y, z):
        self.x = x
        self.y = y
        self.z = z
        self.type = 'education'
        self.neighbours = []
        self.food=0.0018*50
        self.ffood=0.001*50
        self.office_supplies=0.009*50
        self.furniture=0.294*50
        self.daily=0.007*50

    def behaviour(self):
        nrlive = 0
        for n in self.neighbours:
            if n.type == 'residence':
                nrlive += 1
        if nrlive <=3:
            return 'residence'
        elif 11<=nrlive<=13:
            return 'residence'
        elif nrlive>=20:
            return 'void'
        else:
            return 'education'

    def getNeighbourCoordinates(self):
        neighbours = []
        list1=[-10,0,10]
        list2=[-4,0,4]
        for i in list1:
            for j in list1:
                for k in list2:
                    neighbours.append([self.x+i, self.y+j, self.z+k])
        neighbours.remove([self.x,self.y,self.z])
        return neighbours

class Cell_space(Cell):
    def __init__(self, x, y, z):
        self.x = x
        self.y = y
        self.z = z
        self.type = 'space'
        self.neighbours = []
        self.food=0
        self.ffood=0
        self.office_supplies=0
        self.furniture=0
        self.daily=0

    def behaviour(self):
        office = 0
        residence=0
        restaurant=0
        market=0
        education=0
        space=0
        for n in self.neighbours:
            if n.type == 'office':
                office += 1
            elif n.type == 'residence':
                residence += 1
            elif n.type == 'restaurant':
                restaurant += 1
            elif n.type == 'market':
                market += 1
            elif n.type == 'education':
                education += 1
            elif n.type == 'space':
                space += 1
        if office>=8:
            return 'office'
        if residence>=8:
            return 'residence'



    def getNeighbourCoordinates(self):
        neighbours = []
        list1=[-10,0,10]
        list2=[-4,0,4]
        for i in list1:
            for j in list1:
                for k in list2:
                    neighbours.append([self.x+i, self.y+j, self.z+k])
        neighbours.remove([self.x,self.y,self.z])
        return neighbours

envcell=[]
for k in range(51):
    for i,j in zip(X,Y):
        if int(i)%5!=0:
            i=i+1
        if int(j)%5!=0:
            j=j+1
        envcell.append((int(i),int(j),int(k)*4+2))
spacecell=envcell[:]

celldict={}
if officeX != None:
    for i,j,k in zip(officeX,officeY,officeZ):
        if int(i)%5!=0:
            i=i+1
        if int(j)%5!=0:
            j=j+1
        c=Cell_office(int(i),int(j),int(k))
        celldict[int(i),int(j),int(k)]=c
        if spacecell.__contains__((int(i),int(j),int(k)))==True:
            spacecell.remove((int(i),int(j),int(k)))
if restaurantX != None:
    for i,j,k in zip(restaurantX,restaurantY,restaurantZ):
        if int(i)%5!=0:
            i=i+1
        if int(j)%5!=0:
            j=j+1
        c=Cell_restaurant(int(i),int(j),int(k))
        celldict[int(i),int(j),int(k)]=c
        if spacecell.__contains__((int(i),int(j),int(k)))==True:
            spacecell.remove((int(i),int(j),int(k)))
if commerceX != None:
    for i,j,k in zip(commerceX,commerceY,commerceZ):
        if int(i)%5!=0:
            i=i+1
        if int(j)%5!=0:
            j=j+1
        c=Cell_market(int(i),int(j),int(k))
        celldict[int(i),int(j),int(k)]=c
        if spacecell.__contains__((int(i),int(j),int(k)))==True:
            spacecell.remove((int(i),int(j),int(k)))
if residenceX != None:
    for i,j,k in zip(residenceX,residenceY,residenceZ):
        if int(i)%5!=0:
            i=i+1
        if int(j)%5!=0:
            j=j+1
        c=Cell_residence(int(i),int(j),int(k))
        celldict[int(i),int(j),int(k)]=c
        if spacecell.__contains__((int(i),int(j),int(k)))==True:
            spacecell.remove((int(i),int(j),int(k)))
if educationX != None:
    for i,j,k in zip(educationX,educationY,educationZ):
        if int(i)%5!=0:
            i=i+1
        if int(j)%5!=0:
            j=j+1
        c=Cell_education(int(i),int(j),int(k))
        celldict[int(i),int(j),int(k)]=c
        if spacecell.__contains__((int(i),int(j),int(k)))==True:
            spacecell.remove((int(i),int(j),int(k)))
for v in spacecell:
    c=Cell_space(v[0],v[1],v[2])
    celldict[v[0],v[1],v[2]]=c

for i in celldict:
    c=celldict[i]
    neigourCoords = c.getNeighbourCoordinates()
    for n in neigourCoords:
       if celldict.__contains__((n[0],n[1],n[2]))==True:
           c.neighbours.append(celldict[n[0],n[1],n[2]])


def evaluate(dict):
    food=Food
    frozen_food=Frozen_food
    office_supplies=Office_supplies
    furniture=Furniture
    daily_necessities=Daily_necessities
    nextCellDict={}
    for i in dict:
        c = dict[i]
        next = c.behaviour()
        if next == 'office':
            nCell = Cell_office(c.x,c.y,c.z)
            food=food+c.food-nCell.food
            frozen_food=frozen_food+c.ffood-nCell.ffood
            office_supplies=office_supplies+c.office_supplies-nCell.office_supplies
            furniture=furniture+c.furniture-nCell.furniture
            daily_necessities=daily_necessities+c.daily-nCell.daily
            if food>=0 and frozen_food>=0 and office_supplies>=0 and furniture>=0 and daily_necessities>=0:
                nextCellDict[c.x,c.y,c.z] = nCell
        elif next == 'restaurant':
            nCell = Cell_restaurant(c.x,c.y,c.z)
            food=food+c.food-nCell.food
            frozen_food=frozen_food+c.ffood-nCell.ffood
            office_supplies=office_supplies+c.office_supplies-nCell.office_supplies
            furniture=furniture+c.furniture-nCell.furniture
            daily_necessities=daily_necessities+c.daily-nCell.daily
            if food>=0 and frozen_food>=0 and office_supplies>=0 and furniture>=0 and daily_necessities>=0:
                nextCellDict[c.x,c.y,c.z] = nCell
        elif next == 'market':
            nCell = Cell_market(c.x,c.y,c.z)
            food=food+c.food-nCell.food
            frozen_food=frozen_food+c.ffood-nCell.ffood
            office_supplies=office_supplies+c.office_supplies-nCell.office_supplies
            furniture=furniture+c.furniture-nCell.furniture
            daily_necessities=daily_necessities+c.daily-nCell.daily
            if food>=0 and frozen_food>=0 and office_supplies>=0 and furniture>=0 and daily_necessities>=0:
                nextCellDict[c.x,c.y,c.z] = nCell
        elif next == 'residence':
            nCell = Cell_residence(c.x,c.y,c.z)
            food=food+c.food-nCell.food
            frozen_food=frozen_food+c.ffood-nCell.ffood
            office_supplies=office_supplies+c.office_supplies-nCell.office_supplies
            furniture=furniture+c.furniture-nCell.furniture
            daily_necessities=daily_necessities+c.daily-nCell.daily
            if food>=0 and frozen_food>=0 and office_supplies>=0 and furniture>=0 and daily_necessities>=0:
                nextCellDict[c.x,c.y,c.z] = nCell
        elif next == 'education':
            nCell = Cell_education(c.x,c.y,c.z)
            food=food+c.food-nCell.food
            frozen_food=frozen_food+c.ffood-nCell.ffood
            office_supplies=office_supplies+c.office_supplies-nCell.office_supplies
            furniture=furniture+c.furniture-nCell.furniture
            daily_necessities=daily_necessities+c.daily-nCell.daily
            if food>=0 and frozen_food>=0 and office_supplies>=0 and furniture>=0 and daily_necessities>=0:
                nextCellDict[c.x,c.y,c.z] = nCell
        elif next == 'void':
            nCell = Cell_void(c.x,c.y,c.z)
            nextCellDict[c.x,c.y,c.z] = nCell
            food=food+c.food
            frozen_food=frozen_food+c.ffood
            office_supplies=office_supplies+c.office_supplies
            furniture=furniture+c.furniture
            daily_necessities=daily_necessities+c.daily
        else:
            c.neighbours = []
            nextCellDict[c.x,c.y,c.z] = c

    for i in nextCellDict:
        c = nextCellDict[i]
        neigourCoords = c.getNeighbourCoordinates()
        for n in neigourCoords:
            if nextCellDict.__contains__((n[0],n[1],n[2]))==True:
                c.neighbours.append(nextCellDict[n[0],n[1],n[2]])

    dict = nextCellDict
    return dict,food,frozen_food,office_supplies,furniture,daily_necessities

officelist=[]
restaurantlist=[]
marketlist=[]
residencelist=[]
educationlist=[]
voidlist=[]

for g in range(int(generation)):
    officelist=[]
    restaurantlist=[]
    marketlist=[]
    residencelist=[]
    educationlist=[]
    voidlist=[]
    for i in celldict:
        c=celldict[i]
        if c.type=='office':
            officelist.append([c.x,c.y,c.z])
        elif c.type=='restaurant':
            restaurantlist.append([c.x,c.y,c.z])
        elif c.type=='market':
            marketlist.append([c.x,c.y,c.z])
        elif c.type=='residence':
            residencelist.append([c.x,c.y,c.z])
        elif c.type=='education':
            educationlist.append([c.x,c.y,c.z])
        elif c.type=='void':
            voidlist.append([c.x,c.y,c.z])
    celldict,cfood,cffood,coffice,cfurniture,cdaily=evaluate(celldict)

officepoints=[]
restaurantpoints=[]
marketpoints=[]
residencepoints=[]
educationpoints=[]
voidpoints=[]
for p in officelist:
    point3d=rg.Point3d(int(p[0]),int(p[1]),int(p[2]))
    officepoints.append(point3d)
for p in restaurantlist:
    point3d=rg.Point3d(int(p[0]),int(p[1]),int(p[2]))
    restaurantpoints.append(point3d)
for p in marketlist:
    point3d=rg.Point3d(int(p[0]),int(p[1]),int(p[2]))
    marketpoints.append(point3d)
for p in residencelist:
    point3d=rg.Point3d(int(p[0]),int(p[1]),int(p[2]))
    residencepoints.append(point3d)
for p in educationlist:
    point3d=rg.Point3d(int(p[0]),int(p[1]),int(p[2]))
    educationpoints.append(point3d)
for p in voidlist:
    point3d=rg.Point3d(int(p[0]),int(p[1]),int(p[2]))
    voidpoints.append(point3d)
# ---------- end ghpython_script_6 ----------
ghpython_script_7 = GhPythonScript(
    X=deconstruct_46.XComponent,
    Y=deconstruct_46.YComponent,
    Z=deconstruct_46.ZComponent,
    officeX=deconstruct_6.XComponent,
    officeY=deconstruct_6.YComponent,
    officeZ=deconstruct_6.ZComponent,
    restaurantX=deconstruct_7.XComponent,
    restaurantY=deconstruct_7.YComponent,
    restaurantZ=deconstruct_7.ZComponent,
    commerceX=deconstruct_8.XComponent,
    commerceY=deconstruct_8.YComponent,
    commerceZ=deconstruct_8.ZComponent,
    residenceX=deconstruct_10.XComponent,
    residenceY=deconstruct_10.YComponent,
    residenceZ=deconstruct_10.ZComponent,
    educationX=deconstruct_9.XComponent,
    educationY=deconstruct_9.YComponent,
    educationZ=deconstruct_9.ZComponent,
    generation=number_slider,
    Food=ghpython_script_4.food,
    Frozen_food=ghpython_script_4.ffood,
    Office_supplies=ghpython_script_4.officesp,
    Furniture=ghpython_script_4.furniture,
    Daily_necessities=ghpython_script_4.daily)  # -> out, officepoints, restaurantpoints, marketpoints, residencepoints, educationpoints, voidpoints; inputs X: list, Y: list, Z: list, officeX: list, officeY: list, officeZ: list, restaurantX: list, restaurantY: list, restaurantZ: list, commerceX: list, commerceY: list, commerceZ: list, residenceX: list, residenceY: list, residenceZ: list, educationX: list, educationY: list, educationZ: list
# ---------- ghpython_script_7: Python ----------
__author__ = "laoma"
__version__ = "2022.03.12"

import rhinoscriptsyntax as rs
import random
from ghpythonlib.componentbase import executingcomponent as component
import Grasshopper, GhPython
import Rhino.Geometry as rg


class Cell:
  def __init__(self, x, y, z):
    self.x = x
    self.y = y
    self.z = z
    self.type = None

class Cell_void(Cell):
    def __init__(self, x, y, z):
        self.x = x
        self.y = y
        self.z = z
        self.type = 'void'
        self.neighbours = []
        self.food=0
        self.ffood=0
        self.office_supplies=0
        self.furniture=0
        self.daily=0

    def behaviour(self):
        market=0
        for n in self.neighbours:
            if n.type == 'market':
                market += 1
        if market<=3:
            return 'market'
        else:
            return 'void'


    def getNeighbourCoordinates(self):
        neighbours = []
        list1=[-10,0,10]
        list2=[-4,0,4]
        for i in list1:
            for j in list1:
                for k in list2:
                    neighbours.append([self.x+i, self.y+j, self.z+k])
        neighbours.remove([self.x,self.y,self.z])
        return neighbours

class Cell_office(Cell):
    def __init__(self, x, y, z):
        self.x = x
        self.y = y
        self.z = z
        self.type = 'office'
        self.neighbours = []
        self.food=0.0013*20
        self.ffood=0.001*20
        self.office_supplies=0.0063*20
        self.furniture=0.746*20
        self.daily=0.017*20

    def behaviour(self):
        nrlive = 0
        resi=0
        for n in self.neighbours:
            if n.type == 'office':
                nrlive += 1
            if n.type =='residence':
                resi+=1
        if nrlive<=7:
            return 'office'
        elif 10<=nrlive<=12:
            return 'residence'
        elif nrlive>=20:
            return 'void'
        else:
            return 'office'


    def getNeighbourCoordinates(self):
        neighbours = []
        list1=[-10,0,10]
        list2=[-4,0,4]
        for i in list1:
            for j in list1:
                for k in list2:
                    neighbours.append([self.x+i, self.y+j, self.z+k])
        neighbours.remove([self.x,self.y,self.z])
        return neighbours

class Cell_restaurant(Cell):
    def __init__(self, x, y, z):
        self.x = x
        self.y = y
        self.z = z
        self.type = 'restaurant'
        self.neighbours = []
        self.food=0.15*15
        self.ffood=0.09*15
        self.office_supplies=0.0008*15
        self.furniture=0.375*15
        self.daily=0.005*15

    def behaviour(self):
        nrlive = 0
        for n in self.neighbours:
            if n.type == 'restaurant':
                nrlive += 1
        if nrlive <=3:
            return 'market'
        elif 11<=nrlive<=17:
            return 'market'

        elif nrlive>=22:
            return 'void'
        else:
            return 'restaurant'

    def getNeighbourCoordinates(self):
        neighbours = []
        list1=[-10,0,10]
        list2=[-4,0,4]
        for i in list1:
            for j in list1:
                for k in list2:
                    neighbours.append([self.x+i, self.y+j, self.z+k])
        neighbours.remove([self.x,self.y,self.z])
        return neighbours

class Cell_market(Cell):
    def __init__(self, x, y, z):
        self.x = x
        self.y = y
        self.z = z
        self.type = 'market'
        self.neighbours = []
        self.food=0.0008*20
        self.ffood=0.0006*20
        self.office_supplies=0.0017*20
        self.furniture=0.221*20
        self.daily=0.55*20

    def behaviour(self):
        nrlive = 0
        for n in self.neighbours:
            if n.type == 'market':
                nrlive += 1
        if nrlive <=3:
            return 'residence'
        elif 8<=nrlive<=17:
            return 'restaurant'
        elif nrlive>=18:
            return 'void'

        else:
            return 'market'

    def getNeighbourCoordinates(self):
        neighbours = []
        list1=[-10,0,10]
        list2=[-4,0,4]
        for i in list1:
            for j in list1:
                for k in list2:
                    neighbours.append([self.x+i, self.y+j, self.z+k])
        neighbours.remove([self.x,self.y,self.z])
        return neighbours

class Cell_residence(Cell):
    def __init__(self, x, y, z):
        self.x = x
        self.y = y
        self.z = z
        self.type = 'residence'
        self.neighbours = []
        self.food=0.005*8
        self.ffood=0.003*8
        self.office_supplies=0.0003*8
        self.furniture=1.113*8
        self.daily=0.021*8

    def behaviour(self):
        nrlive = 0
        for n in self.neighbours:
            if n.type == 'residence':
                nrlive += 1
        if nrlive <=3:
            return 'residence'
        elif 12<=nrlive<=13:
            return 'education'
        elif 9<=nrlive<=11:
            return 'market'
        elif nrlive>=18:
            return 'void'
        else:
            return 'residence'

    def getNeighbourCoordinates(self):
        neighbours = []
        list1=[-10,0,10]
        list2=[-4,0,4]
        for i in list1:
            for j in list1:
                for k in list2:
                    neighbours.append([self.x+i, self.y+j, self.z+k])
        neighbours.remove([self.x,self.y,self.z])
        return neighbours

class Cell_education(Cell):
    def __init__(self, x, y, z):
        self.x = x
        self.y = y
        self.z = z
        self.type = 'education'
        self.neighbours = []
        self.food=0.0018*50
        self.ffood=0.001*50
        self.office_supplies=0.009*50
        self.furniture=0.294*50
        self.daily=0.007*50

    def behaviour(self):
        nrlive = 0
        for n in self.neighbours:
            if n.type == 'education':
                nrlive += 1
        if nrlive <=3:
            return 'education'
        elif nrlive>=20:
            return 'void'
        else:
            return 'education'

    def getNeighbourCoordinates(self):
        neighbours = []
        list1=[-10,0,10]
        list2=[-4,0,4]
        for i in list1:
            for j in list1:
                for k in list2:
                    neighbours.append([self.x+i, self.y+j, self.z+k])
        neighbours.remove([self.x,self.y,self.z])
        return neighbours

class Cell_space(Cell):
    def __init__(self, x, y, z):
        self.x = x
        self.y = y
        self.z = z
        self.type = 'space'
        self.neighbours = []
        self.food=0
        self.ffood=0
        self.office_supplies=0
        self.furniture=0
        self.daily=0

    def behaviour(self):
        office = 0
        residence=0
        restaurant=0
        market=0
        education=0
        space=0
        for n in self.neighbours:
            if n.type == 'office':
                office += 1
            elif n.type == 'residence':
                residence += 1
            elif n.type == 'restaurant':
                restaurant += 1
            elif n.type == 'market':
                market += 1
            elif n.type == 'education':
                education += 1
            elif n.type == 'space':
                space += 1
        if office>=8:
            return 'office'
        if residence>=8:
            return 'residence'



    def getNeighbourCoordinates(self):
        neighbours = []
        list1=[-10,0,10]
        list2=[-4,0,4]
        for i in list1:
            for j in list1:
                for k in list2:
                    neighbours.append([self.x+i, self.y+j, self.z+k])
        neighbours.remove([self.x,self.y,self.z])
        return neighbours

envcell=[]
for k in range(51):
    for i,j in zip(X,Y):
        if int(i)%5!=0:
            i=i+1
        if int(j)%5!=0:
            j=j+1
        envcell.append((int(i),int(j),int(k)*4+2))
spacecell=envcell[:]

celldict={}
if officeX != None:
    for i,j,k in zip(officeX,officeY,officeZ):
        if int(i)%5!=0:
            i=i+1
        if int(j)%5!=0:
            j=j+1
        c=Cell_office(int(i),int(j),int(k))
        celldict[int(i),int(j),int(k)]=c
        if spacecell.__contains__((int(i),int(j),int(k)))==True:
            spacecell.remove((int(i),int(j),int(k)))
if restaurantX != None:
    for i,j,k in zip(restaurantX,restaurantY,restaurantZ):
        if int(i)%5!=0:
            i=i+1
        if int(j)%5!=0:
            j=j+1
        c=Cell_restaurant(int(i),int(j),int(k))
        celldict[int(i),int(j),int(k)]=c
        if spacecell.__contains__((int(i),int(j),int(k)))==True:
            spacecell.remove((int(i),int(j),int(k)))
if commerceX != None:
    for i,j,k in zip(commerceX,commerceY,commerceZ):
        if int(i)%5!=0:
            i=i+1
        if int(j)%5!=0:
            j=j+1
        c=Cell_market(int(i),int(j),int(k))
        celldict[int(i),int(j),int(k)]=c
        if spacecell.__contains__((int(i),int(j),int(k)))==True:
            spacecell.remove((int(i),int(j),int(k)))
if residenceX != None:
    for i,j,k in zip(residenceX,residenceY,residenceZ):
        if int(i)%5!=0:
            i=i+1
        if int(j)%5!=0:
            j=j+1
        c=Cell_residence(int(i),int(j),int(k))
        celldict[int(i),int(j),int(k)]=c
        if spacecell.__contains__((int(i),int(j),int(k)))==True:
            spacecell.remove((int(i),int(j),int(k)))
if educationX != None:
    for i,j,k in zip(educationX,educationY,educationZ):
        if int(i)%5!=0:
            i=i+1
        if int(j)%5!=0:
            j=j+1
        c=Cell_education(int(i),int(j),int(k))
        celldict[int(i),int(j),int(k)]=c
        if spacecell.__contains__((int(i),int(j),int(k)))==True:
            spacecell.remove((int(i),int(j),int(k)))
for v in spacecell:
    c=Cell_space(v[0],v[1],v[2])
    celldict[v[0],v[1],v[2]]=c

for i in celldict:
    c=celldict[i]
    neigourCoords = c.getNeighbourCoordinates()
    for n in neigourCoords:
       if celldict.__contains__((n[0],n[1],n[2]))==True:
           c.neighbours.append(celldict[n[0],n[1],n[2]])


def evaluate(dict):
    food=Food
    frozen_food=Frozen_food
    office_supplies=Office_supplies
    furniture=Furniture
    daily_necessities=Daily_necessities
    nextCellDict={}
    for i in dict:
        c = dict[i]
        next = c.behaviour()
        if next == 'office':
            nCell = Cell_office(c.x,c.y,c.z)
            food=food+c.food-nCell.food
            frozen_food=frozen_food+c.ffood-nCell.ffood
            office_supplies=office_supplies+c.office_supplies-nCell.office_supplies
            furniture=furniture+c.furniture-nCell.furniture
            daily_necessities=daily_necessities+c.daily-nCell.daily
            if food>=0 and frozen_food>=0 and office_supplies>=0 and furniture>=0 and daily_necessities>=0:
                nextCellDict[c.x,c.y,c.z] = nCell
        elif next == 'restaurant':
            nCell = Cell_restaurant(c.x,c.y,c.z)
            food=food+c.food-nCell.food
            frozen_food=frozen_food+c.ffood-nCell.ffood
            office_supplies=office_supplies+c.office_supplies-nCell.office_supplies
            furniture=furniture+c.furniture-nCell.furniture
            daily_necessities=daily_necessities+c.daily-nCell.daily
            if food>=0 and frozen_food>=0 and office_supplies>=0 and furniture>=0 and daily_necessities>=0:
                nextCellDict[c.x,c.y,c.z] = nCell
        elif next == 'market':
            nCell = Cell_market(c.x,c.y,c.z)
            food=food+c.food-nCell.food
            frozen_food=frozen_food+c.ffood-nCell.ffood
            office_supplies=office_supplies+c.office_supplies-nCell.office_supplies
            furniture=furniture+c.furniture-nCell.furniture
            daily_necessities=daily_necessities+c.daily-nCell.daily
            if food>=0 and frozen_food>=0 and office_supplies>=0 and furniture>=0 and daily_necessities>=0:
                nextCellDict[c.x,c.y,c.z] = nCell
        elif next == 'residence':
            nCell = Cell_residence(c.x,c.y,c.z)
            food=food+c.food-nCell.food
            frozen_food=frozen_food+c.ffood-nCell.ffood
            office_supplies=office_supplies+c.office_supplies-nCell.office_supplies
            furniture=furniture+c.furniture-nCell.furniture
            daily_necessities=daily_necessities+c.daily-nCell.daily
            if food>=0 and frozen_food>=0 and office_supplies>=0 and furniture>=0 and daily_necessities>=0:
                nextCellDict[c.x,c.y,c.z] = nCell
        elif next == 'education':
            nCell = Cell_education(c.x,c.y,c.z)
            food=food+c.food-nCell.food
            frozen_food=frozen_food+c.ffood-nCell.ffood
            office_supplies=office_supplies+c.office_supplies-nCell.office_supplies
            furniture=furniture+c.furniture-nCell.furniture
            daily_necessities=daily_necessities+c.daily-nCell.daily
            if food>=0 and frozen_food>=0 and office_supplies>=0 and furniture>=0 and daily_necessities>=0:
                nextCellDict[c.x,c.y,c.z] = nCell
        elif next == 'void':
            nCell = Cell_void(c.x,c.y,c.z)
            nextCellDict[c.x,c.y,c.z] = nCell
            food=food+c.food
            frozen_food=frozen_food+c.ffood
            office_supplies=office_supplies+c.office_supplies
            furniture=furniture+c.furniture
            daily_necessities=daily_necessities+c.daily
        else:
            c.neighbours = []
            nextCellDict[c.x,c.y,c.z] = c

    for i in nextCellDict:
        c = nextCellDict[i]
        neigourCoords = c.getNeighbourCoordinates()
        for n in neigourCoords:
            if nextCellDict.__contains__((n[0],n[1],n[2]))==True:
                c.neighbours.append(nextCellDict[n[0],n[1],n[2]])

    dict = nextCellDict
    return dict,food,frozen_food,office_supplies,furniture,daily_necessities

officelist=[]
restaurantlist=[]
marketlist=[]
residencelist=[]
educationlist=[]
voidlist=[]

for g in range(int(generation)):
    officelist=[]
    restaurantlist=[]
    marketlist=[]
    residencelist=[]
    educationlist=[]
    voidlist=[]
    for i in celldict:
        c=celldict[i]
        if c.type=='office':
            officelist.append([c.x,c.y,c.z])
        elif c.type=='restaurant':
            restaurantlist.append([c.x,c.y,c.z])
        elif c.type=='market':
            marketlist.append([c.x,c.y,c.z])
        elif c.type=='residence':
            residencelist.append([c.x,c.y,c.z])
        elif c.type=='education':
            educationlist.append([c.x,c.y,c.z])
        elif c.type=='void':
            voidlist.append([c.x,c.y,c.z])
    celldict,cfood,cffood,coffice,cfurniture,cdaily=evaluate(celldict)

officepoints=[]
restaurantpoints=[]
marketpoints=[]
residencepoints=[]
educationpoints=[]
voidpoints=[]
for p in officelist:
    point3d=rg.Point3d(int(p[0]),int(p[1]),int(p[2]))
    officepoints.append(point3d)
for p in restaurantlist:
    point3d=rg.Point3d(int(p[0]),int(p[1]),int(p[2]))
    restaurantpoints.append(point3d)
for p in marketlist:
    point3d=rg.Point3d(int(p[0]),int(p[1]),int(p[2]))
    marketpoints.append(point3d)
for p in residencelist:
    point3d=rg.Point3d(int(p[0]),int(p[1]),int(p[2]))
    residencepoints.append(point3d)
for p in educationlist:
    point3d=rg.Point3d(int(p[0]),int(p[1]),int(p[2]))
    educationpoints.append(point3d)
for p in voidlist:
    point3d=rg.Point3d(int(p[0]),int(p[1]),int(p[2]))
    voidpoints.append(point3d)
# ---------- end ghpython_script_7 ----------
ghpython_script_8 = GhPythonScript(
    office=list_length_12,
    restaurant=list_length_14,
    market=list_length_15,
    residence=list_length_20,
    education=list_length_16)  # -> out, food, ffood, officesp, furniture, daily; same code as ghpython_script_3
deconstruct_80 = Deconstruct(Point=point_80)  # -> XComponent, YComponent, ZComponent
deconstruct_81 = Deconstruct(Point=point_81)  # -> XComponent, YComponent, ZComponent
deconstruct_82 = Deconstruct(Point=point_82)  # -> XComponent, YComponent, ZComponent
deconstruct_83 = Deconstruct(Point=point_83)  # -> XComponent, YComponent, ZComponent
ghpython_script_9 = GhPythonScript(
    office=list_length_21,
    restaurant=list_length_23,
    market=list_length_26,
    residence=list_length_30,
    education=list_length_27)  # -> out, food, ffood, officesp, furniture, daily; same code as ghpython_script_3
ghpython_script_10 = GhPythonScript(
    office=list_length_22,
    restaurant=list_length_25,
    market=list_length_28,
    residence=list_length_32,
    education=list_length_29)  # -> out, food, ffood, officesp, furniture, daily; same code as ghpython_script_3
deconstruct_84 = Deconstruct(Point=point_84)  # -> XComponent, YComponent, ZComponent
ghpython_script_11 = GhPythonScript(
    office=list_length_24,
    restaurant=list_length_31,
    market=list_length_33,
    residence=list_length_35,
    education=list_length_34)  # -> out, food, ffood, officesp, furniture, daily; same code as ghpython_script_3
list_length_56 = ListLength(List=point_38)
list_length_57 = ListLength(List=point_36)
list_length_58 = ListLength(List=point_37)
number_slider_14 = Slider(10, range=1..20)
list_length_59 = ListLength(List=point_40)
list_length_60 = ListLength(List=point_74)
list_length_61 = ListLength(List=point_75)
list_length_62 = ListLength(List=point_76)
list_length_63 = ListLength(List=point_77)
list_length_64 = ListLength(List=point_78)
ghpython_script_12 = GhPythonScript(
    X=deconstruct_64.XComponent,
    Y=deconstruct_64.YComponent,
    Z=deconstruct_64.ZComponent,
    officeX=deconstruct_11.XComponent,
    officeY=deconstruct_11.YComponent,
    officeZ=deconstruct_11.ZComponent,
    restaurantX=deconstruct_12.XComponent,
    restaurantY=deconstruct_12.YComponent,
    restaurantZ=deconstruct_12.ZComponent,
    commerceX=deconstruct_15.XComponent,
    commerceY=deconstruct_15.YComponent,
    commerceZ=deconstruct_15.ZComponent,
    residenceX=deconstruct_19.XComponent,
    residenceY=deconstruct_19.YComponent,
    residenceZ=deconstruct_19.ZComponent,
    generation=number_slider,
    Food=ghpython_script_8.food,
    Frozen_food=ghpython_script_8.ffood,
    Office_supplies=ghpython_script_8.officesp,
    Furniture=ghpython_script_8.furniture,
    Daily_necessities=ghpython_script_8.daily)  # -> out, officepoints, restaurantpoints, marketpoints, residencepoints, educationpoints, voidpoints; inputs X: list, Y: list, Z: list, officeX: list, officeY: list, officeZ: list, restaurantX: list, restaurantY: list, restaurantZ: list, commerceX: list, commerceY: list, commerceZ: list, residenceX: list, residenceY: list, residenceZ: list, educationX: list, educationY: list, educationZ: list
# ---------- ghpython_script_12: Python ----------
__author__ = "laoma"
__version__ = "2022.03.12"

import rhinoscriptsyntax as rs
import random
from ghpythonlib.componentbase import executingcomponent as component
import Grasshopper, GhPython
import Rhino.Geometry as rg


class Cell:
  def __init__(self, x, y, z):
    self.x = x
    self.y = y
    self.z = z
    self.type = None

class Cell_void(Cell):
    def __init__(self, x, y, z):
        self.x = x
        self.y = y
        self.z = z
        self.type = 'void'
        self.neighbours = []
        self.food=0
        self.ffood=0
        self.office_supplies=0
        self.furniture=0
        self.daily=0

    def behaviour(self):
        return 'void'


    def getNeighbourCoordinates(self):
        neighbours = []
        list1=[-10,0,10]
        list2=[-4,0,4]
        for i in list1:
            for j in list1:
                for k in list2:
                    neighbours.append([self.x+i, self.y+j, self.z+k])
        neighbours.remove([self.x,self.y,self.z])
        return neighbours

class Cell_office(Cell):
    def __init__(self, x, y, z):
        self.x = x
        self.y = y
        self.z = z
        self.type = 'office'
        self.neighbours = []
        self.food=0.0013*20
        self.ffood=0.001*20
        self.office_supplies=0.0063*20
        self.furniture=0.746*20
        self.daily=0.017*20

    def behaviour(self):
        nrlive = 0
        resi=0
        for n in self.neighbours:
            if n.type == 'office':
                nrlive += 1
            if n.type =='residence':
                resi+=1
        if nrlive<=7:
            return 'office'
        elif 10<=nrlive<=12:
            return 'residence'
        elif nrlive>=20:
            return 'void'
        else:
            return 'office'


    def getNeighbourCoordinates(self):
        neighbours = []
        list1=[-10,0,10]
        list2=[-4,0,4]
        for i in list1:
            for j in list1:
                for k in list2:
                    neighbours.append([self.x+i, self.y+j, self.z+k])
        neighbours.remove([self.x,self.y,self.z])
        return neighbours

class Cell_restaurant(Cell):
    def __init__(self, x, y, z):
        self.x = x
        self.y = y
        self.z = z
        self.type = 'restaurant'
        self.neighbours = []
        self.food=0.15*15
        self.ffood=0.09*15
        self.office_supplies=0.0008*15
        self.furniture=0.375*15
        self.daily=0.005*15

    def behaviour(self):
        nrlive = 0
        for n in self.neighbours:
            if n.type == 'restaurant':
                nrlive += 1
        if nrlive <=3:
            return 'market'
        elif 11<=nrlive<=17:
            return 'market'

        elif nrlive>=22:
            return 'void'
        else:
            return 'restaurant'

    def getNeighbourCoordinates(self):
        neighbours = []
        list1=[-10,0,10]
        list2=[-4,0,4]
        for i in list1:
            for j in list1:
                for k in list2:
                    neighbours.append([self.x+i, self.y+j, self.z+k])
        neighbours.remove([self.x,self.y,self.z])
        return neighbours

class Cell_market(Cell):
    def __init__(self, x, y, z):
        self.x = x
        self.y = y
        self.z = z
        self.type = 'market'
        self.neighbours = []
        self.food=0.0008*20
        self.ffood=0.0006*20
        self.office_supplies=0.0017*20
        self.furniture=0.221*20
        self.daily=0.55*20

    def behaviour(self):
        nrlive = 0
        for n in self.neighbours:
            if n.type == 'market':
                nrlive += 1
        if nrlive <=3:
            return 'residence'
        elif 8<=nrlive<=17:
            return 'restaurant'
        elif nrlive>=18:
            return 'void'

        else:
            return 'market'

    def getNeighbourCoordinates(self):
        neighbours = []
        list1=[-10,0,10]
        list2=[-4,0,4]
        for i in list1:
            for j in list1:
                for k in list2:
                    neighbours.append([self.x+i, self.y+j, self.z+k])
        neighbours.remove([self.x,self.y,self.z])
        return neighbours

class Cell_residence(Cell):
    def __init__(self, x, y, z):
        self.x = x
        self.y = y
        self.z = z
        self.type = 'residence'
        self.neighbours = []
        self.food=0.005*8
        self.ffood=0.003*8
        self.office_supplies=0.0003*8
        self.furniture=1.113*8
        self.daily=0.021*8

    def behaviour(self):
        nrlive = 0
        for n in self.neighbours:
            if n.type == 'residence':
                nrlive += 1
        if nrlive <=3:
            return 'office'
        elif 11<=nrlive<=13:
            return 'market'
        elif nrlive>=20:
            return 'void'
        else:
            return 'residence'

    def getNeighbourCoordinates(self):
        neighbours = []
        list1=[-10,0,10]
        list2=[-4,0,4]
        for i in list1:
            for j in list1:
                for k in list2:
                    neighbours.append([self.x+i, self.y+j, self.z+k])
        neighbours.remove([self.x,self.y,self.z])
        return neighbours

class Cell_education(Cell):
    def __init__(self, x, y, z):
        self.x = x
        self.y = y
        self.z = z
        self.type = 'education'
        self.neighbours = []
        self.food=0.0018*50
        self.ffood=0.001*50
        self.office_supplies=0.009*50
        self.furniture=0.294*50
        self.daily=0.007*50

    def behaviour(self):
        nrlive = 0
        for n in self.neighbours:
            if n.type == 'residence':
                nrlive += 1
        if nrlive <=3:
            return 'residence'
        elif 11<=nrlive<=13:
            return 'residence'
        elif nrlive>=20:
            return 'void'
        else:
            return 'education'

    def getNeighbourCoordinates(self):
        neighbours = []
        list1=[-10,0,10]
        list2=[-4,0,4]
        for i in list1:
            for j in list1:
                for k in list2:
                    neighbours.append([self.x+i, self.y+j, self.z+k])
        neighbours.remove([self.x,self.y,self.z])
        return neighbours

class Cell_space(Cell):
    def __init__(self, x, y, z):
        self.x = x
        self.y = y
        self.z = z
        self.type = 'space'
        self.neighbours = []
        self.food=0
        self.ffood=0
        self.office_supplies=0
        self.furniture=0
        self.daily=0

    def behaviour(self):
        office = 0
        residence=0
        restaurant=0
        market=0
        education=0
        space=0
        for n in self.neighbours:
            if n.type == 'office':
                office += 1
            elif n.type == 'residence':
                residence += 1
            elif n.type == 'restaurant':
                restaurant += 1
            elif n.type == 'market':
                market += 1
            elif n.type == 'education':
                education += 1
            elif n.type == 'space':
                space += 1
        if office>=9:
            return 'office'
        if residence>=9:
            return 'residence'



    def getNeighbourCoordinates(self):
        neighbours = []
        list1=[-10,0,10]
        list2=[-4,0,4]
        for i in list1:
            for j in list1:
                for k in list2:
                    neighbours.append([self.x+i, self.y+j, self.z+k])
        neighbours.remove([self.x,self.y,self.z])
        return neighbours

envcell=[]
for k in range(51):
    for i,j in zip(X,Y):
        if int(i)%5!=0:
            i=i+1
        if int(j)%5!=0:
            j=j+1
        envcell.append((int(i),int(j),int(k)*4+2))
spacecell=envcell[:]

celldict={}
if officeX != None:
    for i,j,k in zip(officeX,officeY,officeZ):
        if int(i)%5!=0:
            i=i+1
        if int(j)%5!=0:
            j=j+1
        c=Cell_office(int(i),int(j),int(k))
        celldict[int(i),int(j),int(k)]=c
        if spacecell.__contains__((int(i),int(j),int(k)))==True:
            spacecell.remove((int(i),int(j),int(k)))
if restaurantX != None:
    for i,j,k in zip(restaurantX,restaurantY,restaurantZ):
        if int(i)%5!=0:
            i=i+1
        if int(j)%5!=0:
            j=j+1
        c=Cell_restaurant(int(i),int(j),int(k))
        celldict[int(i),int(j),int(k)]=c
        if spacecell.__contains__((int(i),int(j),int(k)))==True:
            spacecell.remove((int(i),int(j),int(k)))
if commerceX != None:
    for i,j,k in zip(commerceX,commerceY,commerceZ):
        if int(i)%5!=0:
            i=i+1
        if int(j)%5!=0:
            j=j+1
        c=Cell_market(int(i),int(j),int(k))
        celldict[int(i),int(j),int(k)]=c
        if spacecell.__contains__((int(i),int(j),int(k)))==True:
            spacecell.remove((int(i),int(j),int(k)))
if residenceX != None:
    for i,j,k in zip(residenceX,residenceY,residenceZ):
        if int(i)%5!=0:
            i=i+1
        if int(j)%5!=0:
            j=j+1
        c=Cell_residence(int(i),int(j),int(k))
        celldict[int(i),int(j),int(k)]=c
        if spacecell.__contains__((int(i),int(j),int(k)))==True:
            spacecell.remove((int(i),int(j),int(k)))
if educationX != None:
    for i,j,k in zip(educationX,educationY,educationZ):
        if int(i)%5!=0:
            i=i+1
        if int(j)%5!=0:
            j=j+1
        c=Cell_education(int(i),int(j),int(k))
        celldict[int(i),int(j),int(k)]=c
        if spacecell.__contains__((int(i),int(j),int(k)))==True:
            spacecell.remove((int(i),int(j),int(k)))
for v in spacecell:
    c=Cell_space(v[0],v[1],v[2])
    celldict[v[0],v[1],v[2]]=c

for i in celldict:
    c=celldict[i]
    neigourCoords = c.getNeighbourCoordinates()
    for n in neigourCoords:
       if celldict.__contains__((n[0],n[1],n[2]))==True:
           c.neighbours.append(celldict[n[0],n[1],n[2]])


def evaluate(dict):
    food=Food
    frozen_food=Frozen_food
    office_supplies=Office_supplies
    furniture=Furniture
    daily_necessities=Daily_necessities
    nextCellDict={}
    for i in dict:
        c = dict[i]
        next = c.behaviour()
        if next == 'office':
            nCell = Cell_office(c.x,c.y,c.z)
            food=food+c.food-nCell.food
            frozen_food=frozen_food+c.ffood-nCell.ffood
            office_supplies=office_supplies+c.office_supplies-nCell.office_supplies
            furniture=furniture+c.furniture-nCell.furniture
            daily_necessities=daily_necessities+c.daily-nCell.daily
            if food>=0 and frozen_food>=0 and office_supplies>=0 and furniture>=0 and daily_necessities>=0:
                nextCellDict[c.x,c.y,c.z] = nCell
        elif next == 'restaurant':
            nCell = Cell_restaurant(c.x,c.y,c.z)
            food=food+c.food-nCell.food
            frozen_food=frozen_food+c.ffood-nCell.ffood
            office_supplies=office_supplies+c.office_supplies-nCell.office_supplies
            furniture=furniture+c.furniture-nCell.furniture
            daily_necessities=daily_necessities+c.daily-nCell.daily
            if food>=0 and frozen_food>=0 and office_supplies>=0 and furniture>=0 and daily_necessities>=0:
                nextCellDict[c.x,c.y,c.z] = nCell
        elif next == 'market':
            nCell = Cell_market(c.x,c.y,c.z)
            food=food+c.food-nCell.food
            frozen_food=frozen_food+c.ffood-nCell.ffood
            office_supplies=office_supplies+c.office_supplies-nCell.office_supplies
            furniture=furniture+c.furniture-nCell.furniture
            daily_necessities=daily_necessities+c.daily-nCell.daily
            if food>=0 and frozen_food>=0 and office_supplies>=0 and furniture>=0 and daily_necessities>=0:
                nextCellDict[c.x,c.y,c.z] = nCell
        elif next == 'residence':
            nCell = Cell_residence(c.x,c.y,c.z)
            food=food+c.food-nCell.food
            frozen_food=frozen_food+c.ffood-nCell.ffood
            office_supplies=office_supplies+c.office_supplies-nCell.office_supplies
            furniture=furniture+c.furniture-nCell.furniture
            daily_necessities=daily_necessities+c.daily-nCell.daily
            if food>=0 and frozen_food>=0 and office_supplies>=0 and furniture>=0 and daily_necessities>=0:
                nextCellDict[c.x,c.y,c.z] = nCell
        elif next == 'education':
            nCell = Cell_education(c.x,c.y,c.z)
            food=food+c.food-nCell.food
            frozen_food=frozen_food+c.ffood-nCell.ffood
            office_supplies=office_supplies+c.office_supplies-nCell.office_supplies
            furniture=furniture+c.furniture-nCell.furniture
            daily_necessities=daily_necessities+c.daily-nCell.daily
            if food>=0 and frozen_food>=0 and office_supplies>=0 and furniture>=0 and daily_necessities>=0:
                nextCellDict[c.x,c.y,c.z] = nCell
        elif next == 'void':
            nCell = Cell_void(c.x,c.y,c.z)
            nextCellDict[c.x,c.y,c.z] = nCell
            food=food+c.food
            frozen_food=frozen_food+c.ffood
            office_supplies=office_supplies+c.office_supplies
            furniture=furniture+c.furniture
            daily_necessities=daily_necessities+c.daily
        else:
            c.neighbours = []
            nextCellDict[c.x,c.y,c.z] = c

    for i in nextCellDict:
        c = nextCellDict[i]
        neigourCoords = c.getNeighbourCoordinates()
        for n in neigourCoords:
            if nextCellDict.__contains__((n[0],n[1],n[2]))==True:
                c.neighbours.append(nextCellDict[n[0],n[1],n[2]])

    dict = nextCellDict
    return dict,food,frozen_food,office_supplies,furniture,daily_necessities

officelist=[]
restaurantlist=[]
marketlist=[]
residencelist=[]
educationlist=[]
voidlist=[]

for g in range(int(generation)):
    officelist=[]
    restaurantlist=[]
    marketlist=[]
    residencelist=[]
    educationlist=[]
    voidlist=[]
    for i in celldict:
        c=celldict[i]
        if c.type=='office':
            officelist.append([c.x,c.y,c.z])
        elif c.type=='restaurant':
            restaurantlist.append([c.x,c.y,c.z])
        elif c.type=='market':
            marketlist.append([c.x,c.y,c.z])
        elif c.type=='residence':
            residencelist.append([c.x,c.y,c.z])
        elif c.type=='education':
            educationlist.append([c.x,c.y,c.z])
        elif c.type=='void':
            voidlist.append([c.x,c.y,c.z])
    celldict,cfood,cffood,coffice,cfurniture,cdaily=evaluate(celldict)

officepoints=[]
restaurantpoints=[]
marketpoints=[]
residencepoints=[]
educationpoints=[]
voidpoints=[]
for p in officelist:
    point3d=rg.Point3d(int(p[0]),int(p[1]),int(p[2]))
    officepoints.append(point3d)
for p in restaurantlist:
    point3d=rg.Point3d(int(p[0]),int(p[1]),int(p[2]))
    restaurantpoints.append(point3d)
for p in marketlist:
    point3d=rg.Point3d(int(p[0]),int(p[1]),int(p[2]))
    marketpoints.append(point3d)
for p in residencelist:
    point3d=rg.Point3d(int(p[0]),int(p[1]),int(p[2]))
    residencepoints.append(point3d)
for p in educationlist:
    point3d=rg.Point3d(int(p[0]),int(p[1]),int(p[2]))
    educationpoints.append(point3d)
for p in voidlist:
    point3d=rg.Point3d(int(p[0]),int(p[1]),int(p[2]))
    voidpoints.append(point3d)
# ---------- end ghpython_script_12 ----------
ghpython_script_13 = GhPythonScript(
    X=deconstruct_65.XComponent,
    Y=deconstruct_65.YComponent,
    Z=deconstruct_65.ZComponent,
    officeX=deconstruct_13.XComponent,
    officeY=deconstruct_13.YComponent,
    officeZ=deconstruct_13.ZComponent,
    restaurantX=deconstruct_14.XComponent,
    restaurantY=deconstruct_14.YComponent,
    restaurantZ=deconstruct_14.ZComponent,
    commerceX=deconstruct_16.XComponent,
    commerceY=deconstruct_16.YComponent,
    commerceZ=deconstruct_16.ZComponent,
    educationX=deconstruct_18.XComponent,
    educationY=deconstruct_18.YComponent,
    educationZ=deconstruct_18.ZComponent,
    generation=number_slider,
    Food=ghpython_script_5.food,
    Frozen_food=ghpython_script_5.ffood,
    Office_supplies=ghpython_script_5.officesp,
    Furniture=ghpython_script_5.furniture,
    Daily_necessities=ghpython_script_5.daily)  # -> out, officepoints, restaurantpoints, marketpoints, residencepoints, educationpoints, voidpoints; inputs X: list, Y: list, Z: list, officeX: list, officeY: list, officeZ: list, restaurantX: list, restaurantY: list, restaurantZ: list, commerceX: list, commerceY: list, commerceZ: list, residenceX: list, residenceY: list, residenceZ: list, educationX: list, educationY: list, educationZ: list
# ---------- ghpython_script_13: Python ----------
__author__ = "laoma"
__version__ = "2022.03.12"

import rhinoscriptsyntax as rs
import random
from ghpythonlib.componentbase import executingcomponent as component
import Grasshopper, GhPython
import Rhino.Geometry as rg


class Cell:
  def __init__(self, x, y, z):
    self.x = x
    self.y = y
    self.z = z
    self.type = None

class Cell_void(Cell):
    def __init__(self, x, y, z):
        self.x = x
        self.y = y
        self.z = z
        self.type = 'void'
        self.neighbours = []
        self.food=0
        self.ffood=0
        self.office_supplies=0
        self.furniture=0
        self.daily=0

    def behaviour(self):
        return 'void'


    def getNeighbourCoordinates(self):
        neighbours = []
        list1=[-10,0,10]
        list2=[-4,0,4]
        for i in list1:
            for j in list1:
                for k in list2:
                    neighbours.append([self.x+i, self.y+j, self.z+k])
        neighbours.remove([self.x,self.y,self.z])
        return neighbours

class Cell_office(Cell):
    def __init__(self, x, y, z):
        self.x = x
        self.y = y
        self.z = z
        self.type = 'office'
        self.neighbours = []
        self.food=0.0013*20
        self.ffood=0.001*20
        self.office_supplies=0.0063*20
        self.furniture=0.746*20
        self.daily=0.017*20

    def behaviour(self):
        nrlive = 0
        resi=0
        for n in self.neighbours:
            if n.type == 'office':
                nrlive += 1
            if n.type =='residence':
                resi+=1
        if nrlive<=7:
            return 'office'
        elif 10<=nrlive<=12:
            return 'residence'
        elif nrlive>=20:
            return 'void'
        else:
            return 'office'


    def getNeighbourCoordinates(self):
        neighbours = []
        list1=[-10,0,10]
        list2=[-4,0,4]
        for i in list1:
            for j in list1:
                for k in list2:
                    neighbours.append([self.x+i, self.y+j, self.z+k])
        neighbours.remove([self.x,self.y,self.z])
        return neighbours

class Cell_restaurant(Cell):
    def __init__(self, x, y, z):
        self.x = x
        self.y = y
        self.z = z
        self.type = 'restaurant'
        self.neighbours = []
        self.food=0.15*15
        self.ffood=0.09*15
        self.office_supplies=0.0008*15
        self.furniture=0.375*15
        self.daily=0.005*15

    def behaviour(self):
        nrlive = 0
        for n in self.neighbours:
            if n.type == 'restaurant':
                nrlive += 1
        if nrlive <=3:
            return 'market'
        elif 11<=nrlive<=17:
            return 'market'

        elif nrlive>=22:
            return 'void'
        else:
            return 'restaurant'

    def getNeighbourCoordinates(self):
        neighbours = []
        list1=[-10,0,10]
        list2=[-4,0,4]
        for i in list1:
            for j in list1:
                for k in list2:
                    neighbours.append([self.x+i, self.y+j, self.z+k])
        neighbours.remove([self.x,self.y,self.z])
        return neighbours

class Cell_market(Cell):
    def __init__(self, x, y, z):
        self.x = x
        self.y = y
        self.z = z
        self.type = 'market'
        self.neighbours = []
        self.food=0.0008*20
        self.ffood=0.0006*20
        self.office_supplies=0.0017*20
        self.furniture=0.221*20
        self.daily=0.55*20

    def behaviour(self):
        nrlive = 0
        for n in self.neighbours:
            if n.type == 'market':
                nrlive += 1
        if nrlive <=3:
            return 'residence'
        elif 8<=nrlive<=17:
            return 'restaurant'
        elif nrlive>=18:
            return 'void'

        else:
            return 'market'

    def getNeighbourCoordinates(self):
        neighbours = []
        list1=[-10,0,10]
        list2=[-4,0,4]
        for i in list1:
            for j in list1:
                for k in list2:
                    neighbours.append([self.x+i, self.y+j, self.z+k])
        neighbours.remove([self.x,self.y,self.z])
        return neighbours

class Cell_residence(Cell):
    def __init__(self, x, y, z):
        self.x = x
        self.y = y
        self.z = z
        self.type = 'residence'
        self.neighbours = []
        self.food=0.005*8
        self.ffood=0.003*8
        self.office_supplies=0.0003*8
        self.furniture=1.113*8
        self.daily=0.021*8

    def behaviour(self):
        nrlive = 0
        for n in self.neighbours:
            if n.type == 'residence':
                nrlive += 1
        if nrlive <=3:
            return 'office'

        elif 11<=nrlive<=13:
            return 'market'
        elif 18<=nrlive<=19:
            return 'education'
        elif nrlive>=20:
            return 'void'
        else:
            return 'residence'

    def getNeighbourCoordinates(self):
        neighbours = []
        list1=[-10,0,10]
        list2=[-4,0,4]
        for i in list1:
            for j in list1:
                for k in list2:
                    neighbours.append([self.x+i, self.y+j, self.z+k])
        neighbours.remove([self.x,self.y,self.z])
        return neighbours

class Cell_education(Cell):
    def __init__(self, x, y, z):
        self.x = x
        self.y = y
        self.z = z
        self.type = 'education'
        self.neighbours = []
        self.food=0.0018*50
        self.ffood=0.001*50
        self.office_supplies=0.009*50
        self.furniture=0.294*50
        self.daily=0.007*50

    def behaviour(self):
        nrlive = 0
        for n in self.neighbours:
            if n.type == 'education':
                nrlive += 1
        if nrlive <=3:
            return 'education'

        elif nrlive>=20:
            return 'void'
        else:
            return 'education'

    def getNeighbourCoordinates(self):
        neighbours = []
        list1=[-10,0,10]
        list2=[-4,0,4]
        for i in list1:
            for j in list1:
                for k in list2:
                    neighbours.append([self.x+i, self.y+j, self.z+k])
        neighbours.remove([self.x,self.y,self.z])
        return neighbours

class Cell_space(Cell):
    def __init__(self, x, y, z):
        self.x = x
        self.y = y
        self.z = z
        self.type = 'space'
        self.neighbours = []
        self.food=0
        self.ffood=0
        self.office_supplies=0
        self.furniture=0
        self.daily=0

    def behaviour(self):
        office = 0
        residence=0
        restaurant=0
        market=0
        education=0
        space=0
        for n in self.neighbours:
            if n.type == 'office':
                office += 1
            elif n.type == 'residence':
                residence += 1
            elif n.type == 'restaurant':
                restaurant += 1
            elif n.type == 'market':
                market += 1
            elif n.type == 'education':
                education += 1
            elif n.type == 'space':
                space += 1
        if office>=9:
            return 'office'
        if residence>=9:
            return 'residence'



    def getNeighbourCoordinates(self):
        neighbours = []
        list1=[-10,0,10]
        list2=[-4,0,4]
        for i in list1:
            for j in list1:
                for k in list2:
                    neighbours.append([self.x+i, self.y+j, self.z+k])
        neighbours.remove([self.x,self.y,self.z])
        return neighbours

envcell=[]
for k in range(51):
    for i,j in zip(X,Y):
        if int(i)%5!=0:
            i=i+1
        if int(j)%5!=0:
            j=j+1
        envcell.append((int(i),int(j),int(k)*4+2))
spacecell=envcell[:]

celldict={}
if officeX != None:
    for i,j,k in zip(officeX,officeY,officeZ):
        if int(i)%5!=0:
            i=i+1
        if int(j)%5!=0:
            j=j+1
        c=Cell_office(int(i),int(j),int(k))
        celldict[int(i),int(j),int(k)]=c
        if spacecell.__contains__((int(i),int(j),int(k)))==True:
            spacecell.remove((int(i),int(j),int(k)))
if restaurantX != None:
    for i,j,k in zip(restaurantX,restaurantY,restaurantZ):
        if int(i)%5!=0:
            i=i+1
        if int(j)%5!=0:
            j=j+1
        c=Cell_restaurant(int(i),int(j),int(k))
        celldict[int(i),int(j),int(k)]=c
        if spacecell.__contains__((int(i),int(j),int(k)))==True:
            spacecell.remove((int(i),int(j),int(k)))
if commerceX != None:
    for i,j,k in zip(commerceX,commerceY,commerceZ):
        if int(i)%5!=0:
            i=i+1
        if int(j)%5!=0:
            j=j+1
        c=Cell_market(int(i),int(j),int(k))
        celldict[int(i),int(j),int(k)]=c
        if spacecell.__contains__((int(i),int(j),int(k)))==True:
            spacecell.remove((int(i),int(j),int(k)))
if residenceX != None:
    for i,j,k in zip(residenceX,residenceY,residenceZ):
        if int(i)%5!=0:
            i=i+1
        if int(j)%5!=0:
            j=j+1
        c=Cell_residence(int(i),int(j),int(k))
        celldict[int(i),int(j),int(k)]=c
        if spacecell.__contains__((int(i),int(j),int(k)))==True:
            spacecell.remove((int(i),int(j),int(k)))
if educationX != None:
    for i,j,k in zip(educationX,educationY,educationZ):
        if int(i)%5!=0:
            i=i+1
        if int(j)%5!=0:
            j=j+1
        c=Cell_education(int(i),int(j),int(k))
        celldict[int(i),int(j),int(k)]=c
        if spacecell.__contains__((int(i),int(j),int(k)))==True:
            spacecell.remove((int(i),int(j),int(k)))
for v in spacecell:
    c=Cell_space(v[0],v[1],v[2])
    celldict[v[0],v[1],v[2]]=c

for i in celldict:
    c=celldict[i]
    neigourCoords = c.getNeighbourCoordinates()
    for n in neigourCoords:
       if celldict.__contains__((n[0],n[1],n[2]))==True:
           c.neighbours.append(celldict[n[0],n[1],n[2]])


def evaluate(dict):
    food=Food
    frozen_food=Frozen_food
    office_supplies=Office_supplies
    furniture=Furniture
    daily_necessities=Daily_necessities
    nextCellDict={}
    for i in dict:
        c = dict[i]
        next = c.behaviour()
        if next == 'office':
            nCell = Cell_office(c.x,c.y,c.z)
            food=food+c.food-nCell.food
            frozen_food=frozen_food+c.ffood-nCell.ffood
            office_supplies=office_supplies+c.office_supplies-nCell.office_supplies
            furniture=furniture+c.furniture-nCell.furniture
            daily_necessities=daily_necessities+c.daily-nCell.daily
            if food>=0 and frozen_food>=0 and office_supplies>=0 and furniture>=0 and daily_necessities>=0:
                nextCellDict[c.x,c.y,c.z] = nCell
        elif next == 'restaurant':
            nCell = Cell_restaurant(c.x,c.y,c.z)
            food=food+c.food-nCell.food
            frozen_food=frozen_food+c.ffood-nCell.ffood
            office_supplies=office_supplies+c.office_supplies-nCell.office_supplies
            furniture=furniture+c.furniture-nCell.furniture
            daily_necessities=daily_necessities+c.daily-nCell.daily
            if food>=0 and frozen_food>=0 and office_supplies>=0 and furniture>=0 and daily_necessities>=0:
                nextCellDict[c.x,c.y,c.z] = nCell
        elif next == 'market':
            nCell = Cell_market(c.x,c.y,c.z)
            food=food+c.food-nCell.food
            frozen_food=frozen_food+c.ffood-nCell.ffood
            office_supplies=office_supplies+c.office_supplies-nCell.office_supplies
            furniture=furniture+c.furniture-nCell.furniture
            daily_necessities=daily_necessities+c.daily-nCell.daily
            if food>=0 and frozen_food>=0 and office_supplies>=0 and furniture>=0 and daily_necessities>=0:
                nextCellDict[c.x,c.y,c.z] = nCell
        elif next == 'residence':
            nCell = Cell_residence(c.x,c.y,c.z)
            food=food+c.food-nCell.food
            frozen_food=frozen_food+c.ffood-nCell.ffood
            office_supplies=office_supplies+c.office_supplies-nCell.office_supplies
            furniture=furniture+c.furniture-nCell.furniture
            daily_necessities=daily_necessities+c.daily-nCell.daily
            if food>=0 and frozen_food>=0 and office_supplies>=0 and furniture>=0 and daily_necessities>=0:
                nextCellDict[c.x,c.y,c.z] = nCell
        elif next == 'education':
            nCell = Cell_education(c.x,c.y,c.z)
            food=food+c.food-nCell.food
            frozen_food=frozen_food+c.ffood-nCell.ffood
            office_supplies=office_supplies+c.office_supplies-nCell.office_supplies
            furniture=furniture+c.furniture-nCell.furniture
            daily_necessities=daily_necessities+c.daily-nCell.daily
            if food>=0 and frozen_food>=0 and office_supplies>=0 and furniture>=0 and daily_necessities>=0:
                nextCellDict[c.x,c.y,c.z] = nCell
        elif next == 'void':
            nCell = Cell_void(c.x,c.y,c.z)
            nextCellDict[c.x,c.y,c.z] = nCell
            food=food+c.food
            frozen_food=frozen_food+c.ffood
            office_supplies=office_supplies+c.office_supplies
            furniture=furniture+c.furniture
            daily_necessities=daily_necessities+c.daily
        else:
            c.neighbours = []
            nextCellDict[c.x,c.y,c.z] = c

    for i in nextCellDict:
        c = nextCellDict[i]
        neigourCoords = c.getNeighbourCoordinates()
        for n in neigourCoords:
            if nextCellDict.__contains__((n[0],n[1],n[2]))==True:
                c.neighbours.append(nextCellDict[n[0],n[1],n[2]])

    dict = nextCellDict
    return dict,food,frozen_food,office_supplies,furniture,daily_necessities

officelist=[]
restaurantlist=[]
marketlist=[]
residencelist=[]
educationlist=[]
voidlist=[]

for g in range(int(generation)):
    officelist=[]
    restaurantlist=[]
    marketlist=[]
    residencelist=[]
    educationlist=[]
    voidlist=[]
    for i in celldict:
        c=celldict[i]
        if c.type=='office':
            officelist.append([c.x,c.y,c.z])
        elif c.type=='restaurant':
            restaurantlist.append([c.x,c.y,c.z])
        elif c.type=='market':
            marketlist.append([c.x,c.y,c.z])
        elif c.type=='residence':
            residencelist.append([c.x,c.y,c.z])
        elif c.type=='education':
            educationlist.append([c.x,c.y,c.z])
        elif c.type=='void':
            voidlist.append([c.x,c.y,c.z])
    celldict,cfood,cffood,coffice,cfurniture,cdaily=evaluate(celldict)

officepoints=[]
restaurantpoints=[]
marketpoints=[]
residencepoints=[]
educationpoints=[]
voidpoints=[]
for p in officelist:
    point3d=rg.Point3d(int(p[0]),int(p[1]),int(p[2]))
    officepoints.append(point3d)
for p in restaurantlist:
    point3d=rg.Point3d(int(p[0]),int(p[1]),int(p[2]))
    restaurantpoints.append(point3d)
for p in marketlist:
    point3d=rg.Point3d(int(p[0]),int(p[1]),int(p[2]))
    marketpoints.append(point3d)
for p in residencelist:
    point3d=rg.Point3d(int(p[0]),int(p[1]),int(p[2]))
    residencepoints.append(point3d)
for p in educationlist:
    point3d=rg.Point3d(int(p[0]),int(p[1]),int(p[2]))
    educationpoints.append(point3d)
for p in voidlist:
    point3d=rg.Point3d(int(p[0]),int(p[1]),int(p[2]))
    voidpoints.append(point3d)
# ---------- end ghpython_script_13 ----------
ghpython_script_14 = GhPythonScript(
    X=deconstruct_66.XComponent,
    Y=deconstruct_66.YComponent,
    Z=deconstruct_66.ZComponent,
    officeX=deconstruct_21.XComponent,
    officeY=deconstruct_21.YComponent,
    officeZ=deconstruct_21.ZComponent,
    restaurantX=deconstruct_22.XComponent,
    restaurantY=deconstruct_22.YComponent,
    restaurantZ=deconstruct_22.ZComponent,
    commerceX=deconstruct_25.XComponent,
    commerceY=deconstruct_25.YComponent,
    commerceZ=deconstruct_25.ZComponent,
    residenceX=deconstruct_32.XComponent,
    residenceY=deconstruct_32.YComponent,
    residenceZ=deconstruct_32.ZComponent,
    educationX=deconstruct_27.XComponent,
    educationY=deconstruct_27.YComponent,
    educationZ=deconstruct_27.ZComponent,
    generation=number_slider,
    Food=ghpython_script_9.food,
    Frozen_food=ghpython_script_9.ffood,
    Office_supplies=ghpython_script_9.officesp,
    Furniture=ghpython_script_9.furniture,
    Daily_necessities=ghpython_script_9.daily)  # -> out, officepoints, restaurantpoints, marketpoints, residencepoints, educationpoints, voidpoints; inputs X: list, Y: list, Z: list, officeX: list, officeY: list, officeZ: list, restaurantX: list, restaurantY: list, restaurantZ: list, commerceX: list, commerceY: list, commerceZ: list, residenceX: list, residenceY: list, residenceZ: list, educationX: list, educationY: list, educationZ: list
# ---------- ghpython_script_14: Python ----------
__author__ = "laoma"
__version__ = "2022.03.12"

import rhinoscriptsyntax as rs
import random
from ghpythonlib.componentbase import executingcomponent as component
import Grasshopper, GhPython
import Rhino.Geometry as rg


class Cell:
  def __init__(self, x, y, z):
    self.x = x
    self.y = y
    self.z = z
    self.type = None

class Cell_void(Cell):
    def __init__(self, x, y, z):
        self.x = x
        self.y = y
        self.z = z
        self.type = 'void'
        self.neighbours = []
        self.food=0
        self.ffood=0
        self.office_supplies=0
        self.furniture=0
        self.daily=0

    def behaviour(self):
        return 'void'


    def getNeighbourCoordinates(self):
        neighbours = []
        list1=[-10,0,10]
        list2=[-4,0,4]
        for i in list1:
            for j in list1:
                for k in list2:
                    neighbours.append([self.x+i, self.y+j, self.z+k])
        neighbours.remove([self.x,self.y,self.z])
        return neighbours

class Cell_office(Cell):
    def __init__(self, x, y, z):
        self.x = x
        self.y = y
        self.z = z
        self.type = 'office'
        self.neighbours = []
        self.food=0.0013*20
        self.ffood=0.001*20
        self.office_supplies=0.0063*20
        self.furniture=0.746*20
        self.daily=0.017*20

    def behaviour(self):
        nrlive = 0
        resi=0
        for n in self.neighbours:
            if n.type == 'office':
                nrlive += 1
            if n.type =='residence':
                resi+=1
        if nrlive<=7:
            return 'office'
        elif 10<=nrlive<=12:
            return 'residence'
        elif nrlive>=20:
            return 'void'
        else:
            return 'office'


    def getNeighbourCoordinates(self):
        neighbours = []
        list1=[-10,0,10]
        list2=[-4,0,4]
        for i in list1:
            for j in list1:
                for k in list2:
                    neighbours.append([self.x+i, self.y+j, self.z+k])
        neighbours.remove([self.x,self.y,self.z])
        return neighbours

class Cell_restaurant(Cell):
    def __init__(self, x, y, z):
        self.x = x
        self.y = y
        self.z = z
        self.type = 'restaurant'
        self.neighbours = []
        self.food=0.15*15
        self.ffood=0.09*15
        self.office_supplies=0.0008*15
        self.furniture=0.375*15
        self.daily=0.005*15

    def behaviour(self):
        nrlive = 0
        for n in self.neighbours:
            if n.type == 'restaurant':
                nrlive += 1
        if nrlive <=3:
            return 'market'
        elif 11<=nrlive<=17:
            return 'market'

        elif nrlive>=22:
            return 'void'
        else:
            return 'restaurant'

    def getNeighbourCoordinates(self):
        neighbours = []
        list1=[-10,0,10]
        list2=[-4,0,4]
        for i in list1:
            for j in list1:
                for k in list2:
                    neighbours.append([self.x+i, self.y+j, self.z+k])
        neighbours.remove([self.x,self.y,self.z])
        return neighbours

class Cell_market(Cell):
    def __init__(self, x, y, z):
        self.x = x
        self.y = y
        self.z = z
        self.type = 'market'
        self.neighbours = []
        self.food=0.0008*20
        self.ffood=0.0006*20
        self.office_supplies=0.0017*20
        self.furniture=0.221*20
        self.daily=0.55*20

    def behaviour(self):
        nrlive = 0
        for n in self.neighbours:
            if n.type == 'market':
                nrlive += 1
        if nrlive <=3:
            return 'residence'
        elif 8<=nrlive<=17:
            return 'restaurant'
        elif nrlive>=18:
            return 'void'

        else:
            return 'market'

    def getNeighbourCoordinates(self):
        neighbours = []
        list1=[-10,0,10]
        list2=[-4,0,4]
        for i in list1:
            for j in list1:
                for k in list2:
                    neighbours.append([self.x+i, self.y+j, self.z+k])
        neighbours.remove([self.x,self.y,self.z])
        return neighbours

class Cell_residence(Cell):
    def __init__(self, x, y, z):
        self.x = x
        self.y = y
        self.z = z
        self.type = 'residence'
        self.neighbours = []
        self.food=0.005*8
        self.ffood=0.003*8
        self.office_supplies=0.0003*8
        self.furniture=1.113*8
        self.daily=0.021*8

    def behaviour(self):
        nrlive = 0
        for n in self.neighbours:
            if n.type == 'residence':
                nrlive += 1
        if nrlive <=3:
            return 'residence'
        elif 18<=nrlive<=19:
            return 'education'
        elif 11<=nrlive<=13:
            return 'market'
        elif nrlive>=20:
            return 'void'
        else:
            return 'residence'

    def getNeighbourCoordinates(self):
        neighbours = []
        list1=[-10,0,10]
        list2=[-4,0,4]
        for i in list1:
            for j in list1:
                for k in list2:
                    neighbours.append([self.x+i, self.y+j, self.z+k])
        neighbours.remove([self.x,self.y,self.z])
        return neighbours

class Cell_education(Cell):
    def __init__(self, x, y, z):
        self.x = x
        self.y = y
        self.z = z
        self.type = 'education'
        self.neighbours = []
        self.food=0.0018*50
        self.ffood=0.001*50
        self.office_supplies=0.009*50
        self.furniture=0.294*50
        self.daily=0.007*50

    def behaviour(self):
        nrlive = 0
        for n in self.neighbours:
            if n.type == 'education':
                nrlive += 1
        if nrlive <=3:
            return 'residence'
        elif 11<=nrlive<=13:
            return 'residence'
        elif nrlive>=20:
            return 'void'
        else:
            return 'education'

    def getNeighbourCoordinates(self):
        neighbours = []
        list1=[-10,0,10]
        list2=[-4,0,4]
        for i in list1:
            for j in list1:
                for k in list2:
                    neighbours.append([self.x+i, self.y+j, self.z+k])
        neighbours.remove([self.x,self.y,self.z])
        return neighbours

class Cell_space(Cell):
    def __init__(self, x, y, z):
        self.x = x
        self.y = y
        self.z = z
        self.type = 'space'
        self.neighbours = []
        self.food=0
        self.ffood=0
        self.office_supplies=0
        self.furniture=0
        self.daily=0

    def behaviour(self):
        office = 0
        residence=0
        restaurant=0
        market=0
        education=0
        space=0
        for n in self.neighbours:
            if n.type == 'office':
                office += 1
            elif n.type == 'residence':
                residence += 1
            elif n.type == 'restaurant':
                restaurant += 1
            elif n.type == 'market':
                market += 1
            elif n.type == 'education':
                education += 1
            elif n.type == 'space':
                space += 1
        if office>=8:
            return 'office'
        if residence>=8:
            return 'residence'



    def getNeighbourCoordinates(self):
        neighbours = []
        list1=[-10,0,10]
        list2=[-4,0,4]
        for i in list1:
            for j in list1:
                for k in list2:
                    neighbours.append([self.x+i, self.y+j, self.z+k])
        neighbours.remove([self.x,self.y,self.z])
        return neighbours

envcell=[]
for k in range(51):
    for i,j in zip(X,Y):
        if int(i)%5!=0:
            i=i+1
        if int(j)%5!=0:
            j=j+1
        envcell.append((int(i),int(j),int(k)*4+2))
spacecell=envcell[:]

celldict={}
if officeX != None:
    for i,j,k in zip(officeX,officeY,officeZ):
        if int(i)%5!=0:
            i=i+1
        if int(j)%5!=0:
            j=j+1
        c=Cell_office(int(i),int(j),int(k))
        celldict[int(i),int(j),int(k)]=c
        if spacecell.__contains__((int(i),int(j),int(k)))==True:
            spacecell.remove((int(i),int(j),int(k)))
if restaurantX != None:
    for i,j,k in zip(restaurantX,restaurantY,restaurantZ):
        if int(i)%5!=0:
            i=i+1
        if int(j)%5!=0:
            j=j+1
        c=Cell_restaurant(int(i),int(j),int(k))
        celldict[int(i),int(j),int(k)]=c
        if spacecell.__contains__((int(i),int(j),int(k)))==True:
            spacecell.remove((int(i),int(j),int(k)))
if commerceX != None:
    for i,j,k in zip(commerceX,commerceY,commerceZ):
        if int(i)%5!=0:
            i=i+1
        if int(j)%5!=0:
            j=j+1
        c=Cell_market(int(i),int(j),int(k))
        celldict[int(i),int(j),int(k)]=c
        if spacecell.__contains__((int(i),int(j),int(k)))==True:
            spacecell.remove((int(i),int(j),int(k)))
if residenceX != None:
    for i,j,k in zip(residenceX,residenceY,residenceZ):
        if int(i)%5!=0:
            i=i+1
        if int(j)%5!=0:
            j=j+1
        c=Cell_residence(int(i),int(j),int(k))
        celldict[int(i),int(j),int(k)]=c
        if spacecell.__contains__((int(i),int(j),int(k)))==True:
            spacecell.remove((int(i),int(j),int(k)))
if educationX != None:
    for i,j,k in zip(educationX,educationY,educationZ):
        if int(i)%5!=0:
            i=i+1
        if int(j)%5!=0:
            j=j+1
        c=Cell_education(int(i),int(j),int(k))
        celldict[int(i),int(j),int(k)]=c
        if spacecell.__contains__((int(i),int(j),int(k)))==True:
            spacecell.remove((int(i),int(j),int(k)))
for v in spacecell:
    c=Cell_space(v[0],v[1],v[2])
    celldict[v[0],v[1],v[2]]=c

for i in celldict:
    c=celldict[i]
    neigourCoords = c.getNeighbourCoordinates()
    for n in neigourCoords:
       if celldict.__contains__((n[0],n[1],n[2]))==True:
           c.neighbours.append(celldict[n[0],n[1],n[2]])


def evaluate(dict):
    food=Food
    frozen_food=Frozen_food
    office_supplies=Office_supplies
    furniture=Furniture
    daily_necessities=Daily_necessities
    nextCellDict={}
    for i in dict:
        c = dict[i]
        next = c.behaviour()
        if next == 'office':
            nCell = Cell_office(c.x,c.y,c.z)
            food=food+c.food-nCell.food
            frozen_food=frozen_food+c.ffood-nCell.ffood
            office_supplies=office_supplies+c.office_supplies-nCell.office_supplies
            furniture=furniture+c.furniture-nCell.furniture
            daily_necessities=daily_necessities+c.daily-nCell.daily
            if food>=0 and frozen_food>=0 and office_supplies>=0 and furniture>=0 and daily_necessities>=0:
                nextCellDict[c.x,c.y,c.z] = nCell
        elif next == 'restaurant':
            nCell = Cell_restaurant(c.x,c.y,c.z)
            food=food+c.food-nCell.food
            frozen_food=frozen_food+c.ffood-nCell.ffood
            office_supplies=office_supplies+c.office_supplies-nCell.office_supplies
            furniture=furniture+c.furniture-nCell.furniture
            daily_necessities=daily_necessities+c.daily-nCell.daily
            if food>=0 and frozen_food>=0 and office_supplies>=0 and furniture>=0 and daily_necessities>=0:
                nextCellDict[c.x,c.y,c.z] = nCell
        elif next == 'market':
            nCell = Cell_market(c.x,c.y,c.z)
            food=food+c.food-nCell.food
            frozen_food=frozen_food+c.ffood-nCell.ffood
            office_supplies=office_supplies+c.office_supplies-nCell.office_supplies
            furniture=furniture+c.furniture-nCell.furniture
            daily_necessities=daily_necessities+c.daily-nCell.daily
            if food>=0 and frozen_food>=0 and office_supplies>=0 and furniture>=0 and daily_necessities>=0:
                nextCellDict[c.x,c.y,c.z] = nCell
        elif next == 'residence':
            nCell = Cell_residence(c.x,c.y,c.z)
            food=food+c.food-nCell.food
            frozen_food=frozen_food+c.ffood-nCell.ffood
            office_supplies=office_supplies+c.office_supplies-nCell.office_supplies
            furniture=furniture+c.furniture-nCell.furniture
            daily_necessities=daily_necessities+c.daily-nCell.daily
            if food>=0 and frozen_food>=0 and office_supplies>=0 and furniture>=0 and daily_necessities>=0:
                nextCellDict[c.x,c.y,c.z] = nCell
        elif next == 'education':
            nCell = Cell_education(c.x,c.y,c.z)
            food=food+c.food-nCell.food
            frozen_food=frozen_food+c.ffood-nCell.ffood
            office_supplies=office_supplies+c.office_supplies-nCell.office_supplies
            furniture=furniture+c.furniture-nCell.furniture
            daily_necessities=daily_necessities+c.daily-nCell.daily
            if food>=0 and frozen_food>=0 and office_supplies>=0 and furniture>=0 and daily_necessities>=0:
                nextCellDict[c.x,c.y,c.z] = nCell
        elif next == 'void':
            nCell = Cell_void(c.x,c.y,c.z)
            nextCellDict[c.x,c.y,c.z] = nCell
            food=food+c.food
            frozen_food=frozen_food+c.ffood
            office_supplies=office_supplies+c.office_supplies
            furniture=furniture+c.furniture
            daily_necessities=daily_necessities+c.daily
        else:
            c.neighbours = []
            nextCellDict[c.x,c.y,c.z] = c

    for i in nextCellDict:
        c = nextCellDict[i]
        neigourCoords = c.getNeighbourCoordinates()
        for n in neigourCoords:
            if nextCellDict.__contains__((n[0],n[1],n[2]))==True:
                c.neighbours.append(nextCellDict[n[0],n[1],n[2]])

    dict = nextCellDict
    return dict,food,frozen_food,office_supplies,furniture,daily_necessities

officelist=[]
restaurantlist=[]
marketlist=[]
residencelist=[]
educationlist=[]
voidlist=[]

for g in range(int(generation)):
    officelist=[]
    restaurantlist=[]
    marketlist=[]
    residencelist=[]
    educationlist=[]
    voidlist=[]
    for i in celldict:
        c=celldict[i]
        if c.type=='office':
            officelist.append([c.x,c.y,c.z])
        elif c.type=='restaurant':
            restaurantlist.append([c.x,c.y,c.z])
        elif c.type=='market':
            marketlist.append([c.x,c.y,c.z])
        elif c.type=='residence':
            residencelist.append([c.x,c.y,c.z])
        elif c.type=='education':
            educationlist.append([c.x,c.y,c.z])
        elif c.type=='void':
            voidlist.append([c.x,c.y,c.z])
    celldict,cfood,cffood,coffice,cfurniture,cdaily=evaluate(celldict)

officepoints=[]
restaurantpoints=[]
marketpoints=[]
residencepoints=[]
educationpoints=[]
voidpoints=[]
for p in officelist:
    point3d=rg.Point3d(int(p[0]),int(p[1]),int(p[2]))
    officepoints.append(point3d)
for p in restaurantlist:
    point3d=rg.Point3d(int(p[0]),int(p[1]),int(p[2]))
    restaurantpoints.append(point3d)
for p in marketlist:
    point3d=rg.Point3d(int(p[0]),int(p[1]),int(p[2]))
    marketpoints.append(point3d)
for p in residencelist:
    point3d=rg.Point3d(int(p[0]),int(p[1]),int(p[2]))
    residencepoints.append(point3d)
for p in educationlist:
    point3d=rg.Point3d(int(p[0]),int(p[1]),int(p[2]))
    educationpoints.append(point3d)
for p in voidlist:
    point3d=rg.Point3d(int(p[0]),int(p[1]),int(p[2]))
    voidpoints.append(point3d)
# ---------- end ghpython_script_14 ----------
ghpython_script_15 = GhPythonScript(
    X=deconstruct_67.XComponent,
    Y=deconstruct_67.YComponent,
    Z=deconstruct_67.ZComponent,
    officeX=deconstruct_23.XComponent,
    officeY=deconstruct_23.YComponent,
    officeZ=deconstruct_23.ZComponent,
    restaurantX=deconstruct_24.XComponent,
    restaurantY=deconstruct_24.YComponent,
    restaurantZ=deconstruct_24.ZComponent,
    commerceX=deconstruct_26.XComponent,
    commerceY=deconstruct_26.YComponent,
    commerceZ=deconstruct_26.ZComponent,
    residenceX=deconstruct_33.XComponent,
    residenceY=deconstruct_33.YComponent,
    residenceZ=deconstruct_33.ZComponent,
    generation=number_slider,
    Food=ghpython_script_10.food,
    Frozen_food=ghpython_script_10.ffood,
    Office_supplies=ghpython_script_10.officesp,
    Furniture=ghpython_script_10.furniture,
    Daily_necessities=ghpython_script_10.daily)  # -> out, officepoints, restaurantpoints, marketpoints, residencepoints, educationpoints, voidpoints; inputs X: list, Y: list, Z: list, officeX: list, officeY: list, officeZ: list, restaurantX: list, restaurantY: list, restaurantZ: list, commerceX: list, commerceY: list, commerceZ: list, residenceX: list, residenceY: list, residenceZ: list, educationX: list, educationY: list, educationZ: list
# ---------- ghpython_script_15: Python ----------
__author__ = "laoma"
__version__ = "2022.03.12"

import rhinoscriptsyntax as rs
import random
from ghpythonlib.componentbase import executingcomponent as component
import Grasshopper, GhPython
import Rhino.Geometry as rg


class Cell:
  def __init__(self, x, y, z):
    self.x = x
    self.y = y
    self.z = z
    self.type = None

class Cell_void(Cell):
    def __init__(self, x, y, z):
        self.x = x
        self.y = y
        self.z = z
        self.type = 'void'
        self.neighbours = []
        self.food=0
        self.ffood=0
        self.office_supplies=0
        self.furniture=0
        self.daily=0

    def behaviour(self):
        return 'void'


    def getNeighbourCoordinates(self):
        neighbours = []
        list1=[-10,0,10]
        list2=[-4,0,4]
        for i in list1:
            for j in list1:
                for k in list2:
                    neighbours.append([self.x+i, self.y+j, self.z+k])
        neighbours.remove([self.x,self.y,self.z])
        return neighbours

class Cell_office(Cell):
    def __init__(self, x, y, z):
        self.x = x
        self.y = y
        self.z = z
        self.type = 'office'
        self.neighbours = []
        self.food=0.0013*20
        self.ffood=0.001*20
        self.office_supplies=0.0063*20
        self.furniture=0.746*20
        self.daily=0.017*20

    def behaviour(self):
        nrlive = 0
        resi=0
        for n in self.neighbours:
            if n.type == 'office':
                nrlive += 1
            if n.type =='residence':
                resi+=1
        if nrlive<=7:
            return 'office'
        elif 10<=nrlive<=12:
            return 'residence'
        elif nrlive>=22:
            return 'void'
        else:
            return 'office'


    def getNeighbourCoordinates(self):
        neighbours = []
        list1=[-10,0,10]
        list2=[-4,0,4]
        for i in list1:
            for j in list1:
                for k in list2:
                    neighbours.append([self.x+i, self.y+j, self.z+k])
        neighbours.remove([self.x,self.y,self.z])
        return neighbours

class Cell_restaurant(Cell):
    def __init__(self, x, y, z):
        self.x = x
        self.y = y
        self.z = z
        self.type = 'restaurant'
        self.neighbours = []
        self.food=0.15*15
        self.ffood=0.09*15
        self.office_supplies=0.0008*15
        self.furniture=0.375*15
        self.daily=0.005*15

    def behaviour(self):
        nrlive = 0
        for n in self.neighbours:
            if n.type == 'restaurant':
                nrlive += 1
        if nrlive <=3:
            return 'market'
        elif 11<=nrlive<=17:
            return 'market'

        elif nrlive>=22:
            return 'void'
        else:
            return 'restaurant'

    def getNeighbourCoordinates(self):
        neighbours = []
        list1=[-10,0,10]
        list2=[-4,0,4]
        for i in list1:
            for j in list1:
                for k in list2:
                    neighbours.append([self.x+i, self.y+j, self.z+k])
        neighbours.remove([self.x,self.y,self.z])
        return neighbours

class Cell_market(Cell):
    def __init__(self, x, y, z):
        self.x = x
        self.y = y
        self.z = z
        self.type = 'market'
        self.neighbours = []
        self.food=0.0008*20
        self.ffood=0.0006*20
        self.office_supplies=0.0017*20
        self.furniture=0.221*20
        self.daily=0.55*20

    def behaviour(self):
        nrlive = 0
        for n in self.neighbours:
            if n.type == 'market':
                nrlive += 1
        if nrlive <=3:
            return 'residence'
        elif 8<=nrlive<=17:
            return 'restaurant'
        elif nrlive>=18:
            return 'void'

        else:
            return 'market'

    def getNeighbourCoordinates(self):
        neighbours = []
        list1=[-10,0,10]
        list2=[-4,0,4]
        for i in list1:
            for j in list1:
                for k in list2:
                    neighbours.append([self.x+i, self.y+j, self.z+k])
        neighbours.remove([self.x,self.y,self.z])
        return neighbours

class Cell_residence(Cell):
    def __init__(self, x, y, z):
        self.x = x
        self.y = y
        self.z = z
        self.type = 'residence'
        self.neighbours = []
        self.food=0.005*8
        self.ffood=0.003*8
        self.office_supplies=0.0003*8
        self.furniture=1.113*8
        self.daily=0.021*8

    def behaviour(self):
        nrlive = 0
        for n in self.neighbours:
            if n.type == 'residence':
                nrlive += 1
        if nrlive <=3:
            return 'office'
        elif 11<=nrlive<=13:
            return 'market'
        elif nrlive>=20:
            return 'void'
        else:
            return 'residence'

    def getNeighbourCoordinates(self):
        neighbours = []
        list1=[-10,0,10]
        list2=[-4,0,4]
        for i in list1:
            for j in list1:
                for k in list2:
                    neighbours.append([self.x+i, self.y+j, self.z+k])
        neighbours.remove([self.x,self.y,self.z])
        return neighbours

class Cell_education(Cell):
    def __init__(self, x, y, z):
        self.x = x
        self.y = y
        self.z = z
        self.type = 'education'
        self.neighbours = []
        self.food=0.0018*50
        self.ffood=0.001*50
        self.office_supplies=0.009*50
        self.furniture=0.294*50
        self.daily=0.007*50

    def behaviour(self):
        nrlive = 0
        for n in self.neighbours:
            if n.type == 'residence':
                nrlive += 1
        if nrlive <=3:
            return 'residence'
        elif 11<=nrlive<=13:
            return 'residence'
        elif nrlive>=20:
            return 'void'
        else:
            return 'education'

    def getNeighbourCoordinates(self):
        neighbours = []
        list1=[-10,0,10]
        list2=[-4,0,4]
        for i in list1:
            for j in list1:
                for k in list2:
                    neighbours.append([self.x+i, self.y+j, self.z+k])
        neighbours.remove([self.x,self.y,self.z])
        return neighbours

class Cell_space(Cell):
    def __init__(self, x, y, z):
        self.x = x
        self.y = y
        self.z = z
        self.type = 'space'
        self.neighbours = []
        self.food=0
        self.ffood=0
        self.office_supplies=0
        self.furniture=0
        self.daily=0

    def behaviour(self):
        office = 0
        residence=0
        restaurant=0
        market=0
        education=0
        space=0
        for n in self.neighbours:
            if n.type == 'office':
                office += 1
            elif n.type == 'residence':
                residence += 1
            elif n.type == 'restaurant':
                restaurant += 1
            elif n.type == 'market':
                market += 1
            elif n.type == 'education':
                education += 1
            elif n.type == 'space':
                space += 1
        if office>=8:
            return 'office'
        if residence>=8:
            return 'residence'



    def getNeighbourCoordinates(self):
        neighbours = []
        list1=[-10,0,10]
        list2=[-4,0,4]
        for i in list1:
            for j in list1:
                for k in list2:
                    neighbours.append([self.x+i, self.y+j, self.z+k])
        neighbours.remove([self.x,self.y,self.z])
        return neighbours

envcell=[]
for k in range(51):
    for i,j in zip(X,Y):
        if int(i)%5!=0:
            i=i+1
        if int(j)%5!=0:
            j=j+1
        envcell.append((int(i),int(j),int(k)*4+2))
spacecell=envcell[:]

celldict={}
if officeX != None:
    for i,j,k in zip(officeX,officeY,officeZ):
        if int(i)%5!=0:
            i=i+1
        if int(j)%5!=0:
            j=j+1
        c=Cell_office(int(i),int(j),int(k))
        celldict[int(i),int(j),int(k)]=c
        if spacecell.__contains__((int(i),int(j),int(k)))==True:
            spacecell.remove((int(i),int(j),int(k)))
if restaurantX != None:
    for i,j,k in zip(restaurantX,restaurantY,restaurantZ):
        if int(i)%5!=0:
            i=i+1
        if int(j)%5!=0:
            j=j+1
        c=Cell_restaurant(int(i),int(j),int(k))
        celldict[int(i),int(j),int(k)]=c
        if spacecell.__contains__((int(i),int(j),int(k)))==True:
            spacecell.remove((int(i),int(j),int(k)))
if commerceX != None:
    for i,j,k in zip(commerceX,commerceY,commerceZ):
        if int(i)%5!=0:
            i=i+1
        if int(j)%5!=0:
            j=j+1
        c=Cell_market(int(i),int(j),int(k))
        celldict[int(i),int(j),int(k)]=c
        if spacecell.__contains__((int(i),int(j),int(k)))==True:
            spacecell.remove((int(i),int(j),int(k)))
if residenceX != None:
    for i,j,k in zip(residenceX,residenceY,residenceZ):
        if int(i)%5!=0:
            i=i+1
        if int(j)%5!=0:
            j=j+1
        c=Cell_residence(int(i),int(j),int(k))
        celldict[int(i),int(j),int(k)]=c
        if spacecell.__contains__((int(i),int(j),int(k)))==True:
            spacecell.remove((int(i),int(j),int(k)))
if educationX != None:
    for i,j,k in zip(educationX,educationY,educationZ):
        if int(i)%5!=0:
            i=i+1
        if int(j)%5!=0:
            j=j+1
        c=Cell_education(int(i),int(j),int(k))
        celldict[int(i),int(j),int(k)]=c
        if spacecell.__contains__((int(i),int(j),int(k)))==True:
            spacecell.remove((int(i),int(j),int(k)))
for v in spacecell:
    c=Cell_space(v[0],v[1],v[2])
    celldict[v[0],v[1],v[2]]=c

for i in celldict:
    c=celldict[i]
    neigourCoords = c.getNeighbourCoordinates()
    for n in neigourCoords:
       if celldict.__contains__((n[0],n[1],n[2]))==True:
           c.neighbours.append(celldict[n[0],n[1],n[2]])


def evaluate(dict):
    food=Food
    frozen_food=Frozen_food
    office_supplies=Office_supplies
    furniture=Furniture
    daily_necessities=Daily_necessities
    nextCellDict={}
    for i in dict:
        c = dict[i]
        next = c.behaviour()
        if next == 'office':
            nCell = Cell_office(c.x,c.y,c.z)
            food=food+c.food-nCell.food
            frozen_food=frozen_food+c.ffood-nCell.ffood
            office_supplies=office_supplies+c.office_supplies-nCell.office_supplies
            furniture=furniture+c.furniture-nCell.furniture
            daily_necessities=daily_necessities+c.daily-nCell.daily
            if food>=0 and frozen_food>=0 and office_supplies>=0 and furniture>=0 and daily_necessities>=0:
                nextCellDict[c.x,c.y,c.z] = nCell
        elif next == 'restaurant':
            nCell = Cell_restaurant(c.x,c.y,c.z)
            food=food+c.food-nCell.food
            frozen_food=frozen_food+c.ffood-nCell.ffood
            office_supplies=office_supplies+c.office_supplies-nCell.office_supplies
            furniture=furniture+c.furniture-nCell.furniture
            daily_necessities=daily_necessities+c.daily-nCell.daily
            if food>=0 and frozen_food>=0 and office_supplies>=0 and furniture>=0 and daily_necessities>=0:
                nextCellDict[c.x,c.y,c.z] = nCell
        elif next == 'market':
            nCell = Cell_market(c.x,c.y,c.z)
            food=food+c.food-nCell.food
            frozen_food=frozen_food+c.ffood-nCell.ffood
            office_supplies=office_supplies+c.office_supplies-nCell.office_supplies
            furniture=furniture+c.furniture-nCell.furniture
            daily_necessities=daily_necessities+c.daily-nCell.daily
            if food>=0 and frozen_food>=0 and office_supplies>=0 and furniture>=0 and daily_necessities>=0:
                nextCellDict[c.x,c.y,c.z] = nCell
        elif next == 'residence':
            nCell = Cell_residence(c.x,c.y,c.z)
            food=food+c.food-nCell.food
            frozen_food=frozen_food+c.ffood-nCell.ffood
            office_supplies=office_supplies+c.office_supplies-nCell.office_supplies
            furniture=furniture+c.furniture-nCell.furniture
            daily_necessities=daily_necessities+c.daily-nCell.daily
            if food>=0 and frozen_food>=0 and office_supplies>=0 and furniture>=0 and daily_necessities>=0:
                nextCellDict[c.x,c.y,c.z] = nCell
        elif next == 'education':
            nCell = Cell_education(c.x,c.y,c.z)
            food=food+c.food-nCell.food
            frozen_food=frozen_food+c.ffood-nCell.ffood
            office_supplies=office_supplies+c.office_supplies-nCell.office_supplies
            furniture=furniture+c.furniture-nCell.furniture
            daily_necessities=daily_necessities+c.daily-nCell.daily
            if food>=0 and frozen_food>=0 and office_supplies>=0 and furniture>=0 and daily_necessities>=0:
                nextCellDict[c.x,c.y,c.z] = nCell
        elif next == 'void':
            nCell = Cell_void(c.x,c.y,c.z)
            nextCellDict[c.x,c.y,c.z] = nCell
            food=food+c.food
            frozen_food=frozen_food+c.ffood
            office_supplies=office_supplies+c.office_supplies
            furniture=furniture+c.furniture
            daily_necessities=daily_necessities+c.daily
        else:
            c.neighbours = []
            nextCellDict[c.x,c.y,c.z] = c

    for i in nextCellDict:
        c = nextCellDict[i]
        neigourCoords = c.getNeighbourCoordinates()
        for n in neigourCoords:
            if nextCellDict.__contains__((n[0],n[1],n[2]))==True:
                c.neighbours.append(nextCellDict[n[0],n[1],n[2]])

    dict = nextCellDict
    return dict,food,frozen_food,office_supplies,furniture,daily_necessities

officelist=[]
restaurantlist=[]
marketlist=[]
residencelist=[]
educationlist=[]
voidlist=[]

for g in range(int(generation)):
    officelist=[]
    restaurantlist=[]
    marketlist=[]
    residencelist=[]
    educationlist=[]
    voidlist=[]
    for i in celldict:
        c=celldict[i]
        if c.type=='office':
            officelist.append([c.x,c.y,c.z])
        elif c.type=='restaurant':
            restaurantlist.append([c.x,c.y,c.z])
        elif c.type=='market':
            marketlist.append([c.x,c.y,c.z])
        elif c.type=='residence':
            residencelist.append([c.x,c.y,c.z])
        elif c.type=='education':
            educationlist.append([c.x,c.y,c.z])
        elif c.type=='void':
            voidlist.append([c.x,c.y,c.z])
    celldict,cfood,cffood,coffice,cfurniture,cdaily=evaluate(celldict)

officepoints=[]
restaurantpoints=[]
marketpoints=[]
residencepoints=[]
educationpoints=[]
voidpoints=[]
for p in officelist:
    point3d=rg.Point3d(int(p[0]),int(p[1]),int(p[2]))
    officepoints.append(point3d)
for p in restaurantlist:
    point3d=rg.Point3d(int(p[0]),int(p[1]),int(p[2]))
    restaurantpoints.append(point3d)
for p in marketlist:
    point3d=rg.Point3d(int(p[0]),int(p[1]),int(p[2]))
    marketpoints.append(point3d)
for p in residencelist:
    point3d=rg.Point3d(int(p[0]),int(p[1]),int(p[2]))
    residencepoints.append(point3d)
for p in educationlist:
    point3d=rg.Point3d(int(p[0]),int(p[1]),int(p[2]))
    educationpoints.append(point3d)
for p in voidlist:
    point3d=rg.Point3d(int(p[0]),int(p[1]),int(p[2]))
    voidpoints.append(point3d)
# ---------- end ghpython_script_15 ----------
point_85 = Point(area_14.Centroid)
ghpython_script_16 = GhPythonScript(
    office=list_length_36,
    restaurant=list_length_37,
    market=list_length_38,
    residence=list_length_40,
    education=list_length_39)  # -> out, food, ffood, officesp, furniture, daily; same code as ghpython_script_3
ghpython_script_17 = GhPythonScript(
    X=deconstruct_68.XComponent,
    Y=deconstruct_68.YComponent,
    Z=deconstruct_68.ZComponent,
    officeX=deconstruct_28.XComponent,
    officeY=deconstruct_28.YComponent,
    officeZ=deconstruct_28.ZComponent,
    restaurantX=deconstruct_29.XComponent,
    restaurantY=deconstruct_29.YComponent,
    restaurantZ=deconstruct_29.ZComponent,
    commerceX=deconstruct_31.XComponent,
    commerceY=deconstruct_31.YComponent,
    commerceZ=deconstruct_31.ZComponent,
    generation=number_slider,
    Food=ghpython_script_11.food,
    Frozen_food=ghpython_script_11.ffood,
    Office_supplies=ghpython_script_11.officesp,
    Furniture=ghpython_script_11.furniture,
    Daily_necessities=ghpython_script_11.daily)  # -> out, officepoints, restaurantpoints, marketpoints, residencepoints, educationpoints, voidpoints; inputs X: list, Y: list, Z: list, officeX: list, officeY: list, officeZ: list, restaurantX: list, restaurantY: list, restaurantZ: list, commerceX: list, commerceY: list, commerceZ: list, residenceX: list, residenceY: list, residenceZ: list, educationX: list, educationY: list, educationZ: list
# ---------- ghpython_script_17: Python ----------
__author__ = "laoma"
__version__ = "2022.03.12"

import rhinoscriptsyntax as rs
import random
from ghpythonlib.componentbase import executingcomponent as component
import Grasshopper, GhPython
import Rhino.Geometry as rg


class Cell:
  def __init__(self, x, y, z):
    self.x = x
    self.y = y
    self.z = z
    self.type = None

class Cell_void(Cell):
    def __init__(self, x, y, z):
        self.x = x
        self.y = y
        self.z = z
        self.type = 'void'
        self.neighbours = []
        self.food=0
        self.ffood=0
        self.office_supplies=0
        self.furniture=0
        self.daily=0

    def behaviour(self):
        return 'void'


    def getNeighbourCoordinates(self):
        neighbours = []
        list1=[-10,0,10]
        list2=[-4,0,4]
        for i in list1:
            for j in list1:
                for k in list2:
                    neighbours.append([self.x+i, self.y+j, self.z+k])
        neighbours.remove([self.x,self.y,self.z])
        return neighbours

class Cell_office(Cell):
    def __init__(self, x, y, z):
        self.x = x
        self.y = y
        self.z = z
        self.type = 'office'
        self.neighbours = []
        self.food=0.0013*20
        self.ffood=0.001*20
        self.office_supplies=0.0063*20
        self.furniture=0.746*20
        self.daily=0.017*20

    def behaviour(self):
        nrlive = 0
        resi=0
        for n in self.neighbours:
            if n.type == 'office':
                nrlive += 1
            if n.type =='residence':
                resi+=1
        if nrlive<=7:
            return 'office'
        elif 10<=nrlive<=12:
            return 'residence'
        elif nrlive>=20:
            return 'void'
        else:
            return 'office'


    def getNeighbourCoordinates(self):
        neighbours = []
        list1=[-10,0,10]
        list2=[-4,0,4]
        for i in list1:
            for j in list1:
                for k in list2:
                    neighbours.append([self.x+i, self.y+j, self.z+k])
        neighbours.remove([self.x,self.y,self.z])
        return neighbours

class Cell_restaurant(Cell):
    def __init__(self, x, y, z):
        self.x = x
        self.y = y
        self.z = z
        self.type = 'restaurant'
        self.neighbours = []
        self.food=0.15*15
        self.ffood=0.09*15
        self.office_supplies=0.0008*15
        self.furniture=0.375*15
        self.daily=0.005*15

    def behaviour(self):
        nrlive = 0
        for n in self.neighbours:
            if n.type == 'restaurant':
                nrlive += 1
        if nrlive <=3:
            return 'market'
        elif 11<=nrlive<=17:
            return 'market'

        elif nrlive>=22:
            return 'void'
        else:
            return 'restaurant'

    def getNeighbourCoordinates(self):
        neighbours = []
        list1=[-10,0,10]
        list2=[-4,0,4]
        for i in list1:
            for j in list1:
                for k in list2:
                    neighbours.append([self.x+i, self.y+j, self.z+k])
        neighbours.remove([self.x,self.y,self.z])
        return neighbours

class Cell_market(Cell):
    def __init__(self, x, y, z):
        self.x = x
        self.y = y
        self.z = z
        self.type = 'market'
        self.neighbours = []
        self.food=0.0008*20
        self.ffood=0.0006*20
        self.office_supplies=0.0017*20
        self.furniture=0.221*20
        self.daily=0.55*20

    def behaviour(self):
        nrlive = 0
        for n in self.neighbours:
            if n.type == 'market':
                nrlive += 1
        if nrlive <=3:
            return 'residence'
        elif 8<=nrlive<=17:
            return 'restaurant'
        elif nrlive>=18:
            return 'void'

        else:
            return 'market'

    def getNeighbourCoordinates(self):
        neighbours = []
        list1=[-10,0,10]
        list2=[-4,0,4]
        for i in list1:
            for j in list1:
                for k in list2:
                    neighbours.append([self.x+i, self.y+j, self.z+k])
        neighbours.remove([self.x,self.y,self.z])
        return neighbours

class Cell_residence(Cell):
    def __init__(self, x, y, z):
        self.x = x
        self.y = y
        self.z = z
        self.type = 'residence'
        self.neighbours = []
        self.food=0.005*8
        self.ffood=0.003*8
        self.office_supplies=0.0003*8
        self.furniture=1.113*8
        self.daily=0.021*8

    def behaviour(self):
        nrlive = 0
        for n in self.neighbours:
            if n.type == 'residence':
                nrlive += 1
        if nrlive <=3:
            return 'office'
        elif 11<=nrlive<=13:
            return 'market'
        elif nrlive>=20:
            return 'void'
        else:
            return 'residence'

    def getNeighbourCoordinates(self):
        neighbours = []
        list1=[-10,0,10]
        list2=[-4,0,4]
        for i in list1:
            for j in list1:
                for k in list2:
                    neighbours.append([self.x+i, self.y+j, self.z+k])
        neighbours.remove([self.x,self.y,self.z])
        return neighbours

class Cell_education(Cell):
    def __init__(self, x, y, z):
        self.x = x
        self.y = y
        self.z = z
        self.type = 'education'
        self.neighbours = []
        self.food=0.0018*50
        self.ffood=0.001*50
        self.office_supplies=0.009*50
        self.furniture=0.294*50
        self.daily=0.007*50

    def behaviour(self):
        nrlive = 0
        for n in self.neighbours:
            if n.type == 'residence':
                nrlive += 1
        if nrlive <=3:
            return 'residence'
        elif 11<=nrlive<=13:
            return 'residence'
        elif nrlive>=20:
            return 'void'
        else:
            return 'education'

    def getNeighbourCoordinates(self):
        neighbours = []
        list1=[-10,0,10]
        list2=[-4,0,4]
        for i in list1:
            for j in list1:
                for k in list2:
                    neighbours.append([self.x+i, self.y+j, self.z+k])
        neighbours.remove([self.x,self.y,self.z])
        return neighbours

class Cell_space(Cell):
    def __init__(self, x, y, z):
        self.x = x
        self.y = y
        self.z = z
        self.type = 'space'
        self.neighbours = []
        self.food=0
        self.ffood=0
        self.office_supplies=0
        self.furniture=0
        self.daily=0

    def behaviour(self):
        office = 0
        residence=0
        restaurant=0
        market=0
        education=0
        space=0
        for n in self.neighbours:
            if n.type == 'office':
                office += 1
            elif n.type == 'residence':
                residence += 1
            elif n.type == 'restaurant':
                restaurant += 1
            elif n.type == 'market':
                market += 1
            elif n.type == 'education':
                education += 1
            elif n.type == 'space':
                space += 1
        if office>=8:
            return 'office'
        if residence>=8:
            return 'residence'



    def getNeighbourCoordinates(self):
        neighbours = []
        list1=[-10,0,10]
        list2=[-4,0,4]
        for i in list1:
            for j in list1:
                for k in list2:
                    neighbours.append([self.x+i, self.y+j, self.z+k])
        neighbours.remove([self.x,self.y,self.z])
        return neighbours

envcell=[]
for k in range(51):
    for i,j in zip(X,Y):
        if int(i)%5!=0:
            i=i+1
        if int(j)%5!=0:
            j=j+1
        envcell.append((int(i),int(j),int(k)*4+2))
spacecell=envcell[:]

celldict={}
if officeX != None:
    for i,j,k in zip(officeX,officeY,officeZ):
        if int(i)%5!=0:
            i=i+1
        if int(j)%5!=0:
            j=j+1
        c=Cell_office(int(i),int(j),int(k))
        celldict[int(i),int(j),int(k)]=c
        if spacecell.__contains__((int(i),int(j),int(k)))==True:
            spacecell.remove((int(i),int(j),int(k)))
if restaurantX != None:
    for i,j,k in zip(restaurantX,restaurantY,restaurantZ):
        if int(i)%5!=0:
            i=i+1
        if int(j)%5!=0:
            j=j+1
        c=Cell_restaurant(int(i),int(j),int(k))
        celldict[int(i),int(j),int(k)]=c
        if spacecell.__contains__((int(i),int(j),int(k)))==True:
            spacecell.remove((int(i),int(j),int(k)))
if commerceX != None:
    for i,j,k in zip(commerceX,commerceY,commerceZ):
        if int(i)%5!=0:
            i=i+1
        if int(j)%5!=0:
            j=j+1
        c=Cell_market(int(i),int(j),int(k))
        celldict[int(i),int(j),int(k)]=c
        if spacecell.__contains__((int(i),int(j),int(k)))==True:
            spacecell.remove((int(i),int(j),int(k)))
if residenceX != None:
    for i,j,k in zip(residenceX,residenceY,residenceZ):
        if int(i)%5!=0:
            i=i+1
        if int(j)%5!=0:
            j=j+1
        c=Cell_residence(int(i),int(j),int(k))
        celldict[int(i),int(j),int(k)]=c
        if spacecell.__contains__((int(i),int(j),int(k)))==True:
            spacecell.remove((int(i),int(j),int(k)))
if educationX != None:
    for i,j,k in zip(educationX,educationY,educationZ):
        if int(i)%5!=0:
            i=i+1
        if int(j)%5!=0:
            j=j+1
        c=Cell_education(int(i),int(j),int(k))
        celldict[int(i),int(j),int(k)]=c
        if spacecell.__contains__((int(i),int(j),int(k)))==True:
            spacecell.remove((int(i),int(j),int(k)))
for v in spacecell:
    c=Cell_space(v[0],v[1],v[2])
    celldict[v[0],v[1],v[2]]=c

for i in celldict:
    c=celldict[i]
    neigourCoords = c.getNeighbourCoordinates()
    for n in neigourCoords:
       if celldict.__contains__((n[0],n[1],n[2]))==True:
           c.neighbours.append(celldict[n[0],n[1],n[2]])


def evaluate(dict):
    food=Food
    frozen_food=Frozen_food
    office_supplies=Office_supplies
    furniture=Furniture
    daily_necessities=Daily_necessities
    nextCellDict={}
    for i in dict:
        c = dict[i]
        next = c.behaviour()
        if next == 'office':
            nCell = Cell_office(c.x,c.y,c.z)
            food=food+c.food-nCell.food
            frozen_food=frozen_food+c.ffood-nCell.ffood
            office_supplies=office_supplies+c.office_supplies-nCell.office_supplies
            furniture=furniture+c.furniture-nCell.furniture
            daily_necessities=daily_necessities+c.daily-nCell.daily
            if food>=0 and frozen_food>=0 and office_supplies>=0 and furniture>=0 and daily_necessities>=0:
                nextCellDict[c.x,c.y,c.z] = nCell
        elif next == 'restaurant':
            nCell = Cell_restaurant(c.x,c.y,c.z)
            food=food+c.food-nCell.food
            frozen_food=frozen_food+c.ffood-nCell.ffood
            office_supplies=office_supplies+c.office_supplies-nCell.office_supplies
            furniture=furniture+c.furniture-nCell.furniture
            daily_necessities=daily_necessities+c.daily-nCell.daily
            if food>=0 and frozen_food>=0 and office_supplies>=0 and furniture>=0 and daily_necessities>=0:
                nextCellDict[c.x,c.y,c.z] = nCell
        elif next == 'market':
            nCell = Cell_market(c.x,c.y,c.z)
            food=food+c.food-nCell.food
            frozen_food=frozen_food+c.ffood-nCell.ffood
            office_supplies=office_supplies+c.office_supplies-nCell.office_supplies
            furniture=furniture+c.furniture-nCell.furniture
            daily_necessities=daily_necessities+c.daily-nCell.daily
            if food>=0 and frozen_food>=0 and office_supplies>=0 and furniture>=0 and daily_necessities>=0:
                nextCellDict[c.x,c.y,c.z] = nCell
        elif next == 'residence':
            nCell = Cell_residence(c.x,c.y,c.z)
            food=food+c.food-nCell.food
            frozen_food=frozen_food+c.ffood-nCell.ffood
            office_supplies=office_supplies+c.office_supplies-nCell.office_supplies
            furniture=furniture+c.furniture-nCell.furniture
            daily_necessities=daily_necessities+c.daily-nCell.daily
            if food>=0 and frozen_food>=0 and office_supplies>=0 and furniture>=0 and daily_necessities>=0:
                nextCellDict[c.x,c.y,c.z] = nCell
        elif next == 'education':
            nCell = Cell_education(c.x,c.y,c.z)
            food=food+c.food-nCell.food
            frozen_food=frozen_food+c.ffood-nCell.ffood
            office_supplies=office_supplies+c.office_supplies-nCell.office_supplies
            furniture=furniture+c.furniture-nCell.furniture
            daily_necessities=daily_necessities+c.daily-nCell.daily
            if food>=0 and frozen_food>=0 and office_supplies>=0 and furniture>=0 and daily_necessities>=0:
                nextCellDict[c.x,c.y,c.z] = nCell
        elif next == 'void':
            nCell = Cell_void(c.x,c.y,c.z)
            nextCellDict[c.x,c.y,c.z] = nCell
            food=food+c.food
            frozen_food=frozen_food+c.ffood
            office_supplies=office_supplies+c.office_supplies
            furniture=furniture+c.furniture
            daily_necessities=daily_necessities+c.daily
        else:
            c.neighbours = []
            nextCellDict[c.x,c.y,c.z] = c

    for i in nextCellDict:
        c = nextCellDict[i]
        neigourCoords = c.getNeighbourCoordinates()
        for n in neigourCoords:
            if nextCellDict.__contains__((n[0],n[1],n[2]))==True:
                c.neighbours.append(nextCellDict[n[0],n[1],n[2]])

    dict = nextCellDict
    return dict,food,frozen_food,office_supplies,furniture,daily_necessities

officelist=[]
restaurantlist=[]
marketlist=[]
residencelist=[]
educationlist=[]
voidlist=[]

for g in range(int(generation)):
    officelist=[]
    restaurantlist=[]
    marketlist=[]
    residencelist=[]
    educationlist=[]
    voidlist=[]
    for i in celldict:
        c=celldict[i]
        if c.type=='office':
            officelist.append([c.x,c.y,c.z])
        elif c.type=='restaurant':
            restaurantlist.append([c.x,c.y,c.z])
        elif c.type=='market':
            marketlist.append([c.x,c.y,c.z])
        elif c.type=='residence':
            residencelist.append([c.x,c.y,c.z])
        elif c.type=='education':
            educationlist.append([c.x,c.y,c.z])
        elif c.type=='void':
            voidlist.append([c.x,c.y,c.z])
    celldict,cfood,cffood,coffice,cfurniture,cdaily=evaluate(celldict)

officepoints=[]
restaurantpoints=[]
marketpoints=[]
residencepoints=[]
educationpoints=[]
voidpoints=[]
for p in officelist:
    point3d=rg.Point3d(int(p[0]),int(p[1]),int(p[2]))
    officepoints.append(point3d)
for p in restaurantlist:
    point3d=rg.Point3d(int(p[0]),int(p[1]),int(p[2]))
    restaurantpoints.append(point3d)
for p in marketlist:
    point3d=rg.Point3d(int(p[0]),int(p[1]),int(p[2]))
    marketpoints.append(point3d)
for p in residencelist:
    point3d=rg.Point3d(int(p[0]),int(p[1]),int(p[2]))
    residencepoints.append(point3d)
for p in educationlist:
    point3d=rg.Point3d(int(p[0]),int(p[1]),int(p[2]))
    educationpoints.append(point3d)
for p in voidlist:
    point3d=rg.Point3d(int(p[0]),int(p[1]),int(p[2]))
    voidpoints.append(point3d)
# ---------- end ghpython_script_17 ----------
ghpython_script_18 = GhPythonScript(
    office=list_length_41,
    restaurant=list_length_42,
    market=list_length_43,
    residence=list_length_45,
    education=list_length_44)  # -> out, food, ffood, officesp, furniture, daily; same code as ghpython_script_3
ghpython_script_19 = GhPythonScript(
    office=list_length_46,
    restaurant=list_length_47,
    market=list_length_48,
    residence=list_length_51,
    education=list_length_49)  # -> out, food, ffood, officesp, furniture, daily; same code as ghpython_script_3
ghpython_script_20 = GhPythonScript(
    office=list_length_50,
    restaurant=list_length_52,
    market=list_length_53,
    residence=list_length_55,
    education=list_length_54)  # -> out, food, ffood, officesp, furniture, daily; same code as ghpython_script_3
ghpython_script_21 = GhPythonScript(
    X=deconstruct_70.XComponent,
    Y=deconstruct_70.YComponent,
    Z=deconstruct_70.ZComponent,
    officeX=deconstruct_41.XComponent,
    officeY=deconstruct_41.YComponent,
    officeZ=deconstruct_41.ZComponent,
    restaurantX=deconstruct_42.XComponent,
    restaurantY=deconstruct_42.YComponent,
    restaurantZ=deconstruct_42.ZComponent,
    commerceX=deconstruct_43.XComponent,
    commerceY=deconstruct_43.YComponent,
    commerceZ=deconstruct_43.ZComponent,
    residenceX=deconstruct_45.XComponent,
    residenceY=deconstruct_45.YComponent,
    residenceZ=deconstruct_45.ZComponent,
    generation=number_slider,
    Food=ghpython_script_16.food,
    Frozen_food=ghpython_script_16.ffood,
    Office_supplies=ghpython_script_16.officesp,
    Furniture=ghpython_script_16.furniture,
    Daily_necessities=ghpython_script_16.daily)  # -> out, officepoints, restaurantpoints, marketpoints, residencepoints, educationpoints, voidpoints; inputs X: list, Y: list, Z: list, officeX: list, officeY: list, officeZ: list, restaurantX: list, restaurantY: list, restaurantZ: list, commerceX: list, commerceY: list, commerceZ: list, residenceX: list, residenceY: list, residenceZ: list, educationX: list, educationY: list, educationZ: list
# ---------- ghpython_script_21: Python ----------
__author__ = "laoma"
__version__ = "2022.03.12"

import rhinoscriptsyntax as rs
import random
from ghpythonlib.componentbase import executingcomponent as component
import Grasshopper, GhPython
import Rhino.Geometry as rg


class Cell:
  def __init__(self, x, y, z):
    self.x = x
    self.y = y
    self.z = z
    self.type = None

class Cell_void(Cell):
    def __init__(self, x, y, z):
        self.x = x
        self.y = y
        self.z = z
        self.type = 'void'
        self.neighbours = []
        self.food=0
        self.ffood=0
        self.office_supplies=0
        self.furniture=0
        self.daily=0

    def behaviour(self):
        market = 0
        for n in self.neighbours:
            if n.type == 'market':
                market += 1
        if market>=18:
            return 'market'
        else:
            return 'void'


    def getNeighbourCoordinates(self):
        neighbours = []
        list1=[-10,0,10]
        list2=[-4,0,4]
        for i in list1:
            for j in list1:
                for k in list2:
                    neighbours.append([self.x+i, self.y+j, self.z+k])
        neighbours.remove([self.x,self.y,self.z])
        return neighbours

class Cell_office(Cell):
    def __init__(self, x, y, z):
        self.x = x
        self.y = y
        self.z = z
        self.type = 'office'
        self.neighbours = []
        self.food=0.0013*20
        self.ffood=0.001*20
        self.office_supplies=0.0063*20
        self.furniture=0.746*20
        self.daily=0.017*20

    def behaviour(self):
        nrlive = 0
        resi=0
        for n in self.neighbours:
            if n.type == 'office':
                nrlive += 1
            if n.type =='residence':
                resi+=1
        if nrlive<=7:
            return 'office'
        elif 10<=nrlive<=12:
            return 'residence'
        elif nrlive>=20:
            return 'void'
        else:
            return 'office'


    def getNeighbourCoordinates(self):
        neighbours = []
        list1=[-10,0,10]
        list2=[-4,0,4]
        for i in list1:
            for j in list1:
                for k in list2:
                    neighbours.append([self.x+i, self.y+j, self.z+k])
        neighbours.remove([self.x,self.y,self.z])
        return neighbours

class Cell_restaurant(Cell):
    def __init__(self, x, y, z):
        self.x = x
        self.y = y
        self.z = z
        self.type = 'restaurant'
        self.neighbours = []
        self.food=0.15*15
        self.ffood=0.09*15
        self.office_supplies=0.0008*15
        self.furniture=0.375*15
        self.daily=0.005*15

    def behaviour(self):
        nrlive = 0
        for n in self.neighbours:
            if n.type == 'restaurant':
                nrlive += 1
        if nrlive <=3:
            return 'market'


        elif nrlive>=18:
            return 'void'
        else:
            return 'restaurant'

    def getNeighbourCoordinates(self):
        neighbours = []
        list1=[-10,0,10]
        list2=[-4,0,4]
        for i in list1:
            for j in list1:
                for k in list2:
                    neighbours.append([self.x+i, self.y+j, self.z+k])
        neighbours.remove([self.x,self.y,self.z])
        return neighbours

class Cell_market(Cell):
    def __init__(self, x, y, z):
        self.x = x
        self.y = y
        self.z = z
        self.type = 'market'
        self.neighbours = []
        self.food=0.0008*20
        self.ffood=0.0006*20
        self.office_supplies=0.0017*20
        self.furniture=0.221*20
        self.daily=0.55*20

    def behaviour(self):
        nrlive = 0
        for n in self.neighbours:
            if n.type == 'market':
                nrlive += 1
        if nrlive <=7:
            return 'market'
        elif 10<=nrlive<=12:
            return 'restaurant'
        elif nrlive>=18:
            return 'void'
        else:
            return 'market'

    def getNeighbourCoordinates(self):
        neighbours = []
        list1=[-10,0,10]
        list2=[-4,0,4]
        for i in list1:
            for j in list1:
                for k in list2:
                    neighbours.append([self.x+i, self.y+j, self.z+k])
        neighbours.remove([self.x,self.y,self.z])
        return neighbours

class Cell_residence(Cell):
    def __init__(self, x, y, z):
        self.x = x
        self.y = y
        self.z = z
        self.type = 'residence'
        self.neighbours = []
        self.food=0.005*8
        self.ffood=0.003*8
        self.office_supplies=0.0003*8
        self.furniture=1.113*8
        self.daily=0.021*8

    def behaviour(self):
        nrlive = 0
        for n in self.neighbours:
            if n.type == 'residence':
                nrlive += 1
        if nrlive <=3:
            return 'office'
        elif nrlive>=18:
            return 'void'

        else:
            return 'residence'

    def getNeighbourCoordinates(self):
        neighbours = []
        list1=[-10,0,10]
        list2=[-4,0,4]
        for i in list1:
            for j in list1:
                for k in list2:
                    neighbours.append([self.x+i, self.y+j, self.z+k])
        neighbours.remove([self.x,self.y,self.z])
        return neighbours

class Cell_education(Cell):
    def __init__(self, x, y, z):
        self.x = x
        self.y = y
        self.z = z
        self.type = 'education'
        self.neighbours = []
        self.food=0.0018*50
        self.ffood=0.001*50
        self.office_supplies=0.009*50
        self.furniture=0.294*50
        self.daily=0.007*50

    def behaviour(self):
        nrlive = 0
        for n in self.neighbours:
            if n.type == 'residence':
                nrlive += 1
        if nrlive <=3:
            return 'residence'
        elif 11<=nrlive<=13:
            return 'residence'
        elif nrlive>=20:
            return 'void'
        else:
            return 'education'

    def getNeighbourCoordinates(self):
        neighbours = []
        list1=[-10,0,10]
        list2=[-4,0,4]
        for i in list1:
            for j in list1:
                for k in list2:
                    neighbours.append([self.x+i, self.y+j, self.z+k])
        neighbours.remove([self.x,self.y,self.z])
        return neighbours

class Cell_space(Cell):
    def __init__(self, x, y, z):
        self.x = x
        self.y = y
        self.z = z
        self.type = 'space'
        self.neighbours = []
        self.food=0
        self.ffood=0
        self.office_supplies=0
        self.furniture=0
        self.daily=0

    def behaviour(self):
        office = 0
        residence=0
        restaurant=0
        market=0
        education=0
        space=0
        for n in self.neighbours:
            if n.type == 'office':
                office += 1
            elif n.type == 'residence':
                residence += 1
            elif n.type == 'restaurant':
                restaurant += 1
            elif n.type == 'market':
                market += 1
            elif n.type == 'education':
                education += 1
            elif n.type == 'space':
                space += 1
        if market>=9:
            return 'market'


    def getNeighbourCoordinates(self):
        neighbours = []
        list1=[-10,0,10]
        list2=[-4,0,4]
        for i in list1:
            for j in list1:
                for k in list2:
                    neighbours.append([self.x+i, self.y+j, self.z+k])
        neighbours.remove([self.x,self.y,self.z])
        return neighbours

envcell=[]
for k in range(51):
    for i,j in zip(X,Y):
        if int(i)%5!=0:
            i=i+1
        if int(j)%5!=0:
            j=j+1
        envcell.append((int(i),int(j),int(k)*4+2))
spacecell=envcell[:]

celldict={}
if officeX != None:
    for i,j,k in zip(officeX,officeY,officeZ):
        if int(i)%5!=0:
            i=i+1
        if int(j)%5!=0:
            j=j+1
        c=Cell_office(int(i),int(j),int(k))
        celldict[int(i),int(j),int(k)]=c
        if spacecell.__contains__((int(i),int(j),int(k)))==True:
            spacecell.remove((int(i),int(j),int(k)))
if restaurantX != None:
    for i,j,k in zip(restaurantX,restaurantY,restaurantZ):
        if int(i)%5!=0:
            i=i+1
        if int(j)%5!=0:
            j=j+1
        c=Cell_restaurant(int(i),int(j),int(k))
        celldict[int(i),int(j),int(k)]=c
        if spacecell.__contains__((int(i),int(j),int(k)))==True:
            spacecell.remove((int(i),int(j),int(k)))
if commerceX != None:
    for i,j,k in zip(commerceX,commerceY,commerceZ):
        if int(i)%5!=0:
            i=i+1
        if int(j)%5!=0:
            j=j+1
        c=Cell_market(int(i),int(j),int(k))
        celldict[int(i),int(j),int(k)]=c
        if spacecell.__contains__((int(i),int(j),int(k)))==True:
            spacecell.remove((int(i),int(j),int(k)))
if residenceX != None:
    for i,j,k in zip(residenceX,residenceY,residenceZ):
        if int(i)%5!=0:
            i=i+1
        if int(j)%5!=0:
            j=j+1
        c=Cell_residence(int(i),int(j),int(k))
        celldict[int(i),int(j),int(k)]=c
        if spacecell.__contains__((int(i),int(j),int(k)))==True:
            spacecell.remove((int(i),int(j),int(k)))
if educationX != None:
    for i,j,k in zip(educationX,educationY,educationZ):
        if int(i)%5!=0:
            i=i+1
        if int(j)%5!=0:
            j=j+1
        c=Cell_education(int(i),int(j),int(k))
        celldict[int(i),int(j),int(k)]=c
        if spacecell.__contains__((int(i),int(j),int(k)))==True:
            spacecell.remove((int(i),int(j),int(k)))
for v in spacecell:
    c=Cell_space(v[0],v[1],v[2])
    celldict[v[0],v[1],v[2]]=c

for i in celldict:
    c=celldict[i]
    neigourCoords = c.getNeighbourCoordinates()
    for n in neigourCoords:
       if celldict.__contains__((n[0],n[1],n[2]))==True:
           c.neighbours.append(celldict[n[0],n[1],n[2]])


def evaluate(dict):
    food=Food
    frozen_food=Frozen_food
    office_supplies=Office_supplies
    furniture=Furniture
    daily_necessities=Daily_necessities
    nextCellDict={}
    for i in dict:
        c = dict[i]
        next = c.behaviour()
        if next == 'office':
            nCell = Cell_office(c.x,c.y,c.z)
            food=food+c.food-nCell.food
            frozen_food=frozen_food+c.ffood-nCell.ffood
            office_supplies=office_supplies+c.office_supplies-nCell.office_supplies
            furniture=furniture+c.furniture-nCell.furniture
            daily_necessities=daily_necessities+c.daily-nCell.daily
            if food>=0 and frozen_food>=0 and office_supplies>=0 and furniture>=0 and daily_necessities>=0:
                nextCellDict[c.x,c.y,c.z] = nCell
        elif next == 'restaurant':
            nCell = Cell_restaurant(c.x,c.y,c.z)
            food=food+c.food-nCell.food
            frozen_food=frozen_food+c.ffood-nCell.ffood
            office_supplies=office_supplies+c.office_supplies-nCell.office_supplies
            furniture=furniture+c.furniture-nCell.furniture
            daily_necessities=daily_necessities+c.daily-nCell.daily
            if food>=0 and frozen_food>=0 and office_supplies>=0 and furniture>=0 and daily_necessities>=0:
                nextCellDict[c.x,c.y,c.z] = nCell
        elif next == 'market':
            nCell = Cell_market(c.x,c.y,c.z)
            food=food+c.food-nCell.food
            frozen_food=frozen_food+c.ffood-nCell.ffood
            office_supplies=office_supplies+c.office_supplies-nCell.office_supplies
            furniture=furniture+c.furniture-nCell.furniture
            daily_necessities=daily_necessities+c.daily-nCell.daily
            if food>=0 and frozen_food>=0 and office_supplies>=0 and furniture>=0 and daily_necessities>=0:
                nextCellDict[c.x,c.y,c.z] = nCell
        elif next == 'residence':
            nCell = Cell_residence(c.x,c.y,c.z)
            food=food+c.food-nCell.food
            frozen_food=frozen_food+c.ffood-nCell.ffood
            office_supplies=office_supplies+c.office_supplies-nCell.office_supplies
            furniture=furniture+c.furniture-nCell.furniture
            daily_necessities=daily_necessities+c.daily-nCell.daily
            if food>=0 and frozen_food>=0 and office_supplies>=0 and furniture>=0 and daily_necessities>=0:
                nextCellDict[c.x,c.y,c.z] = nCell
        elif next == 'education':
            nCell = Cell_education(c.x,c.y,c.z)
            food=food+c.food-nCell.food
            frozen_food=frozen_food+c.ffood-nCell.ffood
            office_supplies=office_supplies+c.office_supplies-nCell.office_supplies
            furniture=furniture+c.furniture-nCell.furniture
            daily_necessities=daily_necessities+c.daily-nCell.daily
            if food>=0 and frozen_food>=0 and office_supplies>=0 and furniture>=0 and daily_necessities>=0:
                nextCellDict[c.x,c.y,c.z] = nCell
        elif next == 'void':
            nCell = Cell_void(c.x,c.y,c.z)
            nextCellDict[c.x,c.y,c.z] = nCell
            food=food+c.food
            frozen_food=frozen_food+c.ffood
            office_supplies=office_supplies+c.office_supplies
            furniture=furniture+c.furniture
            daily_necessities=daily_necessities+c.daily
        else:
            c.neighbours = []
            nextCellDict[c.x,c.y,c.z] = c

    for i in nextCellDict:
        c = nextCellDict[i]
        neigourCoords = c.getNeighbourCoordinates()
        for n in neigourCoords:
            if nextCellDict.__contains__((n[0],n[1],n[2]))==True:
                c.neighbours.append(nextCellDict[n[0],n[1],n[2]])

    dict = nextCellDict
    return dict,food,frozen_food,office_supplies,furniture,daily_necessities

officelist=[]
restaurantlist=[]
marketlist=[]
residencelist=[]
educationlist=[]
voidlist=[]

for g in range(int(generation)):
    officelist=[]
    restaurantlist=[]
    marketlist=[]
    residencelist=[]
    educationlist=[]
    voidlist=[]
    for i in celldict:
        c=celldict[i]
        if c.type=='office':
            officelist.append([c.x,c.y,c.z])
        elif c.type=='restaurant':
            restaurantlist.append([c.x,c.y,c.z])
        elif c.type=='market':
            marketlist.append([c.x,c.y,c.z])
        elif c.type=='residence':
            residencelist.append([c.x,c.y,c.z])
        elif c.type=='education':
            educationlist.append([c.x,c.y,c.z])
        elif c.type=='void':
            voidlist.append([c.x,c.y,c.z])
    celldict,cfood,cffood,coffice,cfurniture,cdaily=evaluate(celldict)

officepoints=[]
restaurantpoints=[]
marketpoints=[]
residencepoints=[]
educationpoints=[]
voidpoints=[]
for p in officelist:
    point3d=rg.Point3d(int(p[0]),int(p[1]),int(p[2]))
    officepoints.append(point3d)
for p in restaurantlist:
    point3d=rg.Point3d(int(p[0]),int(p[1]),int(p[2]))
    restaurantpoints.append(point3d)
for p in marketlist:
    point3d=rg.Point3d(int(p[0]),int(p[1]),int(p[2]))
    marketpoints.append(point3d)
for p in residencelist:
    point3d=rg.Point3d(int(p[0]),int(p[1]),int(p[2]))
    residencepoints.append(point3d)
for p in educationlist:
    point3d=rg.Point3d(int(p[0]),int(p[1]),int(p[2]))
    educationpoints.append(point3d)
for p in voidlist:
    point3d=rg.Point3d(int(p[0]),int(p[1]),int(p[2]))
    voidpoints.append(point3d)
# ---------- end ghpython_script_21 ----------
deconstruct_85 = Deconstruct(Point=point_85)  # -> XComponent, YComponent, ZComponent
ghpython_script_22 = GhPythonScript(
    X=deconstruct_71.XComponent,
    Y=deconstruct_71.YComponent,
    Z=deconstruct_71.ZComponent,
    officeX=deconstruct_49.XComponent,
    officeY=deconstruct_49.YComponent,
    officeZ=deconstruct_49.ZComponent,
    restaurantX=deconstruct_50.XComponent,
    restaurantY=deconstruct_50.YComponent,
    restaurantZ=deconstruct_50.ZComponent,
    commerceX=deconstruct_51.XComponent,
    commerceY=deconstruct_51.YComponent,
    commerceZ=deconstruct_51.ZComponent,
    residenceX=deconstruct_53.XComponent,
    residenceY=deconstruct_53.YComponent,
    residenceZ=deconstruct_53.ZComponent,
    generation=number_slider,
    Food=ghpython_script_18.food,
    Frozen_food=ghpython_script_18.ffood,
    Office_supplies=ghpython_script_18.officesp,
    Furniture=ghpython_script_18.furniture,
    Daily_necessities=ghpython_script_18.daily)  # -> out, officepoints, restaurantpoints, marketpoints, residencepoints, educationpoints, voidpoints; inputs X: list, Y: list, Z: list, officeX: list, officeY: list, officeZ: list, restaurantX: list, restaurantY: list, restaurantZ: list, commerceX: list, commerceY: list, commerceZ: list, residenceX: list, residenceY: list, residenceZ: list, educationX: list, educationY: list, educationZ: list; same code as ghpython_script_17
ghpython_script_23 = GhPythonScript(
    X=deconstruct_72.XComponent,
    Y=deconstruct_72.YComponent,
    Z=deconstruct_72.ZComponent,
    officeX=deconstruct_54.XComponent,
    officeY=deconstruct_54.YComponent,
    officeZ=deconstruct_54.ZComponent,
    restaurantX=deconstruct_55.XComponent,
    restaurantY=deconstruct_55.YComponent,
    restaurantZ=deconstruct_55.ZComponent,
    commerceX=deconstruct_56.XComponent,
    commerceY=deconstruct_56.YComponent,
    commerceZ=deconstruct_56.ZComponent,
    residenceX=deconstruct_58.XComponent,
    residenceY=deconstruct_58.YComponent,
    residenceZ=deconstruct_58.ZComponent,
    generation=number_slider,
    Food=ghpython_script_19.food,
    Frozen_food=ghpython_script_19.ffood,
    Office_supplies=ghpython_script_19.officesp,
    Furniture=ghpython_script_19.furniture,
    Daily_necessities=ghpython_script_19.daily)  # -> out, officepoints, restaurantpoints, marketpoints, residencepoints, educationpoints, voidpoints; inputs X: list, Y: list, Z: list, officeX: list, officeY: list, officeZ: list, restaurantX: list, restaurantY: list, restaurantZ: list, commerceX: list, commerceY: list, commerceZ: list, residenceX: list, residenceY: list, residenceZ: list, educationX: list, educationY: list, educationZ: list; same code as ghpython_script_17
ghpython_script_24 = GhPythonScript(
    X=deconstruct_73.XComponent,
    Y=deconstruct_73.YComponent,
    Z=deconstruct_73.ZComponent,
    officeX=deconstruct_59.XComponent,
    officeY=deconstruct_59.YComponent,
    officeZ=deconstruct_59.ZComponent,
    restaurantX=deconstruct_60.XComponent,
    restaurantY=deconstruct_60.YComponent,
    restaurantZ=deconstruct_60.ZComponent,
    commerceX=deconstruct_61.XComponent,
    commerceY=deconstruct_61.YComponent,
    commerceZ=deconstruct_61.ZComponent,
    residenceX=deconstruct_63.XComponent,
    residenceY=deconstruct_63.YComponent,
    residenceZ=deconstruct_63.ZComponent,
    generation=number_slider,
    Food=ghpython_script_20.food,
    Frozen_food=ghpython_script_20.ffood,
    Office_supplies=ghpython_script_20.officesp,
    Furniture=ghpython_script_20.furniture,
    Daily_necessities=ghpython_script_20.daily)  # -> out, officepoints, restaurantpoints, marketpoints, residencepoints, educationpoints, voidpoints; inputs X: list, Y: list, Z: list, officeX: list, officeY: list, officeZ: list, restaurantX: list, restaurantY: list, restaurantZ: list, commerceX: list, commerceY: list, commerceZ: list, residenceX: list, residenceY: list, residenceZ: list, educationX: list, educationY: list, educationZ: list
# ---------- ghpython_script_24: Python ----------
__author__ = "laoma"
__version__ = "2022.03.12"

import rhinoscriptsyntax as rs
import random
from ghpythonlib.componentbase import executingcomponent as component
import Grasshopper, GhPython
import Rhino.Geometry as rg


class Cell:
  def __init__(self, x, y, z):
    self.x = x
    self.y = y
    self.z = z
    self.type = None

class Cell_void(Cell):
    def __init__(self, x, y, z):
        self.x = x
        self.y = y
        self.z = z
        self.type = 'void'
        self.neighbours = []
        self.food=0
        self.ffood=0
        self.office_supplies=0
        self.furniture=0
        self.daily=0

    def behaviour(self):
        office= 0
        residence=0
        for n in self.neighbours:
            if n.type == 'office':
                office += 1
        if office>=12:
            return 'office'

        else:
            return 'void'


    def getNeighbourCoordinates(self):
        neighbours = []
        list1=[-10,0,10]
        list2=[-4,0,4]
        for i in list1:
            for j in list1:
                for k in list2:
                    neighbours.append([self.x+i, self.y+j, self.z+k])
        neighbours.remove([self.x,self.y,self.z])
        return neighbours

class Cell_office(Cell):
    def __init__(self, x, y, z):
        self.x = x
        self.y = y
        self.z = z
        self.type = 'office'
        self.neighbours = []
        self.food=0.0013*20
        self.ffood=0.001*20
        self.office_supplies=0.0063*20
        self.furniture=0.746*20
        self.daily=0.017*20

    def behaviour(self):
        nrlive = 0
        resi=0
        for n in self.neighbours:
            if n.type == 'office':
                nrlive += 1
            if n.type =='residence':
                resi+=1
        if nrlive<=7:
            return 'office'
        elif 10<=nrlive<=12:
            return 'residence'
        elif nrlive>=20:
            return 'void'
        else:
            return 'office'


    def getNeighbourCoordinates(self):
        neighbours = []
        list1=[-10,0,10]
        list2=[-4,0,4]
        for i in list1:
            for j in list1:
                for k in list2:
                    neighbours.append([self.x+i, self.y+j, self.z+k])
        neighbours.remove([self.x,self.y,self.z])
        return neighbours

class Cell_restaurant(Cell):
    def __init__(self, x, y, z):
        self.x = x
        self.y = y
        self.z = z
        self.type = 'restaurant'
        self.neighbours = []
        self.food=0.15*15
        self.ffood=0.09*15
        self.office_supplies=0.0008*15
        self.furniture=0.375*15
        self.daily=0.005*15

    def behaviour(self):
        nrlive = 0
        for n in self.neighbours:
            if n.type == 'restaurant':
                nrlive += 1
        if nrlive <=3:
            return 'market'
        elif 11<=nrlive<=17:
            return 'market'

        elif nrlive>=22:
            return 'void'
        else:
            return 'restaurant'

    def getNeighbourCoordinates(self):
        neighbours = []
        list1=[-10,0,10]
        list2=[-4,0,4]
        for i in list1:
            for j in list1:
                for k in list2:
                    neighbours.append([self.x+i, self.y+j, self.z+k])
        neighbours.remove([self.x,self.y,self.z])
        return neighbours

class Cell_market(Cell):
    def __init__(self, x, y, z):
        self.x = x
        self.y = y
        self.z = z
        self.type = 'market'
        self.neighbours = []
        self.food=0.0008*20
        self.ffood=0.0006*20
        self.office_supplies=0.0017*20
        self.furniture=0.221*20
        self.daily=0.55*20

    def behaviour(self):
        nrlive = 0
        for n in self.neighbours:
            if n.type == 'market':
                nrlive += 1
        if nrlive <=3:
            return 'residence'
        elif 8<=nrlive<=17:
            return 'restaurant'
        elif nrlive>=18:
            return 'void'

        else:
            return 'market'

    def getNeighbourCoordinates(self):
        neighbours = []
        list1=[-10,0,10]
        list2=[-4,0,4]
        for i in list1:
            for j in list1:
                for k in list2:
                    neighbours.append([self.x+i, self.y+j, self.z+k])
        neighbours.remove([self.x,self.y,self.z])
        return neighbours

class Cell_residence(Cell):
    def __init__(self, x, y, z):
        self.x = x
        self.y = y
        self.z = z
        self.type = 'residence'
        self.neighbours = []
        self.food=0.005*8
        self.ffood=0.003*8
        self.office_supplies=0.0003*8
        self.furniture=1.113*8
        self.daily=0.021*8

    def behaviour(self):
        nrlive = 0
        for n in self.neighbours:
            if n.type == 'residence':
                nrlive += 1
        if nrlive <=3:
            return 'office'
        elif 11<=nrlive<=13:
            return 'market'
        elif nrlive>=20:
            return 'void'
        else:
            return 'residence'

    def getNeighbourCoordinates(self):
        neighbours = []
        list1=[-10,0,10]
        list2=[-4,0,4]
        for i in list1:
            for j in list1:
                for k in list2:
                    neighbours.append([self.x+i, self.y+j, self.z+k])
        neighbours.remove([self.x,self.y,self.z])
        return neighbours

class Cell_education(Cell):
    def __init__(self, x, y, z):
        self.x = x
        self.y = y
        self.z = z
        self.type = 'education'
        self.neighbours = []
        self.food=0.0018*50
        self.ffood=0.001*50
        self.office_supplies=0.009*50
        self.furniture=0.294*50
        self.daily=0.007*50

    def behaviour(self):
        nrlive = 0
        for n in self.neighbours:
            if n.type == 'residence':
                nrlive += 1
        if nrlive <=3:
            return 'residence'
        elif 11<=nrlive<=13:
            return 'residence'
        elif nrlive>=20:
            return 'void'
        else:
            return 'education'

    def getNeighbourCoordinates(self):
        neighbours = []
        list1=[-10,0,10]
        list2=[-4,0,4]
        for i in list1:
            for j in list1:
                for k in list2:
                    neighbours.append([self.x+i, self.y+j, self.z+k])
        neighbours.remove([self.x,self.y,self.z])
        return neighbours

class Cell_space(Cell):
    def __init__(self, x, y, z):
        self.x = x
        self.y = y
        self.z = z
        self.type = 'space'
        self.neighbours = []
        self.food=0
        self.ffood=0
        self.office_supplies=0
        self.furniture=0
        self.daily=0

    def behaviour(self):
        office = 0
        residence=0
        restaurant=0
        market=0
        education=0
        space=0
        for n in self.neighbours:
            if n.type == 'office':
                office += 1
            elif n.type == 'residence':
                residence += 1
            elif n.type == 'restaurant':
                restaurant += 1
            elif n.type == 'market':
                market += 1
            elif n.type == 'education':
                education += 1
            elif n.type == 'space':
                space += 1




    def getNeighbourCoordinates(self):
        neighbours = []
        list1=[-10,0,10]
        list2=[-4,0,4]
        for i in list1:
            for j in list1:
                for k in list2:
                    neighbours.append([self.x+i, self.y+j, self.z+k])
        neighbours.remove([self.x,self.y,self.z])
        return neighbours

envcell=[]
for k in range(51):
    for i,j in zip(X,Y):
        if int(i)%5!=0:
            i=i+1
        if int(j)%5!=0:
            j=j+1
        envcell.append((int(i),int(j),int(k)*4+2))
spacecell=envcell[:]

celldict={}
if officeX != None:
    for i,j,k in zip(officeX,officeY,officeZ):
        if int(i)%5!=0:
            i=i+1
        if int(j)%5!=0:
            j=j+1
        c=Cell_office(int(i),int(j),int(k))
        celldict[int(i),int(j),int(k)]=c
        if spacecell.__contains__((int(i),int(j),int(k)))==True:
            spacecell.remove((int(i),int(j),int(k)))
if restaurantX != None:
    for i,j,k in zip(restaurantX,restaurantY,restaurantZ):
        if int(i)%5!=0:
            i=i+1
        if int(j)%5!=0:
            j=j+1
        c=Cell_restaurant(int(i),int(j),int(k))
        celldict[int(i),int(j),int(k)]=c
        if spacecell.__contains__((int(i),int(j),int(k)))==True:
            spacecell.remove((int(i),int(j),int(k)))
if commerceX != None:
    for i,j,k in zip(commerceX,commerceY,commerceZ):
        if int(i)%5!=0:
            i=i+1
        if int(j)%5!=0:
            j=j+1
        c=Cell_market(int(i),int(j),int(k))
        celldict[int(i),int(j),int(k)]=c
        if spacecell.__contains__((int(i),int(j),int(k)))==True:
            spacecell.remove((int(i),int(j),int(k)))
if residenceX != None:
    for i,j,k in zip(residenceX,residenceY,residenceZ):
        if int(i)%5!=0:
            i=i+1
        if int(j)%5!=0:
            j=j+1
        c=Cell_residence(int(i),int(j),int(k))
        celldict[int(i),int(j),int(k)]=c
        if spacecell.__contains__((int(i),int(j),int(k)))==True:
            spacecell.remove((int(i),int(j),int(k)))
if educationX != None:
    for i,j,k in zip(educationX,educationY,educationZ):
        if int(i)%5!=0:
            i=i+1
        if int(j)%5!=0:
            j=j+1
        c=Cell_education(int(i),int(j),int(k))
        celldict[int(i),int(j),int(k)]=c
        if spacecell.__contains__((int(i),int(j),int(k)))==True:
            spacecell.remove((int(i),int(j),int(k)))
for v in spacecell:
    c=Cell_space(v[0],v[1],v[2])
    celldict[v[0],v[1],v[2]]=c

for i in celldict:
    c=celldict[i]
    neigourCoords = c.getNeighbourCoordinates()
    for n in neigourCoords:
       if celldict.__contains__((n[0],n[1],n[2]))==True:
           c.neighbours.append(celldict[n[0],n[1],n[2]])


def evaluate(dict):
    food=Food
    frozen_food=Frozen_food
    office_supplies=Office_supplies
    furniture=Furniture
    daily_necessities=Daily_necessities
    nextCellDict={}
    for i in dict:
        c = dict[i]
        next = c.behaviour()
        if next == 'office':
            nCell = Cell_office(c.x,c.y,c.z)
            food=food+c.food-nCell.food
            frozen_food=frozen_food+c.ffood-nCell.ffood
            office_supplies=office_supplies+c.office_supplies-nCell.office_supplies
            furniture=furniture+c.furniture-nCell.furniture
            daily_necessities=daily_necessities+c.daily-nCell.daily
            if food>=0 and frozen_food>=0 and office_supplies>=0 and furniture>=0 and daily_necessities>=0:
                nextCellDict[c.x,c.y,c.z] = nCell
        elif next == 'restaurant':
            nCell = Cell_restaurant(c.x,c.y,c.z)
            food=food+c.food-nCell.food
            frozen_food=frozen_food+c.ffood-nCell.ffood
            office_supplies=office_supplies+c.office_supplies-nCell.office_supplies
            furniture=furniture+c.furniture-nCell.furniture
            daily_necessities=daily_necessities+c.daily-nCell.daily
            if food>=0 and frozen_food>=0 and office_supplies>=0 and furniture>=0 and daily_necessities>=0:
                nextCellDict[c.x,c.y,c.z] = nCell
        elif next == 'market':
            nCell = Cell_market(c.x,c.y,c.z)
            food=food+c.food-nCell.food
            frozen_food=frozen_food+c.ffood-nCell.ffood
            office_supplies=office_supplies+c.office_supplies-nCell.office_supplies
            furniture=furniture+c.furniture-nCell.furniture
            daily_necessities=daily_necessities+c.daily-nCell.daily
            if food>=0 and frozen_food>=0 and office_supplies>=0 and furniture>=0 and daily_necessities>=0:
                nextCellDict[c.x,c.y,c.z] = nCell
        elif next == 'residence':
            nCell = Cell_residence(c.x,c.y,c.z)
            food=food+c.food-nCell.food
            frozen_food=frozen_food+c.ffood-nCell.ffood
            office_supplies=office_supplies+c.office_supplies-nCell.office_supplies
            furniture=furniture+c.furniture-nCell.furniture
            daily_necessities=daily_necessities+c.daily-nCell.daily
            if food>=0 and frozen_food>=0 and office_supplies>=0 and furniture>=0 and daily_necessities>=0:
                nextCellDict[c.x,c.y,c.z] = nCell
        elif next == 'education':
            nCell = Cell_education(c.x,c.y,c.z)
            food=food+c.food-nCell.food
            frozen_food=frozen_food+c.ffood-nCell.ffood
            office_supplies=office_supplies+c.office_supplies-nCell.office_supplies
            furniture=furniture+c.furniture-nCell.furniture
            daily_necessities=daily_necessities+c.daily-nCell.daily
            if food>=0 and frozen_food>=0 and office_supplies>=0 and furniture>=0 and daily_necessities>=0:
                nextCellDict[c.x,c.y,c.z] = nCell
        elif next == 'void':
            nCell = Cell_void(c.x,c.y,c.z)
            nextCellDict[c.x,c.y,c.z] = nCell
            food=food+c.food
            frozen_food=frozen_food+c.ffood
            office_supplies=office_supplies+c.office_supplies
            furniture=furniture+c.furniture
            daily_necessities=daily_necessities+c.daily
        else:
            c.neighbours = []
            nextCellDict[c.x,c.y,c.z] = c

    for i in nextCellDict:
        c = nextCellDict[i]
        neigourCoords = c.getNeighbourCoordinates()
        for n in neigourCoords:
            if nextCellDict.__contains__((n[0],n[1],n[2]))==True:
                c.neighbours.append(nextCellDict[n[0],n[1],n[2]])

    dict = nextCellDict
    return dict,food,frozen_food,office_supplies,furniture,daily_necessities

officelist=[]
restaurantlist=[]
marketlist=[]
residencelist=[]
educationlist=[]
voidlist=[]

for g in range(int(generation)):
    officelist=[]
    restaurantlist=[]
    marketlist=[]
    residencelist=[]
    educationlist=[]
    voidlist=[]
    for i in celldict:
        c=celldict[i]
        if c.type=='office':
            officelist.append([c.x,c.y,c.z])
        elif c.type=='restaurant':
            restaurantlist.append([c.x,c.y,c.z])
        elif c.type=='market':
            marketlist.append([c.x,c.y,c.z])
        elif c.type=='residence':
            residencelist.append([c.x,c.y,c.z])
        elif c.type=='education':
            educationlist.append([c.x,c.y,c.z])
        elif c.type=='void':
            voidlist.append([c.x,c.y,c.z])
    celldict,cfood,cffood,coffice,cfurniture,cdaily=evaluate(celldict)

officepoints=[]
restaurantpoints=[]
marketpoints=[]
residencepoints=[]
educationpoints=[]
voidpoints=[]
for p in officelist:
    point3d=rg.Point3d(int(p[0]),int(p[1]),int(p[2]))
    officepoints.append(point3d)
for p in restaurantlist:
    point3d=rg.Point3d(int(p[0]),int(p[1]),int(p[2]))
    restaurantpoints.append(point3d)
for p in marketlist:
    point3d=rg.Point3d(int(p[0]),int(p[1]),int(p[2]))
    marketpoints.append(point3d)
for p in residencelist:
    point3d=rg.Point3d(int(p[0]),int(p[1]),int(p[2]))
    residencepoints.append(point3d)
for p in educationlist:
    point3d=rg.Point3d(int(p[0]),int(p[1]),int(p[2]))
    educationpoints.append(point3d)
for p in voidlist:
    point3d=rg.Point3d(int(p[0]),int(p[1]),int(p[2]))
    voidpoints.append(point3d)
# ---------- end ghpython_script_24 ----------
ghpython_script_25 = GhPythonScript(office=list_length, restaurant=list_length_2, market=list_length_3, residence=list_length_5, education=list_length_4)  # -> out, o, rest, m, resi, edu
# ---------- ghpython_script_25: Python ----------
__author__ = "laoma"
__version__ = "2022.03.16"

import rhinoscriptsyntax as rs
if residence==None:
    residence=0
if education==None:
    education=0
sum=office+restaurant+market+residence+education
o=office/sum*100
rest=restaurant/sum*100
m=market/sum*100
resi=residence/sum*100
edu=education/sum*100
# ---------- end ghpython_script_25 ----------
ghpython_script_26 = GhPythonScript(office=list_length_6, restaurant=list_length_7, market=list_length_8, residence=list_length_10, education=list_length_9)  # -> out, o, rest, m, resi, edu; same code as ghpython_script_25
ghpython_script_27 = GhPythonScript(office=list_length_57, restaurant=list_length_58, market=list_length_56, residence=list_length_59)  # -> out, food, ffood, officesp, furniture, daily
# ---------- ghpython_script_27: Python ----------
__author__ = "laoma"
__version__ = "2022.03.16"

import rhinoscriptsyntax as rs
food=20*0.0013*office+(0.0008*20*market)+(0.15*15*restaurant)+(0.005*8*residence)
ffood=20*0.001*office+(0.0006*20*market)+(0.09*15*restaurant)+(0.003*8*residence)
officesp=20*0.0063*office+(0.0017*20*market)+(0.0008*15*restaurant)+(0.0003*8*residence)
furniture=20*0.746*office+(0.221*20*market)+(1.113*15*restaurant)+(1.113*8*residence)
daily=20*0.017*office+(0.55*20*market)+(0.005*15*restaurant)+(0.021*8*residence)
# ---------- end ghpython_script_27 ----------
ghpython_script_28 = GhPythonScript(
    X=deconstruct_69.XComponent,
    Y=deconstruct_69.YComponent,
    Z=deconstruct_69.ZComponent,
    officeX=deconstruct_36.XComponent,
    officeY=deconstruct_36.YComponent,
    officeZ=deconstruct_36.ZComponent,
    restaurantX=deconstruct_37.XComponent,
    restaurantY=deconstruct_37.YComponent,
    restaurantZ=deconstruct_37.ZComponent,
    commerceX=deconstruct_38.XComponent,
    commerceY=deconstruct_38.YComponent,
    commerceZ=deconstruct_38.ZComponent,
    residenceX=deconstruct_39.XComponent,
    residenceY=deconstruct_39.YComponent,
    residenceZ=deconstruct_39.ZComponent,
    generation=number_slider,
    Food=ghpython_script_27.food,
    Frozen_food=ghpython_script_27.ffood,
    Office_supplies=ghpython_script_27.officesp,
    Furniture=ghpython_script_27.furniture,
    Daily_necessities=ghpython_script_27.daily)  # -> out, officepoints, restaurantpoints, marketpoints, residencepoints, educationpoints, voidpoints; inputs X: list, Y: list, Z: list, officeX: list, officeY: list, officeZ: list, restaurantX: list, restaurantY: list, restaurantZ: list, commerceX: list, commerceY: list, commerceZ: list, residenceX: list, residenceY: list, residenceZ: list, educationX: list, educationY: list, educationZ: list
# ---------- ghpython_script_28: Python ----------
__author__ = "laoma"
__version__ = "2022.03.12"

import rhinoscriptsyntax as rs
import random
from ghpythonlib.componentbase import executingcomponent as component
import Grasshopper, GhPython
import Rhino.Geometry as rg


class Cell:
  def __init__(self, x, y, z):
    self.x = x
    self.y = y
    self.z = z
    self.type = None

class Cell_void(Cell):
    def __init__(self, x, y, z):
        self.x = x
        self.y = y
        self.z = z
        self.type = 'void'
        self.neighbours = []
        self.food=0
        self.ffood=0
        self.office_supplies=0
        self.furniture=0
        self.daily=0

    def behaviour(self):
        market = 0
        for n in self.neighbours:
            if n.type == 'market':
                market += 1
        if market>=15:
            return 'market'
        else:
            return 'void'


    def getNeighbourCoordinates(self):
        neighbours = []
        list1=[-10,0,10]
        list2=[-4,0,4]
        for i in list1:
            for j in list1:
                for k in list2:
                    neighbours.append([self.x+i, self.y+j, self.z+k])
        neighbours.remove([self.x,self.y,self.z])
        return neighbours

class Cell_office(Cell):
    def __init__(self, x, y, z):
        self.x = x
        self.y = y
        self.z = z
        self.type = 'office'
        self.neighbours = []
        self.food=0.0013*20
        self.ffood=0.001*20
        self.office_supplies=0.0063*20
        self.furniture=0.746*20
        self.daily=0.017*20

    def behaviour(self):
        nrlive = 0
        resi=0
        for n in self.neighbours:
            if n.type == 'office':
                nrlive += 1
            if n.type =='residence':
                resi+=1
        if nrlive<=7:
            return 'office'
        elif 10<=nrlive<=12:
            return 'residence'
        elif nrlive>=20:
            return 'void'
        else:
            return 'office'


    def getNeighbourCoordinates(self):
        neighbours = []
        list1=[-10,0,10]
        list2=[-4,0,4]
        for i in list1:
            for j in list1:
                for k in list2:
                    neighbours.append([self.x+i, self.y+j, self.z+k])
        neighbours.remove([self.x,self.y,self.z])
        return neighbours

class Cell_restaurant(Cell):
    def __init__(self, x, y, z):
        self.x = x
        self.y = y
        self.z = z
        self.type = 'restaurant'
        self.neighbours = []
        self.food=0.15*15
        self.ffood=0.09*15
        self.office_supplies=0.0008*15
        self.furniture=0.375*15
        self.daily=0.005*15

    def behaviour(self):
        nrlive = 0
        for n in self.neighbours:
            if n.type == 'restaurant':
                nrlive += 1
        if nrlive <=3:
            return 'market'


        elif 26>nrlive>=22:
            return 'void'
        else:
            return 'restaurant'

    def getNeighbourCoordinates(self):
        neighbours = []
        list1=[-10,0,10]
        list2=[-4,0,4]
        for i in list1:
            for j in list1:
                for k in list2:
                    neighbours.append([self.x+i, self.y+j, self.z+k])
        neighbours.remove([self.x,self.y,self.z])
        return neighbours

class Cell_market(Cell):
    def __init__(self, x, y, z):
        self.x = x
        self.y = y
        self.z = z
        self.type = 'market'
        self.neighbours = []
        self.food=0.0008*20
        self.ffood=0.0006*20
        self.office_supplies=0.0017*20
        self.furniture=0.221*20
        self.daily=0.55*20

    def behaviour(self):
        nrlive = 0
        for n in self.neighbours:
            if n.type == 'market':
                nrlive += 1
        if nrlive <=7:
            return 'market'
        elif 10<=nrlive<=12:
            return 'restaurant'
        elif 20<nrlive<24:
            return 'void'
        else:
            return 'market'

    def getNeighbourCoordinates(self):
        neighbours = []
        list1=[-10,0,10]
        list2=[-4,0,4]
        for i in list1:
            for j in list1:
                for k in list2:
                    neighbours.append([self.x+i, self.y+j, self.z+k])
        neighbours.remove([self.x,self.y,self.z])
        return neighbours

class Cell_residence(Cell):
    def __init__(self, x, y, z):
        self.x = x
        self.y = y
        self.z = z
        self.type = 'residence'
        self.neighbours = []
        self.food=0.005*8
        self.ffood=0.003*8
        self.office_supplies=0.0003*8
        self.furniture=1.113*8
        self.daily=0.021*8

    def behaviour(self):
        nrlive = 0
        for n in self.neighbours:
            if n.type == 'residence':
                nrlive += 1
        if nrlive <=3:
            return 'office'

        else:
            return 'residence'

    def getNeighbourCoordinates(self):
        neighbours = []
        list1=[-10,0,10]
        list2=[-4,0,4]
        for i in list1:
            for j in list1:
                for k in list2:
                    neighbours.append([self.x+i, self.y+j, self.z+k])
        neighbours.remove([self.x,self.y,self.z])
        return neighbours

class Cell_education(Cell):
    def __init__(self, x, y, z):
        self.x = x
        self.y = y
        self.z = z
        self.type = 'education'
        self.neighbours = []
        self.food=0.0018*50
        self.ffood=0.001*50
        self.office_supplies=0.009*50
        self.furniture=0.294*50
        self.daily=0.007*50

    def behaviour(self):
        nrlive = 0
        for n in self.neighbours:
            if n.type == 'residence':
                nrlive += 1
        if nrlive <=3:
            return 'residence'
        elif 11<=nrlive<=13:
            return 'residence'
        elif nrlive>=20:
            return 'void'
        else:
            return 'education'

    def getNeighbourCoordinates(self):
        neighbours = []
        list1=[-10,0,10]
        list2=[-4,0,4]
        for i in list1:
            for j in list1:
                for k in list2:
                    neighbours.append([self.x+i, self.y+j, self.z+k])
        neighbours.remove([self.x,self.y,self.z])
        return neighbours

class Cell_space(Cell):
    def __init__(self, x, y, z):
        self.x = x
        self.y = y
        self.z = z
        self.type = 'space'
        self.neighbours = []
        self.food=0
        self.ffood=0
        self.office_supplies=0
        self.furniture=0
        self.daily=0

    def behaviour(self):
        office = 0
        residence=0
        restaurant=0
        market=0
        education=0
        space=0
        for n in self.neighbours:
            if n.type == 'office':
                office += 1
            elif n.type == 'residence':
                residence += 1
            elif n.type == 'restaurant':
                restaurant += 1
            elif n.type == 'market':
                market += 1
            elif n.type == 'education':
                education += 1
            elif n.type == 'space':
                space += 1
        if market>=9:
            return 'market'




    def getNeighbourCoordinates(self):
        neighbours = []
        list1=[-10,0,10]
        list2=[-4,0,4]
        for i in list1:
            for j in list1:
                for k in list2:
                    neighbours.append([self.x+i, self.y+j, self.z+k])
        neighbours.remove([self.x,self.y,self.z])
        return neighbours

envcell=[]
for k in range(51):
    for i,j in zip(X,Y):
        if int(i)%5!=0:
            i=i+1
        if int(j)%5!=0:
            j=j+1
        envcell.append((int(i),int(j),int(k)*4+2))
spacecell=envcell[:]

celldict={}
if officeX != None:
    for i,j,k in zip(officeX,officeY,officeZ):
        if int(i)%5!=0:
            i=i+1
        if int(j)%5!=0:
            j=j+1
        c=Cell_office(int(i),int(j),int(k))
        celldict[int(i),int(j),int(k)]=c
        if spacecell.__contains__((int(i),int(j),int(k)))==True:
            spacecell.remove((int(i),int(j),int(k)))
if restaurantX != None:
    for i,j,k in zip(restaurantX,restaurantY,restaurantZ):
        if int(i)%5!=0:
            i=i+1
        if int(j)%5!=0:
            j=j+1
        c=Cell_restaurant(int(i),int(j),int(k))
        celldict[int(i),int(j),int(k)]=c
        if spacecell.__contains__((int(i),int(j),int(k)))==True:
            spacecell.remove((int(i),int(j),int(k)))
if commerceX != None:
    for i,j,k in zip(commerceX,commerceY,commerceZ):
        if int(i)%5!=0:
            i=i+1
        if int(j)%5!=0:
            j=j+1
        c=Cell_market(int(i),int(j),int(k))
        celldict[int(i),int(j),int(k)]=c
        if spacecell.__contains__((int(i),int(j),int(k)))==True:
            spacecell.remove((int(i),int(j),int(k)))
if residenceX != None:
    for i,j,k in zip(residenceX,residenceY,residenceZ):
        if int(i)%5!=0:
            i=i+1
        if int(j)%5!=0:
            j=j+1
        c=Cell_residence(int(i),int(j),int(k))
        celldict[int(i),int(j),int(k)]=c
        if spacecell.__contains__((int(i),int(j),int(k)))==True:
            spacecell.remove((int(i),int(j),int(k)))
if educationX != None:
    for i,j,k in zip(educationX,educationY,educationZ):
        if int(i)%5!=0:
            i=i+1
        if int(j)%5!=0:
            j=j+1
        c=Cell_education(int(i),int(j),int(k))
        celldict[int(i),int(j),int(k)]=c
        if spacecell.__contains__((int(i),int(j),int(k)))==True:
            spacecell.remove((int(i),int(j),int(k)))
for v in spacecell:
    c=Cell_space(v[0],v[1],v[2])
    celldict[v[0],v[1],v[2]]=c

for i in celldict:
    c=celldict[i]
    neigourCoords = c.getNeighbourCoordinates()
    for n in neigourCoords:
       if celldict.__contains__((n[0],n[1],n[2]))==True:
           c.neighbours.append(celldict[n[0],n[1],n[2]])


def evaluate(dict):
    food=Food
    frozen_food=Frozen_food
    office_supplies=Office_supplies
    furniture=Furniture
    daily_necessities=Daily_necessities
    nextCellDict={}
    for i in dict:
        c = dict[i]
        next = c.behaviour()
        if next == 'office':
            nCell = Cell_office(c.x,c.y,c.z)
            food=food+c.food-nCell.food
            frozen_food=frozen_food+c.ffood-nCell.ffood
            office_supplies=office_supplies+c.office_supplies-nCell.office_supplies
            furniture=furniture+c.furniture-nCell.furniture
            daily_necessities=daily_necessities+c.daily-nCell.daily
            if food>=0 and frozen_food>=0 and office_supplies>=0 and furniture>=0 and daily_necessities>=0:
                nextCellDict[c.x,c.y,c.z] = nCell
        elif next == 'restaurant':
            nCell = Cell_restaurant(c.x,c.y,c.z)
            food=food+c.food-nCell.food
            frozen_food=frozen_food+c.ffood-nCell.ffood
            office_supplies=office_supplies+c.office_supplies-nCell.office_supplies
            furniture=furniture+c.furniture-nCell.furniture
            daily_necessities=daily_necessities+c.daily-nCell.daily
            if food>=0 and frozen_food>=0 and office_supplies>=0 and furniture>=0 and daily_necessities>=0:
                nextCellDict[c.x,c.y,c.z] = nCell
        elif next == 'market':
            nCell = Cell_market(c.x,c.y,c.z)
            food=food+c.food-nCell.food
            frozen_food=frozen_food+c.ffood-nCell.ffood
            office_supplies=office_supplies+c.office_supplies-nCell.office_supplies
            furniture=furniture+c.furniture-nCell.furniture
            daily_necessities=daily_necessities+c.daily-nCell.daily
            if food>=0 and frozen_food>=0 and office_supplies>=0 and furniture>=0 and daily_necessities>=0:
                nextCellDict[c.x,c.y,c.z] = nCell
        elif next == 'residence':
            nCell = Cell_residence(c.x,c.y,c.z)
            food=food+c.food-nCell.food
            frozen_food=frozen_food+c.ffood-nCell.ffood
            office_supplies=office_supplies+c.office_supplies-nCell.office_supplies
            furniture=furniture+c.furniture-nCell.furniture
            daily_necessities=daily_necessities+c.daily-nCell.daily
            if food>=0 and frozen_food>=0 and office_supplies>=0 and furniture>=0 and daily_necessities>=0:
                nextCellDict[c.x,c.y,c.z] = nCell
        elif next == 'education':
            nCell = Cell_education(c.x,c.y,c.z)
            food=food+c.food-nCell.food
            frozen_food=frozen_food+c.ffood-nCell.ffood
            office_supplies=office_supplies+c.office_supplies-nCell.office_supplies
            furniture=furniture+c.furniture-nCell.furniture
            daily_necessities=daily_necessities+c.daily-nCell.daily
            if food>=0 and frozen_food>=0 and office_supplies>=0 and furniture>=0 and daily_necessities>=0:
                nextCellDict[c.x,c.y,c.z] = nCell
        elif next == 'void':
            nCell = Cell_void(c.x,c.y,c.z)
            nextCellDict[c.x,c.y,c.z] = nCell
            food=food+c.food
            frozen_food=frozen_food+c.ffood
            office_supplies=office_supplies+c.office_supplies
            furniture=furniture+c.furniture
            daily_necessities=daily_necessities+c.daily
        else:
            c.neighbours = []
            nextCellDict[c.x,c.y,c.z] = c

    for i in nextCellDict:
        c = nextCellDict[i]
        neigourCoords = c.getNeighbourCoordinates()
        for n in neigourCoords:
            if nextCellDict.__contains__((n[0],n[1],n[2]))==True:
                c.neighbours.append(nextCellDict[n[0],n[1],n[2]])

    dict = nextCellDict
    return dict,food,frozen_food,office_supplies,furniture,daily_necessities

officelist=[]
restaurantlist=[]
marketlist=[]
residencelist=[]
educationlist=[]
voidlist=[]

for g in range(int(generation)):
    officelist=[]
    restaurantlist=[]
    marketlist=[]
    residencelist=[]
    educationlist=[]
    voidlist=[]
    for i in celldict:
        c=celldict[i]
        if c.type=='office':
            officelist.append([c.x,c.y,c.z])
        elif c.type=='restaurant':
            restaurantlist.append([c.x,c.y,c.z])
        elif c.type=='market':
            marketlist.append([c.x,c.y,c.z])
        elif c.type=='residence':
            residencelist.append([c.x,c.y,c.z])
        elif c.type=='education':
            educationlist.append([c.x,c.y,c.z])
        elif c.type=='void':
            voidlist.append([c.x,c.y,c.z])
    celldict,cfood,cffood,coffice,cfurniture,cdaily=evaluate(celldict)

officepoints=[]
restaurantpoints=[]
marketpoints=[]
residencepoints=[]
educationpoints=[]
voidpoints=[]
for p in officelist:
    point3d=rg.Point3d(int(p[0]),int(p[1]),int(p[2]))
    officepoints.append(point3d)
for p in restaurantlist:
    point3d=rg.Point3d(int(p[0]),int(p[1]),int(p[2]))
    restaurantpoints.append(point3d)
for p in marketlist:
    point3d=rg.Point3d(int(p[0]),int(p[1]),int(p[2]))
    marketpoints.append(point3d)
for p in residencelist:
    point3d=rg.Point3d(int(p[0]),int(p[1]),int(p[2]))
    residencepoints.append(point3d)
for p in educationlist:
    point3d=rg.Point3d(int(p[0]),int(p[1]),int(p[2]))
    educationpoints.append(point3d)
for p in voidlist:
    point3d=rg.Point3d(int(p[0]),int(p[1]),int(p[2]))
    voidpoints.append(point3d)
# ---------- end ghpython_script_28 ----------
ghpython_script_29 = GhPythonScript(
    office=list_length_12,
    restaurant=list_length_14,
    market=list_length_15,
    residence=list_length_20,
    education=list_length_16)  # -> out, o, rest, m, resi, edu; same code as ghpython_script_25
ghpython_script_30 = GhPythonScript(
    office=list_length_13,
    restaurant=list_length_17,
    market=list_length_18,
    residence=list_length_11,
    education=list_length_19)  # -> out, o, rest, m, resi, edu
# ---------- ghpython_script_30: Python ----------
__author__ = "laoma"
__version__ = "2022.03.16"

import rhinoscriptsyntax as rs
if residence==None:
    residence=0
sum=office+restaurant+market+residence+education
o=office/sum*100
rest=restaurant/sum*100
m=market/sum*100
resi=residence/sum*100
edu=education/sum*100
# ---------- end ghpython_script_30 ----------
ghpython_script_31 = GhPythonScript(
    office=list_length_21,
    restaurant=list_length_23,
    market=list_length_26,
    residence=list_length_30,
    education=list_length_27)  # -> out, o, rest, m, resi, edu; same code as ghpython_script_25
ghpython_script_32 = GhPythonScript(
    office=list_length_22,
    restaurant=list_length_25,
    market=list_length_28,
    residence=list_length_32,
    education=list_length_29)  # -> out, o, rest, m, resi, edu; same code as ghpython_script_25
ghpython_script_33 = GhPythonScript(
    office=list_length_60,
    restaurant=list_length_61,
    market=list_length_62,
    residence=list_length_64,
    education=list_length_63)  # -> out, food, ffood, officesp, furniture, daily; same code as ghpython_script_3
ghpython_script_34 = GhPythonScript(
    office=list_length_24,
    restaurant=list_length_31,
    market=list_length_33,
    residence=list_length_35,
    education=list_length_34)  # -> out, o, rest, m, resi, edu; same code as ghpython_script_25
list_length_65 = ListLength(List=point_80)
list_length_66 = ListLength(List=point_81)
list_length_67 = ListLength(List=point_82)
list_length_68 = ListLength(List=point_83)
list_length_69 = ListLength(List=point_84)
ghpython_script_35 = GhPythonScript(office=list_length_57, restaurant=list_length_58, market=list_length_56, residence=list_length_59)  # -> out, o, rest, m, resi
# ---------- ghpython_script_35: Python ----------
__author__ = "laoma"
__version__ = "2022.03.16"

import rhinoscriptsyntax as rs
sum=office+restaurant+market+residence
o=office/sum*100
rest=restaurant/sum*100
m=market/sum*100
resi=residence/sum*100
# ---------- end ghpython_script_35 ----------
ghpython_script_36 = GhPythonScript(
    office=list_length_36,
    restaurant=list_length_37,
    market=list_length_38,
    residence=list_length_40,
    education=list_length_39)  # -> out, o, rest, m, resi, edu; same code as ghpython_script_25
ghpython_script_37 = GhPythonScript(
    X=deconstruct_79.XComponent,
    Y=deconstruct_79.YComponent,
    Z=deconstruct_79.ZComponent,
    officeX=deconstruct_74.XComponent,
    officeY=deconstruct_74.YComponent,
    officeZ=deconstruct_74.ZComponent,
    restaurantX=deconstruct_75.XComponent,
    restaurantY=deconstruct_75.YComponent,
    restaurantZ=deconstruct_75.ZComponent,
    commerceX=deconstruct_76.XComponent,
    commerceY=deconstruct_76.YComponent,
    commerceZ=deconstruct_76.ZComponent,
    residenceX=deconstruct_78.XComponent,
    residenceY=deconstruct_78.YComponent,
    residenceZ=deconstruct_78.ZComponent,
    educationX=deconstruct_77.XComponent,
    educationY=deconstruct_77.YComponent,
    educationZ=deconstruct_77.ZComponent,
    generation=number_slider,
    Food=ghpython_script_33.food,
    Frozen_food=ghpython_script_33.ffood,
    Office_supplies=ghpython_script_33.officesp,
    Furniture=ghpython_script_33.furniture,
    Daily_necessities=ghpython_script_33.daily)  # -> out, officepoints, restaurantpoints, marketpoints, residencepoints, educationpoints, voidpoints; inputs X: list, Y: list, Z: list, officeX: list, officeY: list, officeZ: list, restaurantX: list, restaurantY: list, restaurantZ: list, commerceX: list, commerceY: list, commerceZ: list, residenceX: list, residenceY: list, residenceZ: list, educationX: list, educationY: list, educationZ: list
# ---------- ghpython_script_37: Python ----------
__author__ = "laoma"
__version__ = "2022.03.12"

import rhinoscriptsyntax as rs
import random
from ghpythonlib.componentbase import executingcomponent as component
import Grasshopper, GhPython
import Rhino.Geometry as rg


class Cell:
  def __init__(self, x, y, z):
    self.x = x
    self.y = y
    self.z = z
    self.type = None

class Cell_void(Cell):
    def __init__(self, x, y, z):
        self.x = x
        self.y = y
        self.z = z
        self.type = 'void'
        self.neighbours = []
        self.food=0
        self.ffood=0
        self.office_supplies=0
        self.furniture=0
        self.daily=0

    def behaviour(self):
        office = 0
        for n in self.neighbours:
            if n.type == 'office':
                office += 1
        if office<=15:
            return 'office'
        else:
            return 'void'


    def getNeighbourCoordinates(self):
        neighbours = []
        list1=[-10,0,10]
        list2=[-4,0,4]
        for i in list1:
            for j in list1:
                for k in list2:
                    neighbours.append([self.x+i, self.y+j, self.z+k])
        neighbours.remove([self.x,self.y,self.z])
        return neighbours

class Cell_office(Cell):
    def __init__(self, x, y, z):
        self.x = x
        self.y = y
        self.z = z
        self.type = 'office'
        self.neighbours = []
        self.food=0.0013*20
        self.ffood=0.001*20
        self.office_supplies=0.0063*20
        self.furniture=0.746*20
        self.daily=0.017*20

    def behaviour(self):
        nrlive = 0
        resi=0
        for n in self.neighbours:
            if n.type == 'office':
                nrlive += 1
            if n.type =='residence':
                resi+=1
        if nrlive<=7:
            return 'office'
        elif 10<=nrlive<=12:
            return 'residence'
        elif nrlive>=20:
            return 'void'
        else:
            return 'office'


    def getNeighbourCoordinates(self):
        neighbours = []
        list1=[-10,0,10]
        list2=[-4,0,4]
        for i in list1:
            for j in list1:
                for k in list2:
                    neighbours.append([self.x+i, self.y+j, self.z+k])
        neighbours.remove([self.x,self.y,self.z])
        return neighbours

class Cell_restaurant(Cell):
    def __init__(self, x, y, z):
        self.x = x
        self.y = y
        self.z = z
        self.type = 'restaurant'
        self.neighbours = []
        self.food=0.15*15
        self.ffood=0.09*15
        self.office_supplies=0.0008*15
        self.furniture=0.375*15
        self.daily=0.005*15

    def behaviour(self):
        nrlive = 0
        for n in self.neighbours:
            if n.type == 'restaurant':
                nrlive += 1
        if nrlive <=3:
            return 'market'
        elif 11<=nrlive<=17:
            return 'market'

        elif nrlive>=22:
            return 'void'
        else:
            return 'restaurant'

    def getNeighbourCoordinates(self):
        neighbours = []
        list1=[-10,0,10]
        list2=[-4,0,4]
        for i in list1:
            for j in list1:
                for k in list2:
                    neighbours.append([self.x+i, self.y+j, self.z+k])
        neighbours.remove([self.x,self.y,self.z])
        return neighbours

class Cell_market(Cell):
    def __init__(self, x, y, z):
        self.x = x
        self.y = y
        self.z = z
        self.type = 'market'
        self.neighbours = []
        self.food=0.0008*20
        self.ffood=0.0006*20
        self.office_supplies=0.0017*20
        self.furniture=0.221*20
        self.daily=0.55*20

    def behaviour(self):
        nrlive = 0
        for n in self.neighbours:
            if n.type == 'market':
                nrlive += 1
        if nrlive <=3:
            return 'residence'
        elif 8<=nrlive<=17:
            return 'restaurant'
        elif nrlive>=18:
            return 'void'

        else:
            return 'market'

    def getNeighbourCoordinates(self):
        neighbours = []
        list1=[-10,0,10]
        list2=[-4,0,4]
        for i in list1:
            for j in list1:
                for k in list2:
                    neighbours.append([self.x+i, self.y+j, self.z+k])
        neighbours.remove([self.x,self.y,self.z])
        return neighbours

class Cell_residence(Cell):
    def __init__(self, x, y, z):
        self.x = x
        self.y = y
        self.z = z
        self.type = 'residence'
        self.neighbours = []
        self.food=0.005*8
        self.ffood=0.003*8
        self.office_supplies=0.0003*8
        self.furniture=1.113*8
        self.daily=0.021*8

    def behaviour(self):
        nrlive = 0
        for n in self.neighbours:
            if n.type == 'residence':
                nrlive += 1
        if nrlive <=3:
            return 'office'

        elif 11<=nrlive<=13:
            return 'market'
        elif 17<=nrlive<=19:
            return 'education'
        elif nrlive>=20:
            return 'void'
        else:
            return 'residence'

    def getNeighbourCoordinates(self):
        neighbours = []
        list1=[-10,0,10]
        list2=[-4,0,4]
        for i in list1:
            for j in list1:
                for k in list2:
                    neighbours.append([self.x+i, self.y+j, self.z+k])
        neighbours.remove([self.x,self.y,self.z])
        return neighbours

class Cell_education(Cell):
    def __init__(self, x, y, z):
        self.x = x
        self.y = y
        self.z = z
        self.type = 'education'
        self.neighbours = []
        self.food=0.0018*50
        self.ffood=0.001*50
        self.office_supplies=0.009*50
        self.furniture=0.294*50
        self.daily=0.007*50

    def behaviour(self):
        nrlive = 0
        for n in self.neighbours:
            if n.type == 'education':
                nrlive += 1
        if nrlive <=3:
            return 'education'
        elif 11<=nrlive<=13:
            return 'residence'
        elif nrlive>=20:
            return 'void'
        else:
            return 'education'

    def getNeighbourCoordinates(self):
        neighbours = []
        list1=[-10,0,10]
        list2=[-4,0,4]
        for i in list1:
            for j in list1:
                for k in list2:
                    neighbours.append([self.x+i, self.y+j, self.z+k])
        neighbours.remove([self.x,self.y,self.z])
        return neighbours

class Cell_space(Cell):
    def __init__(self, x, y, z):
        self.x = x
        self.y = y
        self.z = z
        self.type = 'space'
        self.neighbours = []
        self.food=0
        self.ffood=0
        self.office_supplies=0
        self.furniture=0
        self.daily=0

    def behaviour(self):
        office = 0
        residence=0
        restaurant=0
        market=0
        education=0
        space=0
        for n in self.neighbours:
            if n.type == 'office':
                office += 1
            elif n.type == 'residence':
                residence += 1
            elif n.type == 'restaurant':
                restaurant += 1
            elif n.type == 'market':
                market += 1
            elif n.type == 'education':
                education += 1
            elif n.type == 'space':
                space += 1
        if office>=9:
            return 'office'
        if residence>=9:
            return 'residence'



    def getNeighbourCoordinates(self):
        neighbours = []
        list1=[-10,0,10]
        list2=[-4,0,4]
        for i in list1:
            for j in list1:
                for k in list2:
                    neighbours.append([self.x+i, self.y+j, self.z+k])
        neighbours.remove([self.x,self.y,self.z])
        return neighbours

envcell=[]
for k in range(51):
    for i,j in zip(X,Y):
        if int(i)%5!=0:
            i=i+1
        if int(j)%5!=0:
            j=j+1
        envcell.append((int(i),int(j),int(k)*4+2))
spacecell=envcell[:]

celldict={}
if officeX != None:
    for i,j,k in zip(officeX,officeY,officeZ):
        if int(i)%5!=0:
            i=i+1
        if int(j)%5!=0:
            j=j+1
        c=Cell_office(int(i),int(j),int(k))
        celldict[int(i),int(j),int(k)]=c
        if spacecell.__contains__((int(i),int(j),int(k)))==True:
            spacecell.remove((int(i),int(j),int(k)))
if restaurantX != None:
    for i,j,k in zip(restaurantX,restaurantY,restaurantZ):
        if int(i)%5!=0:
            i=i+1
        if int(j)%5!=0:
            j=j+1
        c=Cell_restaurant(int(i),int(j),int(k))
        celldict[int(i),int(j),int(k)]=c
        if spacecell.__contains__((int(i),int(j),int(k)))==True:
            spacecell.remove((int(i),int(j),int(k)))
if commerceX != None:
    for i,j,k in zip(commerceX,commerceY,commerceZ):
        if int(i)%5!=0:
            i=i+1
        if int(j)%5!=0:
            j=j+1
        c=Cell_market(int(i),int(j),int(k))
        celldict[int(i),int(j),int(k)]=c
        if spacecell.__contains__((int(i),int(j),int(k)))==True:
            spacecell.remove((int(i),int(j),int(k)))
if residenceX != None:
    for i,j,k in zip(residenceX,residenceY,residenceZ):
        if int(i)%5!=0:
            i=i+1
        if int(j)%5!=0:
            j=j+1
        c=Cell_residence(int(i),int(j),int(k))
        celldict[int(i),int(j),int(k)]=c
        if spacecell.__contains__((int(i),int(j),int(k)))==True:
            spacecell.remove((int(i),int(j),int(k)))
if educationX != None:
    for i,j,k in zip(educationX,educationY,educationZ):
        if int(i)%5!=0:
            i=i+1
        if int(j)%5!=0:
            j=j+1
        c=Cell_education(int(i),int(j),int(k))
        celldict[int(i),int(j),int(k)]=c
        if spacecell.__contains__((int(i),int(j),int(k)))==True:
            spacecell.remove((int(i),int(j),int(k)))
for v in spacecell:
    c=Cell_space(v[0],v[1],v[2])
    celldict[v[0],v[1],v[2]]=c

for i in celldict:
    c=celldict[i]
    neigourCoords = c.getNeighbourCoordinates()
    for n in neigourCoords:
       if celldict.__contains__((n[0],n[1],n[2]))==True:
           c.neighbours.append(celldict[n[0],n[1],n[2]])


def evaluate(dict):
    food=Food
    frozen_food=Frozen_food
    office_supplies=Office_supplies
    furniture=Furniture
    daily_necessities=Daily_necessities
    nextCellDict={}
    for i in dict:
        c = dict[i]
        next = c.behaviour()
        if next == 'office':
            nCell = Cell_office(c.x,c.y,c.z)
            food=food+c.food-nCell.food
            frozen_food=frozen_food+c.ffood-nCell.ffood
            office_supplies=office_supplies+c.office_supplies-nCell.office_supplies
            furniture=furniture+c.furniture-nCell.furniture
            daily_necessities=daily_necessities+c.daily-nCell.daily
            if food>=0 and frozen_food>=0 and office_supplies>=0 and furniture>=0 and daily_necessities>=0:
                nextCellDict[c.x,c.y,c.z] = nCell
        elif next == 'restaurant':
            nCell = Cell_restaurant(c.x,c.y,c.z)
            food=food+c.food-nCell.food
            frozen_food=frozen_food+c.ffood-nCell.ffood
            office_supplies=office_supplies+c.office_supplies-nCell.office_supplies
            furniture=furniture+c.furniture-nCell.furniture
            daily_necessities=daily_necessities+c.daily-nCell.daily
            if food>=0 and frozen_food>=0 and office_supplies>=0 and furniture>=0 and daily_necessities>=0:
                nextCellDict[c.x,c.y,c.z] = nCell
        elif next == 'market':
            nCell = Cell_market(c.x,c.y,c.z)
            food=food+c.food-nCell.food
            frozen_food=frozen_food+c.ffood-nCell.ffood
            office_supplies=office_supplies+c.office_supplies-nCell.office_supplies
            furniture=furniture+c.furniture-nCell.furniture
            daily_necessities=daily_necessities+c.daily-nCell.daily
            if food>=0 and frozen_food>=0 and office_supplies>=0 and furniture>=0 and daily_necessities>=0:
                nextCellDict[c.x,c.y,c.z] = nCell
        elif next == 'residence':
            nCell = Cell_residence(c.x,c.y,c.z)
            food=food+c.food-nCell.food
            frozen_food=frozen_food+c.ffood-nCell.ffood
            office_supplies=office_supplies+c.office_supplies-nCell.office_supplies
            furniture=furniture+c.furniture-nCell.furniture
            daily_necessities=daily_necessities+c.daily-nCell.daily
            if food>=0 and frozen_food>=0 and office_supplies>=0 and furniture>=0 and daily_necessities>=0:
                nextCellDict[c.x,c.y,c.z] = nCell
        elif next == 'education':
            nCell = Cell_education(c.x,c.y,c.z)
            food=food+c.food-nCell.food
            frozen_food=frozen_food+c.ffood-nCell.ffood
            office_supplies=office_supplies+c.office_supplies-nCell.office_supplies
            furniture=furniture+c.furniture-nCell.furniture
            daily_necessities=daily_necessities+c.daily-nCell.daily
            if food>=0 and frozen_food>=0 and office_supplies>=0 and furniture>=0 and daily_necessities>=0:
                nextCellDict[c.x,c.y,c.z] = nCell
        elif next == 'void':
            nCell = Cell_void(c.x,c.y,c.z)
            nextCellDict[c.x,c.y,c.z] = nCell
            food=food+c.food
            frozen_food=frozen_food+c.ffood
            office_supplies=office_supplies+c.office_supplies
            furniture=furniture+c.furniture
            daily_necessities=daily_necessities+c.daily
        else:
            c.neighbours = []
            nextCellDict[c.x,c.y,c.z] = c

    for i in nextCellDict:
        c = nextCellDict[i]
        neigourCoords = c.getNeighbourCoordinates()
        for n in neigourCoords:
            if nextCellDict.__contains__((n[0],n[1],n[2]))==True:
                c.neighbours.append(nextCellDict[n[0],n[1],n[2]])

    dict = nextCellDict
    return dict,food,frozen_food,office_supplies,furniture,daily_necessities

officelist=[]
restaurantlist=[]
marketlist=[]
residencelist=[]
educationlist=[]
voidlist=[]

for g in range(int(generation)):
    officelist=[]
    restaurantlist=[]
    marketlist=[]
    residencelist=[]
    educationlist=[]
    voidlist=[]
    for i in celldict:
        c=celldict[i]
        if c.type=='office':
            officelist.append([c.x,c.y,c.z])
        elif c.type=='restaurant':
            restaurantlist.append([c.x,c.y,c.z])
        elif c.type=='market':
            marketlist.append([c.x,c.y,c.z])
        elif c.type=='residence':
            residencelist.append([c.x,c.y,c.z])
        elif c.type=='education':
            educationlist.append([c.x,c.y,c.z])
        elif c.type=='void':
            voidlist.append([c.x,c.y,c.z])
    celldict,cfood,cffood,coffice,cfurniture,cdaily=evaluate(celldict)

officepoints=[]
restaurantpoints=[]
marketpoints=[]
residencepoints=[]
educationpoints=[]
voidpoints=[]
for p in officelist:
    point3d=rg.Point3d(int(p[0]),int(p[1]),int(p[2]))
    officepoints.append(point3d)
for p in restaurantlist:
    point3d=rg.Point3d(int(p[0]),int(p[1]),int(p[2]))
    restaurantpoints.append(point3d)
for p in marketlist:
    point3d=rg.Point3d(int(p[0]),int(p[1]),int(p[2]))
    marketpoints.append(point3d)
for p in residencelist:
    point3d=rg.Point3d(int(p[0]),int(p[1]),int(p[2]))
    residencepoints.append(point3d)
for p in educationlist:
    point3d=rg.Point3d(int(p[0]),int(p[1]),int(p[2]))
    educationpoints.append(point3d)
for p in voidlist:
    point3d=rg.Point3d(int(p[0]),int(p[1]),int(p[2]))
    voidpoints.append(point3d)
# ---------- end ghpython_script_37 ----------
ghpython_script_38 = GhPythonScript(
    office=list_length_41,
    restaurant=list_length_42,
    market=list_length_43,
    residence=list_length_45,
    education=list_length_44)  # -> out, o, rest, m, resi, edu; same code as ghpython_script_25
ghpython_script_39 = GhPythonScript(
    office=list_length_46,
    restaurant=list_length_47,
    market=list_length_48,
    residence=list_length_51,
    education=list_length_49)  # -> out, o, rest, m, resi, edu; same code as ghpython_script_25
ghpython_script_40 = GhPythonScript(
    office=list_length_50,
    restaurant=list_length_52,
    market=list_length_53,
    residence=list_length_55,
    education=list_length_54)  # -> out, o, rest, m, resi, edu; same code as ghpython_script_25
panel = Panel(ghpython_script_25.o)
panel_2 = Panel(ghpython_script_25.m)
panel_3 = Panel(ghpython_script_25.resi)
panel_4 = Panel(ghpython_script_25.rest)
panel_5 = Panel(ghpython_script_25.edu)
panel_6 = Panel(ghpython_script_26.o)
panel_7 = Panel(ghpython_script_26.m)
panel_8 = Panel(ghpython_script_26.edu)
panel_9 = Panel(ghpython_script_26.rest)
panel_10 = Panel(ghpython_script_26.resi)
panel_11 = Panel(ghpython_script_29.o)
panel_12 = Panel(ghpython_script_30.o)
panel_13 = Panel(ghpython_script_30.m)
panel_14 = Panel(ghpython_script_29.m)
panel_15 = Panel(ghpython_script_29.resi)
panel_16 = Panel(ghpython_script_30.resi)
panel_17 = Panel(ghpython_script_30.edu)
panel_18 = Panel(ghpython_script_29.rest)
panel_19 = Panel(ghpython_script_30.rest)
panel_20 = Panel(ghpython_script_32.o)
panel_21 = Panel(ghpython_script_29.edu)
panel_22 = Panel(ghpython_script_31.o)
panel_23 = Panel(ghpython_script_32.m)
panel_24 = Panel(ghpython_script_34.o)
panel_25 = Panel(ghpython_script_31.m)
panel_26 = Panel(ghpython_script_32.resi)
panel_27 = Panel(ghpython_script_31.edu)
panel_28 = Panel(ghpython_script_32.rest)
panel_29 = Panel(ghpython_script_31.resi)
panel_30 = Panel(ghpython_script_31.rest)
panel_31 = Panel(ghpython_script_34.m)
panel_32 = Panel(ghpython_script_32.edu)
panel_33 = Panel(ghpython_script_34.resi)
panel_34 = Panel(ghpython_script_34.rest)
panel_35 = Panel(ghpython_script_34.edu)
ghpython_script_41 = GhPythonScript(
    office=list_length_65,
    restaurant=list_length_66,
    market=list_length_67,
    residence=list_length_69,
    education=list_length_68)  # -> out, food, ffood, officesp, furniture, daily; same code as ghpython_script_3
ghpython_script_42 = GhPythonScript(
    office=list_length_60,
    restaurant=list_length_61,
    market=list_length_62,
    residence=list_length_64,
    education=list_length_63)  # -> out, o, rest, m, resi, edu; same code as ghpython_script_25
panel_36 = Panel(ghpython_script_35.o)
panel_37 = Panel(ghpython_script_35.m)
panel_38 = Panel(ghpython_script_35.resi)
panel_39 = Panel(ghpython_script_35.rest)
panel_40 = Panel(ghpython_script_36.o)
panel_41 = Panel(ghpython_script_36.edu)
panel_42 = Panel(ghpython_script_36.resi)
panel_43 = Panel(ghpython_script_36.rest)
panel_44 = Panel(ghpython_script_36.m)
panel_45 = Panel(ghpython_script_38.o)
panel_46 = Panel(ghpython_script_38.m)
ghpython_script_43 = GhPythonScript(
    X=deconstruct_85.XComponent,
    Y=deconstruct_85.YComponent,
    Z=deconstruct_85.ZComponent,
    officeX=deconstruct_80.XComponent,
    officeY=deconstruct_80.YComponent,
    officeZ=deconstruct_80.ZComponent,
    restaurantX=deconstruct_81.XComponent,
    restaurantY=deconstruct_81.YComponent,
    restaurantZ=deconstruct_81.ZComponent,
    commerceX=deconstruct_82.XComponent,
    commerceY=deconstruct_82.YComponent,
    commerceZ=deconstruct_82.ZComponent,
    residenceX=deconstruct_84.XComponent,
    residenceY=deconstruct_84.YComponent,
    residenceZ=deconstruct_84.ZComponent,
    generation=number_slider,
    Food=ghpython_script_41.food,
    Frozen_food=ghpython_script_41.ffood,
    Office_supplies=ghpython_script_41.officesp,
    Furniture=ghpython_script_41.furniture,
    Daily_necessities=ghpython_script_41.daily)  # -> out, officepoints, restaurantpoints, marketpoints, residencepoints, educationpoints, voidpoints; inputs X: list, Y: list, Z: list, officeX: list, officeY: list, officeZ: list, restaurantX: list, restaurantY: list, restaurantZ: list, commerceX: list, commerceY: list, commerceZ: list, residenceX: list, residenceY: list, residenceZ: list, educationX: list, educationY: list, educationZ: list; same code as ghpython_script_17
panel_47 = Panel(ghpython_script_38.resi)
panel_48 = Panel(ghpython_script_38.rest)
panel_49 = Panel(ghpython_script_39.o)
panel_50 = Panel(ghpython_script_38.edu)
panel_51 = Panel(ghpython_script_39.m)
panel_52 = Panel(ghpython_script_39.rest)
panel_53 = Panel(ghpython_script_39.resi)
panel_54 = Panel(ghpython_script_39.edu)
panel_55 = Panel(ghpython_script_40.o)
number_slider_15 = Slider(5, range=0..20)
panel_56 = Panel(ghpython_script_40.m)
panel_57 = Panel(ghpython_script_40.resi)
panel_58 = Panel(ghpython_script_40.rest)
panel_59 = Panel(ghpython_script_40.edu)
number_slider_16 = Slider(5, range=0..20)
number_slider_17 = Slider(5, range=0..20)
number_slider_18 = Slider(5, range=0..20)
number_slider_19 = Slider(5, range=0..20)
number_slider_20 = Slider(5, range=0..20)
number_slider_21 = Slider(5, range=0..20)
number_slider_22 = Slider(5, range=0..20)
number_slider_23 = Slider(5, range=0..20)
number_slider_24 = Slider(5, range=0..20)
number_slider_25 = Slider(5, range=0..20)
point_86 = Point(ghpython_script_6.restaurantpoints)
number_slider_26 = Slider(5, range=0..20)
number_slider_27 = Slider(5, range=0..20)
number_slider_28 = Slider(5, range=0..20)
number_slider_29 = Slider(5, range=0..20)
number_slider_30 = Slider(5, range=0..20)
number_slider_31 = Slider(5, range=0..20)
number_slider_32 = Slider(5, range=0..20)
number_slider_33 = Slider(5, range=0..20)
point_87 = Point(ghpython_script_6.officepoints)
point_88 = Point(ghpython_script_6.marketpoints)
number_slider_34 = Slider(5, range=0..20)
number_slider_35 = Slider(5, range=0..20)
number_slider_36 = Slider(5, range=0..20)
number_slider_37 = Slider(5, range=0..20)
number_slider_38 = Slider(5, range=0..20)
number_slider_39 = Slider(5, range=0..20)
point_89 = Point(ghpython_script_7.restaurantpoints)
number_slider_40 = Slider(5, range=0..20)
number_slider_41 = Slider(5, range=0..20)
point_90 = Point(ghpython_script_6.residencepoints)
number_slider_42 = Slider(5, range=0..20)
number_slider_43 = Slider(5, range=0..20)
point_91 = Point(ghpython_script_7.officepoints)
point_92 = Point(ghpython_script_7.marketpoints)
number_slider_44 = Slider(5, range=0..20)
number_slider_45 = Slider(5, range=0..20)
number_slider_46 = Slider(5, range=0..20)
point_93 = Point(ghpython_script_7.residencepoints)
number_slider_47 = Slider(5, range=0..20)
number_slider_48 = Slider(5, range=0..20)
number_slider_49 = Slider(5, range=0..20)
number_slider_50 = Slider(5, range=0..20)
panel_60 = Panel(ghpython_script_42.o)
number_slider_51 = Slider(5, range=0..20)
panel_61 = Panel(ghpython_script_42.m)
panel_62 = Panel(ghpython_script_42.edu)
panel_63 = Panel(ghpython_script_42.resi)
number_slider_52 = Slider(5, range=0..20)
number_slider_53 = Slider(5, range=0..20)
panel_64 = Panel(ghpython_script_42.rest)
point_94 = Point(ghpython_script_12.restaurantpoints)
point_95 = Point(ghpython_script_13.restaurantpoints)
number_slider_54 = Slider(5, range=0..20)
point_96 = Point(ghpython_script_15.restaurantpoints)
point_97 = Point(ghpython_script_12.officepoints)
point_98 = Point(ghpython_script_12.marketpoints)
number_slider_55 = Slider(5, range=0..20)
point_99 = Point(ghpython_script_14.restaurantpoints)
point_100 = Point(ghpython_script_13.officepoints)
point_101 = Point(ghpython_script_13.marketpoints)
point_102 = Point(ghpython_script_17.restaurantpoints)
number_slider_56 = Slider(5, range=0..20)
number_slider_57 = Slider(5, range=0..20)
number_slider_58 = Slider(5, range=0..20)
ghpython_script_44 = GhPythonScript(
    office=list_length_65,
    restaurant=list_length_66,
    market=list_length_67,
    residence=list_length_69,
    education=list_length_68)  # -> out, o, rest, m, resi, edu; same code as ghpython_script_25
point_103 = Point(ghpython_script_15.officepoints)
point_104 = Point(ghpython_script_15.marketpoints)
number_slider_59 = Slider(5, range=0..20)
number_slider_60 = Slider(5, range=0..20)
point_105 = Point(ghpython_script_14.officepoints)
point_106 = Point(ghpython_script_14.marketpoints)
point_107 = Point(ghpython_script_12.residencepoints)
point_108 = Point(ghpython_script_13.residencepoints)
point_109 = Point(ghpython_script_17.officepoints)
point_110 = Point(ghpython_script_17.marketpoints)
number_slider_61 = Slider(5, range=0..20)
number_slider_62 = Slider(5, range=0..20)
number_slider_63 = Slider(5, range=0..20)
point_111 = Point(ghpython_script_6.voidpoints)
number_slider_64 = Slider(5, range=0..20)
number_slider_65 = Slider(5, range=0..20)
number_slider_66 = Slider(5, range=0..20)
point_112 = Point(ghpython_script_15.residencepoints)
number_slider_67 = Slider(5, range=0..20)
point_113 = Point(ghpython_script_14.residencepoints)
number_slider_68 = Slider(5, range=0..20)
number_slider_69 = Slider(5, range=0..20)
point_114 = Point(ghpython_script_17.residencepoints)
number_slider_70 = Slider(5, range=0..20)
number_slider_71 = Slider(5, range=0..20)
number_slider_72 = Slider(5, range=0..20)
point_115 = Point(ghpython_script_28.restaurantpoints)
point_116 = Point(ghpython_script_7.voidpoints)
number_slider_73 = Slider(5, range=0..20)
number_slider_74 = Slider(5, range=0..20)
point_117 = Point(ghpython_script_6.educationpoints)
number_slider_75 = Slider(5, range=0..20)
number_slider_76 = Slider(5, range=0..20)
point_118 = Point(ghpython_script_28.officepoints)
point_119 = Point(ghpython_script_28.marketpoints)
point_120 = Point(ghpython_script_21.restaurantpoints)
number_slider_77 = Slider(5, range=0..20)
point_121 = Point(ghpython_script_7.educationpoints)
point_122 = Point(ghpython_script_28.residencepoints)
point_123 = Point(ghpython_script_21.officepoints)
point_124 = Point(ghpython_script_21.marketpoints)
number_slider_78 = Slider(5, range=0..20)
point_125 = Point(ghpython_script_22.restaurantpoints)
point_126 = Point(ghpython_script_21.residencepoints)
number_slider_79 = Slider(5, range=0..20)
point_127 = Point(ghpython_script_23.restaurantpoints)
point_128 = Point(ghpython_script_22.officepoints)
point_129 = Point(ghpython_script_22.marketpoints)
point_130 = Point(ghpython_script_13.voidpoints)
point_131 = Point(ghpython_script_12.voidpoints)
point_132 = Point(ghpython_script_24.restaurantpoints)
point_133 = Point(ghpython_script_23.officepoints)
point_134 = Point(ghpython_script_23.marketpoints)
number_slider_80 = Slider(5, range=0..20)
number_slider_81 = Slider(5, range=0..20)
point_135 = Point(ghpython_script_15.voidpoints)
point_136 = Point(ghpython_script_14.voidpoints)
point_137 = Point(ghpython_script_22.residencepoints)
point_138 = Point(ghpython_script_17.voidpoints)
number_slider_82 = Slider(5, range=0..20)
point_139 = Point(ghpython_script_24.officepoints)
point_140 = Point(ghpython_script_24.marketpoints)
point_141 = Point(ghpython_script_23.residencepoints)
point_142 = Point(ghpython_script_13.educationpoints)
point_143 = Point(ghpython_script_12.educationpoints)
number_slider_83 = Slider(5, range=0..20)
number_slider_84 = Slider(5, range=0..20)
point_144 = Point(ghpython_script_24.residencepoints)
point_145 = Point(ghpython_script_15.educationpoints)
point_146 = Point(ghpython_script_14.educationpoints)
point_147 = Point(ghpython_script_17.educationpoints)
number_slider_85 = Slider(5, range=0..20)
number_slider_86 = Slider(5, range=0..20)
point_148 = Point(ghpython_script_28.voidpoints)
point_149 = Point(ghpython_script_21.voidpoints)
number_slider_87 = Slider(5, range=0..20)
point_150 = Point(ghpython_script_28.educationpoints)
center_box = CenterBox(Base=point_86, X=number_slider_15, Y=number_slider_15, Z=Slider(2, range=0..20))
number_slider_88 = Slider(5, range=0..20)
number_slider_89 = Slider(5, range=0..20)
point_151 = Point(ghpython_script_22.voidpoints)
center_box_2 = CenterBox(Base=point_87, X=number_slider_16, Y=number_slider_16, Z=Slider(2, range=0..20))
point_152 = Point(ghpython_script_21.educationpoints)
center_box_3 = CenterBox(Base=point_88, X=number_slider_17, Y=number_slider_17, Z=Slider(2, range=0..20))
number_slider_90 = Slider(5, range=0..20)
center_box_4 = CenterBox(Base=point_89, X=number_slider_18, Y=number_slider_18, Z=Slider(2, range=0..20))
point_153 = Point(ghpython_script_23.voidpoints)
center_box_5 = CenterBox(Base=point_90, X=number_slider_19, Y=number_slider_19, Z=Slider(2, range=0..20))
point_154 = Point(ghpython_script_24.voidpoints)
center_box_6 = CenterBox(Base=point_91, X=number_slider_20, Y=number_slider_20, Z=Slider(2, range=0..20))
center_box_7 = CenterBox(Base=point_92, X=number_slider_21, Y=number_slider_21, Z=Slider(2, range=0..20))
point_155 = Point(ghpython_script_22.educationpoints)
point_156 = Point(ghpython_script_23.educationpoints)
center_box_8 = CenterBox(Base=point_93, X=number_slider_22, Y=number_slider_22, Z=Slider(2, range=0..20))
panel_65 = Panel(ghpython_script_44.o)
point_157 = Point(ghpython_script_24.educationpoints)
panel_66 = Panel(ghpython_script_44.m)
panel_67 = Panel(ghpython_script_44.resi)
panel_68 = Panel(ghpython_script_44.rest)
panel_69 = Panel(ghpython_script_44.edu)
center_box_9 = CenterBox(Base=point_94, X=number_slider_24, Y=number_slider_24, Z=Slider(2, range=0..20))
point_158 = Point(ghpython_script_37.restaurantpoints)
center_box_10 = CenterBox(Base=point_95, X=number_slider_23, Y=number_slider_23, Z=Slider(2, range=0..20))
center_box_11 = CenterBox(Base=point_97, X=number_slider_29, Y=number_slider_29, Z=Slider(2, range=0..20))
center_box_12 = CenterBox(Base=point_99, X=number_slider_26, Y=number_slider_26, Z=Slider(2, range=0..20))
center_box_13 = CenterBox(Base=point_96, X=number_slider_25, Y=number_slider_25, Z=Slider(2, range=0..20))
center_box_14 = CenterBox(Base=point_98, X=number_slider_30, Y=number_slider_30, Z=Slider(2, range=0..20))
center_box_15 = CenterBox(Base=point_100, X=number_slider_27, Y=number_slider_27, Z=Slider(2, range=0..20))
point_159 = Point(ghpython_script_37.officepoints)
point_160 = Point(ghpython_script_37.marketpoints)
center_box_16 = CenterBox(Base=point_101, X=number_slider_28, Y=number_slider_28, Z=Slider(2, range=0..20))
center_box_17 = CenterBox(Base=point_102, X=number_slider_31, Y=number_slider_31, Z=Slider(2, range=0..20))
center_box_18 = CenterBox(Base=point_105, X=number_slider_34, Y=number_slider_34, Z=Slider(2, range=0..20))
center_box_19 = CenterBox(Base=point_103, X=number_slider_32, Y=number_slider_32, Z=Slider(2, range=0..20))
center_box_20 = CenterBox(Base=point_106, X=number_slider_35, Y=number_slider_35, Z=Slider(2, range=0..20))
center_box_21 = CenterBox(Base=point_104, X=number_slider_33, Y=number_slider_33, Z=Slider(2, range=0..20))
number_slider_91 = Slider(5, range=0..20)
center_box_22 = CenterBox(Base=point_107, X=number_slider_37, Y=number_slider_37, Z=Slider(2, range=0..20))
center_box_23 = CenterBox(Base=point_109, X=number_slider_38, Y=number_slider_38, Z=Slider(2, range=0..20))
point_161 = Point(ghpython_script_37.residencepoints)
center_box_24 = CenterBox(Base=point_108, X=number_slider_36, Y=number_slider_36, Z=Slider(2, range=0..20))
center_box_25 = CenterBox(Base=point_110, X=number_slider_39, Y=number_slider_39, Z=Slider(2, range=0..20))
center_box_26 = CenterBox(Base=point_111, X=number_slider_40, Y=number_slider_40, Z=Slider(2, range=0..20))
center_box_27 = CenterBox(Base=point_113, X=number_slider_42, Y=number_slider_42, Z=Slider(2, range=0..20))
center_box_28 = CenterBox(Base=point_112, X=number_slider_41, Y=number_slider_41, Z=Slider(2, range=0..20))
center_box_29 = CenterBox(Base=point_114, X=number_slider_43, Y=number_slider_43, Z=Slider(2, range=0..20))
number_slider_92 = Slider(5, range=0..20)
center_box_30 = CenterBox(Base=point_116, X=number_slider_45, Y=number_slider_45, Z=Slider(2, range=0..20))
center_box_31 = CenterBox(Base=point_115, X=number_slider_44, Y=number_slider_44, Z=Slider(2, range=0..20))
colour_swatch = ColourSwatch(SwatchColor=RGB(158, 233, 236))
center_box_32 = CenterBox(Base=point_117, X=number_slider_46, Y=number_slider_46, Z=Slider(2, range=0..20))
center_box_33 = CenterBox(Base=point_118, X=number_slider_47, Y=number_slider_47, Z=Slider(2, range=0..20))
center_box_34 = CenterBox(Base=point_119, X=number_slider_48, Y=number_slider_48, Z=Slider(2, range=0..20))
colour_swatch_2 = ColourSwatch(SwatchColor=RGB(163, 64, 155))
colour_swatch_3 = ColourSwatch(SwatchColor=RGB(135, 101, 193))
center_box_35 = CenterBox(Base=point_120, X=number_slider_49, Y=number_slider_49, Z=Slider(2, range=0..20))
colour_swatch_4 = ColourSwatch(SwatchColor=RGB(158, 233, 236))
center_box_36 = CenterBox(Base=point_121, X=number_slider_50, Y=number_slider_50, Z=Slider(2, range=0..20))
center_box_37 = CenterBox(Base=point_122, X=number_slider_51, Y=number_slider_51, Z=Slider(2, range=0..20))
colour_swatch_5 = ColourSwatch(SwatchColor=RGB(233, 189, 205))
center_box_38 = CenterBox(Base=point_123, X=number_slider_52, Y=number_slider_52, Z=Slider(2, range=0..20))
center_box_39 = CenterBox(Base=point_124, X=number_slider_53, Y=number_slider_53, Z=Slider(2, range=0..20))
colour_swatch_6 = ColourSwatch(SwatchColor=RGB(163, 64, 155))
colour_swatch_7 = ColourSwatch(SwatchColor=RGB(135, 101, 193))
center_box_40 = CenterBox(Base=point_125, X=number_slider_54, Y=number_slider_54, Z=Slider(2, range=0..20))
center_box_41 = CenterBox(Base=point_126, X=number_slider_55, Y=number_slider_55, Z=Slider(2, range=0..20))
colour_swatch_8 = ColourSwatch(SwatchColor=RGB(233, 189, 205))
center_box_42 = CenterBox(Base=point_128, X=number_slider_57, Y=number_slider_57, Z=Slider(2, range=0..20))
center_box_43 = CenterBox(Base=point_127, X=number_slider_56, Y=number_slider_56, Z=Slider(2, range=0..20))
center_box_44 = CenterBox(Base=point_129, X=number_slider_58, Y=number_slider_58, Z=Slider(2, range=0..20))
center_box_45 = CenterBox(Base=point_131, X=number_slider_59, Y=number_slider_59, Z=Slider(2, range=0..20))
point_162 = Point(ghpython_script_37.voidpoints)
center_box_46 = CenterBox(Base=point_130, X=number_slider_60, Y=number_slider_60, Z=Slider(2, range=0..20))
center_box_47 = CenterBox(Base=point_132, X=number_slider_61, Y=number_slider_61, Z=Slider(2, range=0..20))
center_box_48 = CenterBox(Base=point_133, X=number_slider_62, Y=number_slider_62, Z=Slider(2, range=0..20))
center_box_49 = CenterBox(Base=point_134, X=number_slider_63, Y=number_slider_63, Z=Slider(2, range=0..20))
center_box_50 = CenterBox(Base=point_136, X=number_slider_66, Y=number_slider_66, Z=Slider(2, range=0..20))
center_box_51 = CenterBox(Base=point_135, X=number_slider_64, Y=number_slider_64, Z=Slider(2, range=0..20))
center_box_52 = CenterBox(Base=point_137, X=number_slider_65, Y=number_slider_65, Z=Slider(2, range=0..20))
center_box_53 = CenterBox(Base=point_139, X=number_slider_68, Y=number_slider_68, Z=Slider(2, range=0..20))
center_box_54 = CenterBox(Base=point_138, X=number_slider_67, Y=number_slider_67, Z=Slider(2, range=0..20))
center_box_55 = CenterBox(Base=point_140, X=number_slider_69, Y=number_slider_69, Z=Slider(2, range=0..20))
colour_swatch_9 = ColourSwatch(SwatchColor=RGB(158, 233, 236))
center_box_56 = CenterBox(Base=point_141, X=number_slider_70, Y=number_slider_70, Z=Slider(2, range=0..20))
colour_swatch_10 = ColourSwatch(SwatchColor=RGB(158, 233, 236))
center_box_57 = CenterBox(Base=point_143, X=number_slider_72, Y=number_slider_72, Z=Slider(2, range=0..20))
point_163 = Point(ghpython_script_37.educationpoints)
center_box_58 = CenterBox(Base=point_142, X=number_slider_71, Y=number_slider_71, Z=Slider(2, range=0..20))
center_box_59 = CenterBox(Base=point_144, X=number_slider_73, Y=number_slider_73, Z=Slider(2, range=0..20))
colour_swatch_11 = ColourSwatch(SwatchColor=RGB(158, 233, 236))
colour_swatch_12 = ColourSwatch(SwatchColor=RGB(158, 233, 236))
colour_swatch_13 = ColourSwatch(SwatchColor=RGB(163, 64, 155))
colour_swatch_14 = ColourSwatch(SwatchColor=RGB(135, 101, 193))
colour_swatch_15 = ColourSwatch(SwatchColor=RGB(163, 64, 155))
colour_swatch_16 = ColourSwatch(SwatchColor=RGB(135, 101, 193))
center_box_60 = CenterBox(Base=point_146, X=number_slider_75, Y=number_slider_75, Z=Slider(2, range=0..20))
center_box_61 = CenterBox(Base=point_145, X=number_slider_74, Y=number_slider_74, Z=Slider(2, range=0..20))
colour_swatch_17 = ColourSwatch(SwatchColor=RGB(158, 233, 236))
center_box_62 = CenterBox(Base=point_147, X=number_slider_76, Y=number_slider_76, Z=Slider(2, range=0..20))
colour_swatch_18 = ColourSwatch(SwatchColor=RGB(163, 64, 155))
colour_swatch_19 = ColourSwatch(SwatchColor=RGB(135, 101, 193))
colour_swatch_20 = ColourSwatch(SwatchColor=RGB(163, 64, 155))
colour_swatch_21 = ColourSwatch(SwatchColor=RGB(135, 101, 193))
colour_swatch_22 = ColourSwatch(SwatchColor=RGB(233, 189, 205))
colour_swatch_23 = ColourSwatch(SwatchColor=RGB(233, 189, 205))
colour_swatch_24 = ColourSwatch(SwatchColor=RGB(163, 64, 155))
colour_swatch_25 = ColourSwatch(SwatchColor=RGB(135, 101, 193))
center_box_63 = CenterBox(Base=point_148, X=number_slider_77, Y=number_slider_77, Z=Slider(2, range=0..20))
colour_swatch_26 = ColourSwatch(SwatchColor=RGB(51, 177, 255))
colour_swatch_27 = ColourSwatch(SwatchColor=RGB(233, 189, 205))
number_slider_93 = Slider(5, range=0..20)
colour_swatch_28 = ColourSwatch(SwatchColor=RGB(233, 189, 205))
colour_swatch_29 = ColourSwatch(SwatchColor=RGB(233, 189, 205))
center_box_64 = CenterBox(Base=point_149, X=number_slider_78, Y=number_slider_78, Z=Slider(2, range=0..20))
number_slider_94 = Slider(5, range=0..20)
number_slider_95 = Slider(5, range=0..20)
colour_swatch_30 = ColourSwatch(SwatchColor=RGB(51, 177, 255))
list_length_70 = ListLength(List=center_box)
center_box_65 = CenterBox(Base=point_150, X=number_slider_79, Y=number_slider_79, Z=Slider(2, range=0..20))
colour_swatch_31 = ColourSwatch(SwatchColor=RGB(217, 131, 255))
number_slider_96 = Slider(5, range=0..20)
list_length_71 = ListLength(List=center_box_2)
list_length_72 = ListLength(List=center_box_3)
center_box_66 = CenterBox(Base=point_151, X=number_slider_80, Y=number_slider_80, Z=Slider(2, range=0..20))
center_box_67 = CenterBox(Base=point_152, X=number_slider_81, Y=number_slider_81, Z=Slider(2, range=0..20))
colour_swatch_32 = ColourSwatch(SwatchColor=RGB(158, 233, 236))
list_length_73 = ListLength(List=center_box_4)
list_length_74 = ListLength(List=center_box_5)
colour_swatch_33 = ColourSwatch(SwatchColor=RGB(255, 0, 0))
list_length_75 = ListLength(List=center_box_6)
list_length_76 = ListLength(List=center_box_7)
center_box_68 = CenterBox(Base=point_153, X=number_slider_82, Y=number_slider_82, Z=Slider(2, range=0..20))
colour_swatch_34 = ColourSwatch(SwatchColor=RGB(163, 64, 155))
colour_swatch_35 = ColourSwatch(SwatchColor=RGB(135, 101, 193))
center_box_69 = CenterBox(Base=point_154, X=number_slider_83, Y=number_slider_83, Z=Slider(2, range=0..20))
list_length_77 = ListLength(List=center_box_8)
colour_swatch_36 = ColourSwatch(SwatchColor=RGB(158, 233, 236))
center_box_70 = CenterBox(Base=point_155, X=number_slider_84, Y=number_slider_84, Z=Slider(2, range=0..20))
colour_swatch_37 = ColourSwatch(SwatchColor=RGB(233, 189, 205))
colour_swatch_38 = ColourSwatch(SwatchColor=RGB(158, 233, 236))
colour_swatch_39 = ColourSwatch(SwatchColor=RGB(163, 64, 155))
center_box_71 = CenterBox(Base=point_156, X=number_slider_85, Y=number_slider_85, Z=Slider(2, range=0..20))
colour_swatch_40 = ColourSwatch(SwatchColor=RGB(135, 101, 193))
colour_swatch_41 = ColourSwatch(SwatchColor=RGB(51, 177, 255))
colour_swatch_42 = ColourSwatch(SwatchColor=RGB(51, 177, 255))
list_length_78 = ListLength(List=center_box_32)
colour_swatch_43 = ColourSwatch(SwatchColor=RGB(158, 233, 236))
center_box_72 = CenterBox(Base=point_157, X=number_slider_86, Y=number_slider_86, Z=Slider(2, range=0..20))
colour_swatch_44 = ColourSwatch(SwatchColor=RGB(163, 64, 155))
colour_swatch_45 = ColourSwatch(SwatchColor=RGB(135, 101, 193))
colour_swatch_46 = ColourSwatch(SwatchColor=RGB(51, 177, 255))
colour_swatch_47 = ColourSwatch(SwatchColor=RGB(233, 189, 205))
colour_swatch_48 = ColourSwatch(SwatchColor=RGB(51, 177, 255))
point_164 = Point(ghpython_script_43.restaurantpoints)
colour_swatch_49 = ColourSwatch(SwatchColor=RGB(163, 64, 155))
colour_swatch_50 = ColourSwatch(SwatchColor=RGB(135, 101, 193))
list_length_79 = ListLength(List=center_box_9)
list_length_80 = ListLength(List=center_box_10)
colour_swatch_51 = ColourSwatch(SwatchColor=RGB(233, 189, 205))
colour_swatch_52 = ColourSwatch(SwatchColor=RGB(255, 0, 0))
colour_swatch_53 = ColourSwatch(SwatchColor=RGB(217, 131, 255))
point_165 = Point(ghpython_script_43.officepoints)
point_166 = Point(ghpython_script_43.marketpoints)
list_length_81 = ListLength(List=center_box_11)
list_length_82 = ListLength(List=center_box_14)
center_box_73 = CenterBox(Base=point_158, X=number_slider_87, Y=number_slider_87, Z=Slider(2, range=0..20))
list_length_83 = ListLength(List=center_box_12)
list_length_84 = ListLength(List=center_box_15)
list_length_85 = ListLength(List=center_box_16)
list_length_86 = ListLength(List=center_box_13)
colour_swatch_54 = ColourSwatch(SwatchColor=RGB(233, 189, 205))
colour_swatch_55 = ColourSwatch(SwatchColor=RGB(217, 131, 255))
colour_swatch_56 = ColourSwatch(SwatchColor=RGB(255, 0, 0))
number_slider_97 = Slider(5, range=0..20)
list_length_87 = ListLength(List=center_box_17)
colour_swatch_57 = ColourSwatch(SwatchColor=RGB(217, 131, 255))
list_length_88 = ListLength(List=center_box_22)
point_167 = Point(ghpython_script_43.residencepoints)
list_length_89 = ListLength(List=center_box_18)
list_length_90 = ListLength(List=center_box_20)
center_box_74 = CenterBox(Base=point_159, X=number_slider_88, Y=number_slider_88, Z=Slider(2, range=0..20))
list_length_91 = ListLength(List=center_box_24)
list_length_92 = ListLength(List=center_box_19)
list_length_93 = ListLength(List=center_box_21)
center_box_75 = CenterBox(Base=point_160, X=number_slider_89, Y=number_slider_89, Z=Slider(2, range=0..20))
list_length_94 = ListLength(List=center_box_23)
list_length_95 = ListLength(List=center_box_25)
list_length_96 = ListLength(List=center_box_27)
list_length_97 = ListLength(List=center_box_28)
list_length_98 = ListLength(List=center_box_29)
center_box_76 = CenterBox(Base=point_161, X=number_slider_90, Y=number_slider_90, Z=Slider(2, range=0..20))
number_slider_98 = Slider(5, range=0..20)
list_length_99 = ListLength(List=center_box_36)
colour_swatch_58 = ColourSwatch(SwatchColor=RGB(51, 177, 255))
list_length_100 = ListLength(List=center_box_31)
list_length_101 = ListLength(List=center_box_61)
list_length_102 = ListLength(List=center_box_33)
list_length_103 = ListLength(List=center_box_34)
list_length_104 = ListLength(List=center_box_35)
list_length_105 = ListLength(List=center_box_37)
list_length_106 = ListLength(List=center_box_57)
colour_swatch_59 = ColourSwatch(SwatchColor=RGB(51, 177, 255))
colour_swatch_60 = ColourSwatch(SwatchColor=RGB(217, 131, 255))
list_length_107 = ListLength(List=center_box_38)
list_length_108 = ListLength(List=center_box_39)
list_length_109 = ListLength(List=center_box_62)
colour_swatch_61 = ColourSwatch(SwatchColor=RGB(51, 177, 255))
list_length_110 = ListLength(List=center_box_58)
list_length_111 = ListLength(List=center_box_41)
list_length_112 = ListLength(List=center_box_60)
list_length_113 = ListLength(List=center_box_40)
colour_swatch_62 = ColourSwatch(SwatchColor=RGB(51, 177, 255))
colour_swatch_63 = ColourSwatch(SwatchColor=RGB(217, 131, 255))
point_168 = Point(ghpython_script_43.voidpoints)
list_length_114 = ListLength(List=center_box_42)
list_length_115 = ListLength(List=center_box_44)
list_length_116 = ListLength(List=center_box_43)
colour_swatch_64 = ColourSwatch(SwatchColor=RGB(217, 131, 255))
list_length_117 = ListLength(List=center_box_52)
list_length_118 = ListLength(List=center_box_47)
list_length_119 = ListLength(List=center_box_48)
list_length_120 = ListLength(List=center_box_49)
colour_swatch_65 = ColourSwatch(SwatchColor=RGB(217, 131, 255))
center_box_77 = CenterBox(Base=point_162, X=number_slider_91, Y=number_slider_91, Z=Slider(2, range=0..20))
list_length_121 = ListLength(List=center_box_53)
list_length_122 = ListLength(List=center_box_55)
list_length_123 = ListLength(List=center_box_56)
list_length_124 = ListLength(List=center_box_65)
point_169 = Point(ghpython_script_43.educationpoints)
list_length_125 = ListLength(List=center_box_59)
list_length_126 = ListLength(List=center_box_67)
colour_swatch_66 = ColourSwatch(SwatchColor=RGB(158, 233, 236))
center_box_78 = CenterBox(Base=point_163, X=number_slider_92, Y=number_slider_92, Z=Slider(2, range=0..20))
list_length_127 = ListLength(List=center_box_71)
colour_swatch_67 = ColourSwatch(SwatchColor=RGB(163, 64, 155))
colour_swatch_68 = ColourSwatch(SwatchColor=RGB(135, 101, 193))
list_length_128 = ListLength(List=center_box_70)
colour_swatch_69 = ColourSwatch(SwatchColor=RGB(233, 189, 205))
list_length_129 = ListLength(List=center_box_72)
colour_swatch_70 = ColourSwatch(SwatchColor=RGB(51, 177, 255))
center_box_79 = CenterBox(Base=point_164, X=number_slider_93, Y=number_slider_93, Z=Slider(2, range=0..20))
list_length_130 = ListLength(List=center_box_73)
center_box_80 = CenterBox(Base=point_165, X=number_slider_94, Y=number_slider_94, Z=Slider(2, range=0..20))
center_box_81 = CenterBox(Base=point_166, X=number_slider_95, Y=number_slider_95, Z=Slider(2, range=0..20))
colour_swatch_71 = ColourSwatch(SwatchColor=RGB(255, 0, 0))
list_length_131 = ListLength(List=center_box_74)
list_length_132 = ListLength(List=center_box_75)
center_box_82 = CenterBox(Base=point_167, X=number_slider_96, Y=number_slider_96, Z=Slider(2, range=0..20))
list_length_133 = ListLength(List=center_box_76)
list_length_134 = ListLength(List=center_box_78)
center_box_83 = CenterBox(Base=point_168, X=number_slider_97, Y=number_slider_97, Z=Slider(2, range=0..20))
center_box_84 = CenterBox(Base=point_169, X=number_slider_98, Y=number_slider_98, Z=Slider(2, range=0..20))
colour_swatch_72 = ColourSwatch(SwatchColor=RGB(158, 233, 236))
colour_swatch_73 = ColourSwatch(SwatchColor=RGB(163, 64, 155))
colour_swatch_74 = ColourSwatch(SwatchColor=RGB(135, 101, 193))
colour_swatch_75 = ColourSwatch(SwatchColor=RGB(233, 189, 205))
colour_swatch_76 = ColourSwatch(SwatchColor=RGB(51, 177, 255))
list_length_135 = ListLength(List=center_box_79)
colour_swatch_77 = ColourSwatch(SwatchColor=RGB(217, 131, 255))
list_length_136 = ListLength(List=center_box_80)
list_length_137 = ListLength(List=center_box_81)
list_length_138 = ListLength(List=center_box_82)
ghpython_script_45 = GhPythonScript(office=list_length_71, restaurant=list_length_70, market=list_length_72, residence=list_length_74)  # -> out, o, rest, m, resi
# ---------- ghpython_script_45: Python ----------
__author__ = "laoma"
__version__ = "2022.03.16"

import rhinoscriptsyntax as rs
sum=office+restaurant+market+residence
o='office:{0}%'.format('%.2f' %(office/sum*100))
rest='restaurant:{0}%'.format('%.2f' %(restaurant/sum*100))
m='market:{0}%'.format('%.2f' %(market/sum*100))
resi='residence:{0}%'.format('%.2f' %(residence/sum*100))
# ---------- end ghpython_script_45 ----------
list_length_139 = ListLength(List=center_box_84)
ghpython_script_46 = GhPythonScript(
    office=list_length_75,
    restaurant=list_length_73,
    market=list_length_76,
    residence=list_length_77,
    education=list_length_99)  # -> out, o, rest, m, resi, edu
# ---------- ghpython_script_46: Python ----------
__author__ = "laoma"
__version__ = "2022.03.16"

import rhinoscriptsyntax as rs
sum=office+restaurant+market+residence+education
o='office:{0}%'.format('%.2f' %(office/sum*100))
rest='restaurant:{0}%'.format('%.2f' %(restaurant/sum*100))
m='market:{0}%'.format('%.2f' %(market/sum*100))
resi='residence:{0}%'.format('%.2f' %(residence/sum*100))
edu='education:{0}%'.format('%.2f' %(education/sum*100))
# ---------- end ghpython_script_46 ----------
ghpython_script_47 = GhPythonScript(origin=list_length, now=list_length_71)  # -> out, a
# ---------- ghpython_script_47: Python ----------
__author__ = "laoma"
__version__ = "2022.03.17"

import rhinoscriptsyntax as rs
a='office change:{0}%'.format('%.2f' %((now-origin)/origin*100))
# ---------- end ghpython_script_47 ----------
ghpython_script_48 = GhPythonScript(origin=list_length_6, now=list_length_75)  # -> out, a; same code as ghpython_script_47
ghpython_script_49 = GhPythonScript(office=list_length_81, restaurant=list_length_79, market=list_length_82, residence=list_length_88)  # -> out, o, rest, m, resi; same code as ghpython_script_45
ghpython_script_50 = GhPythonScript(office=list_length_84, restaurant=list_length_80, market=list_length_85, residence=list_length_91)  # -> out, o, rest, m, resi; same code as ghpython_script_45
ghpython_script_51 = GhPythonScript(
    office=list_length_89,
    restaurant=list_length_83,
    market=list_length_90,
    residence=list_length_96,
    education=list_length_112)  # -> out, o, rest, m, resi, edu; same code as ghpython_script_46
ghpython_script_52 = GhPythonScript(office=list_length_92, restaurant=list_length_86, market=list_length_93, residence=list_length_97)  # -> out, o, rest, m, resi; same code as ghpython_script_45
ghpython_script_53 = GhPythonScript(office=list_length_94, restaurant=list_length_87, market=list_length_95, residence=list_length_98)  # -> out, o, rest, m, resi; same code as ghpython_script_45
ghpython_script_54 = GhPythonScript(origin=list_length_12, now=list_length_81)  # -> out, a; same code as ghpython_script_47
ghpython_script_55 = GhPythonScript(origin=list_length_13, now=list_length_84)  # -> out, a; same code as ghpython_script_47
ghpython_script_56 = GhPythonScript(origin=list_length_21, now=list_length_89)  # -> out, a; same code as ghpython_script_47
ghpython_script_57 = GhPythonScript(origin=list_length_22, now=list_length_92)  # -> out, a; same code as ghpython_script_47
ghpython_script_58 = GhPythonScript(origin=list_length_24, now=list_length_94)  # -> out, a; same code as ghpython_script_47
custom_preview = CustomPreview(Geometry=center_box_54, Material=ColourSwatch(SwatchColor=RGB(51, 177, 255)))
ghpython_script_59 = GhPythonScript(office=list_length_102, restaurant=list_length_100, market=list_length_103, residence=list_length_105)  # -> out, o, rest, m, resi; same code as ghpython_script_45
ghpython_script_60 = GhPythonScript(office=list_length_107, restaurant=list_length_104, market=list_length_108, residence=list_length_111)  # -> out, o, rest, m, resi; same code as ghpython_script_45
ghpython_script_61 = GhPythonScript(origin=list_length_57, now=list_length_102)  # -> out, a; same code as ghpython_script_47
ghpython_script_62 = GhPythonScript(origin=list_length_36, now=list_length_107)  # -> out, a; same code as ghpython_script_47
ghpython_script_63 = GhPythonScript(office=list_length_114, restaurant=list_length_113, market=list_length_115, residence=list_length_117)  # -> out, o, rest, m, resi; same code as ghpython_script_45
colour_swatch_78 = ColourSwatch(SwatchColor=RGB(191, 65, 155))
custom_preview_2 = CustomPreview(Geometry=center_box_2, Material=colour_swatch_78)
custom_preview_3 = CustomPreview(Geometry=center_box_6, Material=colour_swatch_78)
custom_preview_4 = CustomPreview(Geometry=center_box_11, Material=colour_swatch_78)
custom_preview_5 = CustomPreview(Geometry=center_box_15, Material=colour_swatch_78)
custom_preview_6 = CustomPreview(Geometry=center_box_18, Material=colour_swatch_78)
custom_preview_7 = CustomPreview(Geometry=center_box_19, Material=colour_swatch_78)
custom_preview_8 = CustomPreview(Geometry=center_box_23, Material=colour_swatch_78)
custom_preview_9 = CustomPreview(Geometry=center_box_33, Material=colour_swatch_78)
custom_preview_10 = CustomPreview(Geometry=center_box_38, Material=colour_swatch_78)
custom_preview_11 = CustomPreview(Geometry=center_box_42, Material=colour_swatch_78)
custom_preview_12 = CustomPreview(Geometry=center_box_48, Material=colour_swatch_78)
custom_preview_13 = CustomPreview(Geometry=center_box_53, Material=colour_swatch_78)
custom_preview_14 = CustomPreview(Geometry=center_box_74, Material=colour_swatch_78)
custom_preview_15 = CustomPreview(Geometry=center_box_80, Material=colour_swatch_78)
colour_swatch_79 = ColourSwatch(SwatchColor=RGB(135, 101, 194))
custom_preview_16 = CustomPreview(Geometry=center_box_3, Material=colour_swatch_79)
custom_preview_17 = CustomPreview(Geometry=center_box_7, Material=colour_swatch_79)
custom_preview_18 = CustomPreview(Geometry=center_box_14, Material=colour_swatch_79)
custom_preview_19 = CustomPreview(Geometry=center_box_16, Material=colour_swatch_79)
custom_preview_20 = CustomPreview(Geometry=center_box_20, Material=colour_swatch_79)
custom_preview_21 = CustomPreview(Geometry=center_box_21, Material=colour_swatch_79)
custom_preview_22 = CustomPreview(Geometry=center_box_25, Material=colour_swatch_79)
custom_preview_23 = CustomPreview(Geometry=center_box_34, Material=colour_swatch_79)
custom_preview_24 = CustomPreview(Geometry=center_box_39, Material=colour_swatch_79)
custom_preview_25 = CustomPreview(Geometry=center_box_44, Material=colour_swatch_79)
custom_preview_26 = CustomPreview(Geometry=center_box_49, Material=colour_swatch_79)
custom_preview_27 = CustomPreview(Geometry=center_box_55, Material=colour_swatch_79)
custom_preview_28 = CustomPreview(Geometry=center_box_75, Material=colour_swatch_79)
custom_preview_29 = CustomPreview(Geometry=center_box_81, Material=colour_swatch_79)
colour_swatch_80 = ColourSwatch(SwatchColor=RGB(104, 228, 237))
custom_preview_30 = CustomPreview(Geometry=center_box, Material=colour_swatch_80)
custom_preview_31 = CustomPreview(Geometry=center_box_4, Material=colour_swatch_80)
custom_preview_32 = CustomPreview(Geometry=center_box_9, Material=colour_swatch_80)
custom_preview_33 = CustomPreview(Geometry=center_box_10, Material=colour_swatch_80)
custom_preview_34 = CustomPreview(Geometry=center_box_12, Material=colour_swatch_80)
custom_preview_35 = CustomPreview(Geometry=center_box_13, Material=colour_swatch_80)
custom_preview_36 = CustomPreview(Geometry=center_box_17, Material=colour_swatch_80)
custom_preview_37 = CustomPreview(Geometry=center_box_31, Material=colour_swatch_80)
custom_preview_38 = CustomPreview(Geometry=center_box_35, Material=colour_swatch_80)
custom_preview_39 = CustomPreview(Geometry=center_box_40, Material=colour_swatch_80)
custom_preview_40 = CustomPreview(Geometry=center_box_43, Material=colour_swatch_80)
custom_preview_41 = CustomPreview(Geometry=center_box_47, Material=colour_swatch_80)
custom_preview_42 = CustomPreview(Geometry=center_box_73, Material=colour_swatch_80)
custom_preview_43 = CustomPreview(Geometry=center_box_79, Material=colour_swatch_80)
colour_swatch_81 = ColourSwatch(SwatchColor=RGB(255, 176, 5))
custom_preview_44 = CustomPreview(Geometry=center_box_5, Material=colour_swatch_81)
custom_preview_45 = CustomPreview(Geometry=center_box_8, Material=colour_swatch_81)
custom_preview_46 = CustomPreview(Geometry=center_box_22, Material=colour_swatch_81)
custom_preview_47 = CustomPreview(Geometry=center_box_24, Material=colour_swatch_81)
custom_preview_48 = CustomPreview(Geometry=center_box_27, Material=colour_swatch_81)
custom_preview_49 = CustomPreview(Geometry=center_box_28, Material=colour_swatch_81)
custom_preview_50 = CustomPreview(Geometry=center_box_37, Material=colour_swatch_81)
custom_preview_51 = CustomPreview(Geometry=center_box_41, Material=colour_swatch_81)
custom_preview_52 = CustomPreview(Geometry=center_box_52, Material=colour_swatch_81)
custom_preview_53 = CustomPreview(Geometry=center_box_56, Material=colour_swatch_81)
custom_preview_54 = CustomPreview(Geometry=center_box_59, Material=colour_swatch_81)
custom_preview_55 = CustomPreview(Geometry=center_box_76, Material=colour_swatch_81)
custom_preview_56 = CustomPreview(Geometry=center_box_82, Material=colour_swatch_81)
ghpython_script_64 = GhPythonScript(office=list_length_119, restaurant=list_length_116, market=list_length_120, residence=list_length_123)  # -> out, o, rest, m, resi; same code as ghpython_script_45
colour_swatch_82 = ColourSwatch(SwatchColor=RGB(5, 145, 232))
custom_preview_57 = CustomPreview(Geometry=center_box_32, Material=colour_swatch_82)
custom_preview_58 = CustomPreview(Geometry=center_box_29, Material=colour_swatch_82)
custom_preview_59 = CustomPreview(Geometry=center_box_36, Material=colour_swatch_82)
custom_preview_60 = CustomPreview(Geometry=center_box_57, Material=colour_swatch_82)
custom_preview_61 = CustomPreview(Geometry=center_box_58, Material=colour_swatch_82)
custom_preview_62 = CustomPreview(Geometry=center_box_60, Material=colour_swatch_82)
custom_preview_63 = CustomPreview(Geometry=center_box_61, Material=colour_swatch_82)
custom_preview_64 = CustomPreview(Geometry=center_box_65, Material=colour_swatch_82)
custom_preview_65 = CustomPreview(Geometry=center_box_67, Material=colour_swatch_82)
custom_preview_66 = CustomPreview(Geometry=center_box_70, Material=colour_swatch_82)
custom_preview_67 = CustomPreview(Geometry=center_box_71, Material=colour_swatch_82)
custom_preview_68 = CustomPreview(Geometry=center_box_72, Material=colour_swatch_82)
custom_preview_69 = CustomPreview(Geometry=center_box_78, Material=colour_swatch_82)
custom_preview_70 = CustomPreview(Geometry=center_box_84, Material=colour_swatch_82)
ghpython_script_65 = GhPythonScript(office=list_length_121, restaurant=list_length_118, market=list_length_122, residence=list_length_125)  # -> out, o, rest, m, resi; same code as ghpython_script_45
colour_swatch_83 = ColourSwatch(SwatchColor=RGB(40, 184, 0))
custom_preview_71 = CustomPreview(Geometry=center_box_62, Material=colour_swatch_83)
custom_preview_72 = CustomPreview(Geometry=center_box_26, Material=colour_swatch_83)
custom_preview_73 = CustomPreview(Geometry=center_box_30, Material=colour_swatch_83)
custom_preview_74 = CustomPreview(Geometry=center_box_45, Material=colour_swatch_83)
custom_preview_75 = CustomPreview(Geometry=center_box_46, Material=colour_swatch_83)
custom_preview_76 = CustomPreview(Geometry=center_box_50, Material=colour_swatch_83)
custom_preview_77 = CustomPreview(Geometry=center_box_51, Material=colour_swatch_83)
custom_preview_78 = CustomPreview(Geometry=center_box_63, Material=colour_swatch_83)
custom_preview_79 = CustomPreview(Geometry=center_box_64, Material=colour_swatch_83)
ghpython_script_66 = GhPythonScript(origin=list_length_41, now=list_length_114)  # -> out, a; same code as ghpython_script_47
custom_preview_80 = CustomPreview(Geometry=center_box_66, Material=colour_swatch_83)
ghpython_script_67 = GhPythonScript(origin=list_length_46, now=list_length_119)  # -> out, a; same code as ghpython_script_47
custom_preview_81 = CustomPreview(Geometry=center_box_68, Material=colour_swatch_83)
ghpython_script_68 = GhPythonScript(origin=list_length_50, now=list_length_121)  # -> out, a; same code as ghpython_script_47
custom_preview_82 = CustomPreview(Geometry=center_box_69, Material=colour_swatch_83)
panel_70 = Panel(ghpython_script_45.o)
panel_71 = Panel(ghpython_script_45.m)
panel_72 = Panel(ghpython_script_45.resi)
panel_73 = Panel(ghpython_script_47.a)
panel_74 = Panel(ghpython_script_45.rest)
panel_75 = Panel(ghpython_script_46.o)
panel_76 = Panel(ghpython_script_46.m)
panel_77 = Panel(ghpython_script_46.resi)
panel_78 = Panel(ghpython_script_46.rest)
panel_79 = Panel(ghpython_script_48.a)
panel_80 = Panel(ghpython_script_46.edu)
panel_81 = Panel(ghpython_script_50.o)
panel_82 = Panel(ghpython_script_50.m)
panel_83 = Panel(ghpython_script_50.resi)
panel_84 = Panel(ghpython_script_55.a)
panel_85 = Panel(ghpython_script_49.o)
panel_86 = Panel(ghpython_script_49.m)
panel_87 = Panel(ghpython_script_49.resi)
panel_88 = Panel(ghpython_script_54.a)
panel_89 = Panel(ghpython_script_50.rest)
panel_90 = Panel(ghpython_script_49.rest)
panel_91 = Panel(ghpython_script_52.o)
panel_92 = Panel(ghpython_script_52.m)
panel_93 = Panel(ghpython_script_52.resi)
panel_94 = Panel(ghpython_script_57.a)
panel_95 = Panel(ghpython_script_51.o)
panel_96 = Panel(ghpython_script_51.m)
panel_97 = Panel(ghpython_script_51.resi)
panel_98 = Panel(ghpython_script_52.rest)
panel_99 = Panel(ghpython_script_51.rest)
panel_100 = Panel(ghpython_script_56.a)
panel_101 = Panel(ghpython_script_51.edu)
panel_102 = Panel(ghpython_script_53.o)
panel_103 = Panel(ghpython_script_53.m)
panel_104 = Panel(ghpython_script_53.resi)
panel_105 = Panel(ghpython_script_58.a)
panel_106 = Panel(ghpython_script_53.rest)
ghpython_script_69 = GhPythonScript(office=list_length_131, restaurant=list_length_130, market=list_length_132, residence=list_length_133)  # -> out, o, rest, m, resi; same code as ghpython_script_45
panel_107 = Panel(ghpython_script_59.o)
panel_108 = Panel(ghpython_script_59.m)
panel_109 = Panel(ghpython_script_59.resi)
panel_110 = Panel(ghpython_script_61.a)
panel_111 = Panel(ghpython_script_59.rest)
panel_112 = Panel(ghpython_script_60.o)
panel_113 = Panel(ghpython_script_60.m)
panel_114 = Panel(ghpython_script_60.resi)
panel_115 = Panel(ghpython_script_62.a)
ghpython_script_70 = GhPythonScript(origin=list_length_60, now=list_length_131)  # -> out, a; same code as ghpython_script_47
panel_116 = Panel(ghpython_script_60.rest)
custom_preview_83 = CustomPreview(Geometry=center_box_77, Material=colour_swatch_83)
panel_117 = Panel(ghpython_script_63.o)
panel_118 = Panel(ghpython_script_63.resi)
panel_119 = Panel(ghpython_script_63.m)
panel_120 = Panel(ghpython_script_66.a)
panel_121 = Panel(ghpython_script_63.rest)
panel_122 = Panel(ghpython_script_64.o)
panel_123 = Panel(ghpython_script_64.m)
panel_124 = Panel(ghpython_script_64.resi)
panel_125 = Panel(ghpython_script_67.a)
panel_126 = Panel(ghpython_script_64.rest)
panel_127 = Panel(ghpython_script_65.o)
panel_128 = Panel(ghpython_script_65.m)
panel_129 = Panel(ghpython_script_65.resi)
panel_130 = Panel(ghpython_script_68.a)
panel_131 = Panel(ghpython_script_65.rest)
panel_132 = Panel(ghpython_script_69.o)
panel_133 = Panel(ghpython_script_69.m)
panel_134 = Panel(ghpython_script_69.resi)
panel_135 = Panel(ghpython_script_70.a)
panel_136 = Panel(ghpython_script_69.rest)
ghpython_script_71 = GhPythonScript(office=list_length_136, restaurant=list_length_135, market=list_length_137, residence=list_length_138)  # -> out, o, rest, m, resi; same code as ghpython_script_45
ghpython_script_72 = GhPythonScript(origin=list_length_65, now=list_length_136)  # -> out, a; same code as ghpython_script_47
custom_preview_84 = CustomPreview(Geometry=center_box_83, Material=colour_swatch_83)
addition = Addition(A=list_length_105)
ghpython_script_73 = GhPythonScript()  # -> Out, A
addition_2 = Addition(A=list_length_124)
panel_137 = Panel(ghpython_script_71.o)
panel_138 = Panel(ghpython_script_71.m)
panel_139 = Panel(ghpython_script_71.resi)
panel_140 = Panel(ghpython_script_72.a)
panel_141 = Panel(ghpython_script_71.rest)
addition_3 = Addition(A=list_length_100)
addition_4 = Addition(A=list_length_102)
addition_5 = Addition(A=list_length_103)

deconstruct_86 = Deconstruct(Point=point_151)  # -> XComponent, YComponent, ZComponent; disabled
number_slider_99 = Slider(2, range=0..20)  # disabled
number_slider_100 = Slider(5, range=0..20)  # disabled
ghpython_script_74 = GhPythonScript(x=deconstruct_86.XComponent, y=deconstruct_86.YComponent, z=deconstruct_86.ZComponent)  # -> out, storagepoint, point1, point2; inputs x: list, y: list, z: list; disabled
# ---------- ghpython_script_74: Python ----------
__author__ = "laoma"
__version__ = "2022.03.22"

import rhinoscriptsyntax as rs
import Rhino.Geometry as rg
from random import sample
zmin=min(z)
a=(zmin-2)/4
b=a%4
storage=[]
others=[]
for i,j,k in zip(x,y,z):
    if ((k-2)/4)%4==b:
        storage.append((i,j,k))
    else:
        others.append((i,j,k))
color1=sample(others, int(len(others)/2))
color2=others[:]
for i in color1:
    color2.remove(i)

storagepoint=[]
point1=[]
point2=[]
for p in storage:
    point3d=rg.Point3d(int(p[0]),int(p[1]),int(p[2]))
    storagepoint.append(point3d)
for p in color1:
    point3d=rg.Point3d(int(p[0]),int(p[1]),int(p[2]))
    point1.append(point3d)
for p in color2:
    point3d=rg.Point3d(int(p[0]),int(p[1]),int(p[2]))
    point2.append(point3d)
# ---------- end ghpython_script_74 ----------
number_slider_101 = Slider(2, range=0..20)  # disabled
number_slider_102 = Slider(5, range=0..20)  # disabled
number_slider_103 = Slider(2, range=0..20)  # disabled
number_slider_104 = Slider(5, range=0..20)  # disabled
point_170 = Point(ghpython_script_74.storagepoint)  # disabled
point_171 = Point(ghpython_script_74.point1)  # disabled
point_172 = Point(ghpython_script_74.point2)  # disabled
center_box_85 = CenterBox(Base=point_170, X=number_slider_100, Y=number_slider_100, Z=number_slider_99)  # disabled
center_box_86 = CenterBox(Base=point_171, X=number_slider_102, Y=number_slider_102, Z=number_slider_101)  # disabled
center_box_87 = CenterBox(Base=point_172, X=number_slider_104, Y=number_slider_104, Z=number_slider_103)  # disabled
colour_swatch_84 = ColourSwatch(SwatchColor=RGB(233, 189, 205))  # disabled
colour_swatch_85 = ColourSwatch(SwatchColor=RGB(217, 131, 255))  # disabled
custom_preview_85 = CustomPreview(Geometry=center_box_86, Material=colour_swatch_85)  # disabled
colour_swatch_86 = ColourSwatch(SwatchColor=RGB(51, 177, 255))  # disabled
custom_preview_86 = CustomPreview(Geometry=center_box_87, Material=colour_swatch_86)  # disabled
custom_preview_87 = CustomPreview(Geometry=center_box_85, Material=colour_swatch_84)  # disabled

deconstruct_87 = Deconstruct(Point=point_131)  # -> XComponent, YComponent, ZComponent; disabled
number_slider_105 = Slider(2, range=0..20)  # disabled
number_slider_106 = Slider(5, range=0..20)  # disabled
ghpython_script_75 = GhPythonScript(x=deconstruct_87.XComponent, y=deconstruct_87.YComponent, z=deconstruct_87.ZComponent)  # -> out, storagepoint, point1, point2; inputs x: list, y: list, z: list; disabled; same code as ghpython_script_74
number_slider_107 = Slider(2, range=0..20)  # disabled
number_slider_108 = Slider(5, range=0..20)  # disabled
number_slider_109 = Slider(2, range=0..20)  # disabled
number_slider_110 = Slider(5, range=0..20)  # disabled
point_173 = Point(ghpython_script_75.storagepoint)  # disabled
point_174 = Point(ghpython_script_75.point1)  # disabled
point_175 = Point(ghpython_script_75.point2)  # disabled
center_box_88 = CenterBox(Base=point_173, X=number_slider_106, Y=number_slider_106, Z=number_slider_105)  # disabled
center_box_89 = CenterBox(Base=point_174, X=number_slider_108, Y=number_slider_108, Z=number_slider_107)  # disabled
center_box_90 = CenterBox(Base=point_175, X=number_slider_110, Y=number_slider_110, Z=number_slider_109)  # disabled
colour_swatch_87 = ColourSwatch(SwatchColor=RGB(233, 189, 205))  # disabled
colour_swatch_88 = ColourSwatch(SwatchColor=RGB(217, 131, 255))  # disabled
custom_preview_88 = CustomPreview(Geometry=center_box_89, Material=colour_swatch_88)  # disabled
colour_swatch_89 = ColourSwatch(SwatchColor=RGB(51, 177, 255))  # disabled
custom_preview_89 = CustomPreview(Geometry=center_box_90, Material=colour_swatch_89)  # disabled
custom_preview_90 = CustomPreview(Geometry=center_box_88, Material=colour_swatch_87)  # disabled

deconstruct_88 = Deconstruct(Point=point_154)  # -> XComponent, YComponent, ZComponent; disabled
number_slider_111 = Slider(2, range=0..20)  # disabled
number_slider_112 = Slider(5, range=0..20)  # disabled
ghpython_script_76 = GhPythonScript(x=deconstruct_88.XComponent, y=deconstruct_88.YComponent, z=deconstruct_88.ZComponent)  # -> out, storagepoint, point1, point2; inputs x: list, y: list, z: list; disabled; same code as ghpython_script_74
number_slider_113 = Slider(2, range=0..20)  # disabled
number_slider_114 = Slider(5, range=0..20)  # disabled
number_slider_115 = Slider(2, range=0..20)  # disabled
number_slider_116 = Slider(5, range=0..20)  # disabled
point_176 = Point(ghpython_script_76.storagepoint)  # disabled
point_177 = Point(ghpython_script_76.point1)  # disabled
point_178 = Point(ghpython_script_76.point2)  # disabled
center_box_91 = CenterBox(Base=point_176, X=number_slider_112, Y=number_slider_112, Z=number_slider_111)  # disabled
center_box_92 = CenterBox(Base=point_177, X=number_slider_114, Y=number_slider_114, Z=number_slider_113)  # disabled
center_box_93 = CenterBox(Base=point_178, X=number_slider_116, Y=number_slider_116, Z=number_slider_115)  # disabled
colour_swatch_90 = ColourSwatch(SwatchColor=RGB(233, 189, 205))  # disabled
colour_swatch_91 = ColourSwatch(SwatchColor=RGB(217, 131, 255))  # disabled
custom_preview_91 = CustomPreview(Geometry=center_box_92, Material=colour_swatch_91)  # disabled
colour_swatch_92 = ColourSwatch(SwatchColor=RGB(51, 177, 255))  # disabled
custom_preview_92 = CustomPreview(Geometry=center_box_93, Material=colour_swatch_92)  # disabled
custom_preview_93 = CustomPreview(Geometry=center_box_91, Material=colour_swatch_90)  # disabled

deconstruct_89 = Deconstruct(Point=point_153)  # -> XComponent, YComponent, ZComponent; disabled
number_slider_117 = Slider(2, range=0..20)  # disabled
number_slider_118 = Slider(5, range=0..20)  # disabled
ghpython_script_77 = GhPythonScript(x=deconstruct_89.XComponent, y=deconstruct_89.YComponent, z=deconstruct_89.ZComponent)  # -> out, storagepoint, point1, point2; inputs x: list, y: list, z: list; disabled; same code as ghpython_script_74
number_slider_119 = Slider(2, range=0..20)  # disabled
number_slider_120 = Slider(5, range=0..20)  # disabled
number_slider_121 = Slider(2, range=0..20)  # disabled
number_slider_122 = Slider(5, range=0..20)  # disabled
point_179 = Point(ghpython_script_77.storagepoint)  # disabled
point_180 = Point(ghpython_script_77.point1)  # disabled
point_181 = Point(ghpython_script_77.point2)  # disabled
center_box_94 = CenterBox(Base=point_179, X=number_slider_118, Y=number_slider_118, Z=number_slider_117)  # disabled
center_box_95 = CenterBox(Base=point_180, X=number_slider_120, Y=number_slider_120, Z=number_slider_119)  # disabled
center_box_96 = CenterBox(Base=point_181, X=number_slider_122, Y=number_slider_122, Z=number_slider_121)  # disabled
colour_swatch_93 = ColourSwatch(SwatchColor=RGB(233, 189, 205))  # disabled
colour_swatch_94 = ColourSwatch(SwatchColor=RGB(217, 131, 255))  # disabled
custom_preview_94 = CustomPreview(Geometry=center_box_95, Material=colour_swatch_94)  # disabled
colour_swatch_95 = ColourSwatch(SwatchColor=RGB(51, 177, 255))  # disabled
custom_preview_95 = CustomPreview(Geometry=center_box_96, Material=colour_swatch_95)  # disabled
custom_preview_96 = CustomPreview(Geometry=center_box_94, Material=colour_swatch_93)  # disabled

deconstruct_90 = Deconstruct(Point=point_149)  # -> XComponent, YComponent, ZComponent; disabled
number_slider_123 = Slider(2, range=0..20)  # disabled
number_slider_124 = Slider(5, range=0..20)  # disabled
ghpython_script_78 = GhPythonScript(x=deconstruct_90.XComponent, y=deconstruct_90.YComponent, z=deconstruct_90.ZComponent)  # -> out, storagepoint, point1, point2; inputs x: list, y: list, z: list; disabled; same code as ghpython_script_74
number_slider_125 = Slider(2, range=0..20)  # disabled
number_slider_126 = Slider(5, range=0..20)  # disabled
number_slider_127 = Slider(2, range=0..20)  # disabled
number_slider_128 = Slider(5, range=0..20)  # disabled
point_182 = Point(ghpython_script_78.storagepoint)  # disabled
point_183 = Point(ghpython_script_78.point1)  # disabled
point_184 = Point(ghpython_script_78.point2)  # disabled
center_box_97 = CenterBox(Base=point_182, X=number_slider_124, Y=number_slider_124, Z=number_slider_123)  # disabled
center_box_98 = CenterBox(Base=point_183, X=number_slider_126, Y=number_slider_126, Z=number_slider_125)  # disabled
center_box_99 = CenterBox(Base=point_184, X=number_slider_128, Y=number_slider_128, Z=number_slider_127)  # disabled
colour_swatch_96 = ColourSwatch(SwatchColor=RGB(233, 189, 205))  # disabled
colour_swatch_97 = ColourSwatch(SwatchColor=RGB(217, 131, 255))  # disabled
custom_preview_97 = CustomPreview(Geometry=center_box_98, Material=colour_swatch_97)  # disabled
colour_swatch_98 = ColourSwatch(SwatchColor=RGB(51, 177, 255))  # disabled
custom_preview_98 = CustomPreview(Geometry=center_box_99, Material=colour_swatch_98)  # disabled
custom_preview_99 = CustomPreview(Geometry=center_box_97, Material=colour_swatch_96)  # disabled

deconstruct_91 = Deconstruct(Point=point_116)  # -> XComponent, YComponent, ZComponent; disabled
number_slider_129 = Slider(2, range=0..20)  # disabled
number_slider_130 = Slider(5, range=0..20)  # disabled
ghpython_script_79 = GhPythonScript(x=deconstruct_91.XComponent, y=deconstruct_91.YComponent, z=deconstruct_91.ZComponent)  # -> out, storagepoint, point1, point2; inputs x: list, y: list, z: list; disabled; same code as ghpython_script_74
number_slider_131 = Slider(2, range=0..20)  # disabled
number_slider_132 = Slider(5, range=0..20)  # disabled
number_slider_133 = Slider(2, range=0..20)  # disabled
number_slider_134 = Slider(5, range=0..20)  # disabled
point_185 = Point(ghpython_script_79.storagepoint)  # disabled
point_186 = Point(ghpython_script_79.point1)  # disabled
point_187 = Point(ghpython_script_79.point2)  # disabled
center_box_100 = CenterBox(Base=point_185, X=number_slider_130, Y=number_slider_130, Z=number_slider_129)  # disabled
center_box_101 = CenterBox(Base=point_186, X=number_slider_132, Y=number_slider_132, Z=number_slider_131)  # disabled
center_box_102 = CenterBox(Base=point_187, X=number_slider_134, Y=number_slider_134, Z=number_slider_133)  # disabled
colour_swatch_99 = ColourSwatch(SwatchColor=RGB(233, 189, 205))  # disabled
colour_swatch_100 = ColourSwatch(SwatchColor=RGB(217, 131, 255))  # disabled
custom_preview_100 = CustomPreview(Geometry=center_box_101, Material=colour_swatch_100)  # disabled
colour_swatch_101 = ColourSwatch(SwatchColor=RGB(51, 177, 255))  # disabled
custom_preview_101 = CustomPreview(Geometry=center_box_102, Material=colour_swatch_101)  # disabled
custom_preview_102 = CustomPreview(Geometry=center_box_100, Material=colour_swatch_99)  # disabled

deconstruct_92 = Deconstruct(Point=point_136)  # -> XComponent, YComponent, ZComponent; disabled
number_slider_135 = Slider(2, range=0..20)  # disabled
number_slider_136 = Slider(5, range=0..20)  # disabled
ghpython_script_80 = GhPythonScript(x=deconstruct_92.XComponent, y=deconstruct_92.YComponent, z=deconstruct_92.ZComponent)  # -> out, storagepoint, point1, point2; inputs x: list, y: list, z: list; disabled; same code as ghpython_script_74
number_slider_137 = Slider(2, range=0..20)  # disabled
number_slider_138 = Slider(5, range=0..20)  # disabled
number_slider_139 = Slider(2, range=0..20)  # disabled
number_slider_140 = Slider(5, range=0..20)  # disabled
point_188 = Point(ghpython_script_80.storagepoint)  # disabled
point_189 = Point(ghpython_script_80.point1)  # disabled
point_190 = Point(ghpython_script_80.point2)  # disabled
center_box_103 = CenterBox(Base=point_188, X=number_slider_136, Y=number_slider_136, Z=number_slider_135)  # disabled
center_box_104 = CenterBox(Base=point_189, X=number_slider_138, Y=number_slider_138, Z=number_slider_137)  # disabled
center_box_105 = CenterBox(Base=point_190, X=number_slider_140, Y=number_slider_140, Z=number_slider_139)  # disabled
colour_swatch_102 = ColourSwatch(SwatchColor=RGB(233, 189, 205))  # disabled
colour_swatch_103 = ColourSwatch(SwatchColor=RGB(217, 131, 255))  # disabled
custom_preview_103 = CustomPreview(Geometry=center_box_104, Material=colour_swatch_103)  # disabled
colour_swatch_104 = ColourSwatch(SwatchColor=RGB(51, 177, 255))  # disabled
custom_preview_104 = CustomPreview(Geometry=center_box_105, Material=colour_swatch_104)  # disabled
custom_preview_105 = CustomPreview(Geometry=center_box_103, Material=colour_swatch_102)  # disabled

deconstruct_93 = Deconstruct(Point=point_162)  # -> XComponent, YComponent, ZComponent; disabled
number_slider_141 = Slider(2, range=0..20)  # disabled
number_slider_142 = Slider(5, range=0..20)  # disabled
ghpython_script_81 = GhPythonScript(x=deconstruct_93.XComponent, y=deconstruct_93.YComponent, z=deconstruct_93.ZComponent)  # -> out, storagepoint, point1, point2; inputs x: list, y: list, z: list; disabled; same code as ghpython_script_74
number_slider_143 = Slider(2, range=0..20)  # disabled
number_slider_144 = Slider(5, range=0..20)  # disabled
number_slider_145 = Slider(2, range=0..20)  # disabled
number_slider_146 = Slider(5, range=0..20)  # disabled
point_191 = Point(ghpython_script_81.storagepoint)  # disabled
point_192 = Point(ghpython_script_81.point1)  # disabled
point_193 = Point(ghpython_script_81.point2)  # disabled
center_box_106 = CenterBox(Base=point_191, X=number_slider_142, Y=number_slider_142, Z=number_slider_141)  # disabled
center_box_107 = CenterBox(Base=point_192, X=number_slider_144, Y=number_slider_144, Z=number_slider_143)  # disabled
center_box_108 = CenterBox(Base=point_193, X=number_slider_146, Y=number_slider_146, Z=number_slider_145)  # disabled
colour_swatch_105 = ColourSwatch(SwatchColor=RGB(233, 189, 205))  # disabled
colour_swatch_106 = ColourSwatch(SwatchColor=RGB(217, 131, 255))  # disabled
custom_preview_106 = CustomPreview(Geometry=center_box_107, Material=colour_swatch_106)  # disabled
colour_swatch_107 = ColourSwatch(SwatchColor=RGB(51, 177, 255))  # disabled
custom_preview_107 = CustomPreview(Geometry=center_box_108, Material=colour_swatch_107)  # disabled
custom_preview_108 = CustomPreview(Geometry=center_box_106, Material=colour_swatch_105)  # disabled

deconstruct_94 = Deconstruct(Point=point_168)  # -> XComponent, YComponent, ZComponent; disabled
number_slider_147 = Slider(2, range=0..20)  # disabled
number_slider_148 = Slider(5, range=0..20)  # disabled
ghpython_script_82 = GhPythonScript(x=deconstruct_94.XComponent, y=deconstruct_94.YComponent, z=deconstruct_94.ZComponent)  # -> out, storagepoint, point1, point2; inputs x: list, y: list, z: list; disabled; same code as ghpython_script_74
number_slider_149 = Slider(2, range=0..20)  # disabled
number_slider_150 = Slider(5, range=0..20)  # disabled
number_slider_151 = Slider(2, range=0..20)  # disabled
number_slider_152 = Slider(5, range=0..20)  # disabled
point_194 = Point(ghpython_script_82.storagepoint)  # disabled
point_195 = Point(ghpython_script_82.point1)  # disabled
point_196 = Point(ghpython_script_82.point2)  # disabled
center_box_109 = CenterBox(Base=point_194, X=number_slider_148, Y=number_slider_148, Z=number_slider_147)  # disabled
center_box_110 = CenterBox(Base=point_195, X=number_slider_150, Y=number_slider_150, Z=number_slider_149)  # disabled
center_box_111 = CenterBox(Base=point_196, X=number_slider_152, Y=number_slider_152, Z=number_slider_151)  # disabled
colour_swatch_108 = ColourSwatch(SwatchColor=RGB(233, 189, 205))  # disabled
colour_swatch_109 = ColourSwatch(SwatchColor=RGB(217, 131, 255))  # disabled
custom_preview_109 = CustomPreview(Geometry=center_box_110, Material=colour_swatch_109)  # disabled
colour_swatch_110 = ColourSwatch(SwatchColor=RGB(51, 177, 255))  # disabled
custom_preview_110 = CustomPreview(Geometry=center_box_111, Material=colour_swatch_110)  # disabled
custom_preview_111 = CustomPreview(Geometry=center_box_109, Material=colour_swatch_108)  # disabled

colour_swatch_111 = ColourSwatch(SwatchColor=RGBA(51, 133, 0, 139))  # disabled
colour_swatch_112 = ColourSwatch(SwatchColor=RGBA(36, 94, 0, 139))  # disabled
colour_swatch_113 = ColourSwatch(SwatchColor=RGB(71, 71, 71))  # disabled

deconstruct_95 = Deconstruct(Point=point_148)  # -> XComponent, YComponent, ZComponent; disabled
number_slider_153 = Slider(2, range=0..20)  # disabled
number_slider_154 = Slider(5, range=0..20)  # disabled
ghpython_script_83 = GhPythonScript(x=deconstruct_95.XComponent, y=deconstruct_95.YComponent, z=deconstruct_95.ZComponent)  # -> out, storagepoint, point1, point2; inputs x: list, y: list, z: list; same code as ghpython_script_74
number_slider_155 = Slider(2, range=0..20)  # disabled
number_slider_156 = Slider(5, range=0..20)  # disabled
number_slider_157 = Slider(2, range=0..20)  # disabled
number_slider_158 = Slider(5, range=0..20)  # disabled
point_197 = Point(ghpython_script_83.storagepoint)  # disabled
point_198 = Point(ghpython_script_83.point1)  # disabled
point_199 = Point(ghpython_script_83.point2)  # disabled
center_box_112 = CenterBox(Base=point_197, X=number_slider_154, Y=number_slider_154, Z=number_slider_153)  # disabled
center_box_113 = CenterBox(Base=point_198, X=number_slider_156, Y=number_slider_156, Z=number_slider_155)  # disabled
center_box_114 = CenterBox(Base=point_199, X=number_slider_158, Y=number_slider_158, Z=number_slider_157)  # disabled
custom_preview_112 = CustomPreview(Geometry=center_box_113, Material=colour_swatch_111)  # disabled
custom_preview_113 = CustomPreview(Geometry=center_box_114, Material=colour_swatch_112)  # disabled
custom_preview_114 = CustomPreview(Geometry=center_box_112, Material=colour_swatch_113)  # disabled

colour_swatch_114 = ColourSwatch(SwatchColor=RGBA(51, 133, 0, 139))  # disabled
colour_swatch_115 = ColourSwatch(SwatchColor=RGBA(36, 94, 0, 139))  # disabled
colour_swatch_116 = ColourSwatch(SwatchColor=RGB(71, 71, 71))  # disabled

deconstruct_96 = Deconstruct(Point=point_135)  # -> XComponent, YComponent, ZComponent; disabled
number_slider_159 = Slider(2, range=0..20)  # disabled
number_slider_160 = Slider(5, range=0..20)  # disabled
ghpython_script_84 = GhPythonScript(x=deconstruct_96.XComponent, y=deconstruct_96.YComponent, z=deconstruct_96.ZComponent)  # -> out, storagepoint, point1, point2; inputs x: list, y: list, z: list; disabled; same code as ghpython_script_74
number_slider_161 = Slider(2, range=0..20)  # disabled
number_slider_162 = Slider(5, range=0..20)  # disabled
number_slider_163 = Slider(2, range=0..20)  # disabled
number_slider_164 = Slider(5, range=0..20)  # disabled
point_200 = Point(ghpython_script_84.storagepoint)  # disabled
point_201 = Point(ghpython_script_84.point1)  # disabled
point_202 = Point(ghpython_script_84.point2)  # disabled
center_box_115 = CenterBox(Base=point_200, X=number_slider_160, Y=number_slider_160, Z=number_slider_159)  # disabled
center_box_116 = CenterBox(Base=point_201, X=number_slider_162, Y=number_slider_162, Z=number_slider_161)  # disabled
center_box_117 = CenterBox(Base=point_202, X=number_slider_164, Y=number_slider_164, Z=number_slider_163)  # disabled
custom_preview_115 = CustomPreview(Geometry=center_box_116, Material=colour_swatch_114)  # disabled
custom_preview_116 = CustomPreview(Geometry=center_box_117, Material=colour_swatch_115)  # disabled
custom_preview_117 = CustomPreview(Geometry=center_box_115, Material=colour_swatch_116)  # disabled

colour_swatch_117 = ColourSwatch(SwatchColor=RGBA(51, 133, 0, 139))  # disabled
colour_swatch_118 = ColourSwatch(SwatchColor=RGBA(36, 94, 0, 139))  # disabled
colour_swatch_119 = ColourSwatch(SwatchColor=RGB(71, 71, 71))  # disabled

deconstruct_97 = Deconstruct(Point=point_130)  # -> XComponent, YComponent, ZComponent; disabled
number_slider_165 = Slider(2, range=0..20)  # disabled
number_slider_166 = Slider(5, range=0..20)  # disabled
ghpython_script_85 = GhPythonScript(x=deconstruct_97.XComponent, y=deconstruct_97.YComponent, z=deconstruct_97.ZComponent)  # -> out, storagepoint, point1, point2; inputs x: list, y: list, z: list; disabled; same code as ghpython_script_74
number_slider_167 = Slider(2, range=0..20)  # disabled
number_slider_168 = Slider(5, range=0..20)  # disabled
number_slider_169 = Slider(2, range=0..20)  # disabled
number_slider_170 = Slider(5, range=0..20)  # disabled
point_203 = Point(ghpython_script_85.storagepoint)  # disabled
point_204 = Point(ghpython_script_85.point1)  # disabled
point_205 = Point(ghpython_script_85.point2)  # disabled
center_box_118 = CenterBox(Base=point_203, X=number_slider_166, Y=number_slider_166, Z=number_slider_165)  # disabled
center_box_119 = CenterBox(Base=point_204, X=number_slider_168, Y=number_slider_168, Z=number_slider_167)  # disabled
center_box_120 = CenterBox(Base=point_205, X=number_slider_170, Y=number_slider_170, Z=number_slider_169)  # disabled
custom_preview_118 = CustomPreview(Geometry=center_box_119, Material=colour_swatch_117)  # disabled
custom_preview_119 = CustomPreview(Geometry=center_box_120, Material=colour_swatch_118)  # disabled
custom_preview_120 = CustomPreview(Geometry=center_box_118, Material=colour_swatch_119)  # disabled

colour_swatch_120 = ColourSwatch(SwatchColor=RGBA(51, 133, 0, 139))  # disabled
colour_swatch_121 = ColourSwatch(SwatchColor=RGBA(36, 94, 0, 139))  # disabled
colour_swatch_122 = ColourSwatch(SwatchColor=RGB(71, 71, 71))  # disabled

deconstruct_98 = Deconstruct(Point=point_111)  # -> XComponent, YComponent, ZComponent; disabled
number_slider_171 = Slider(2, range=0..20)  # disabled
number_slider_172 = Slider(5, range=0..20)  # disabled
ghpython_script_86 = GhPythonScript(x=deconstruct_98.XComponent, y=deconstruct_98.YComponent, z=deconstruct_98.ZComponent)  # -> out, storagepoint, point1, point2; inputs x: list, y: list, z: list; disabled; same code as ghpython_script_74
number_slider_173 = Slider(2, range=0..20)  # disabled
number_slider_174 = Slider(5, range=0..20)  # disabled
number_slider_175 = Slider(2, range=0..20)  # disabled
number_slider_176 = Slider(5, range=0..20)  # disabled
point_206 = Point(ghpython_script_86.storagepoint)  # disabled
point_207 = Point(ghpython_script_86.point1)  # disabled
point_208 = Point(ghpython_script_86.point2)  # disabled
center_box_121 = CenterBox(Base=point_206, X=number_slider_172, Y=number_slider_172, Z=number_slider_171)  # disabled
center_box_122 = CenterBox(Base=point_207, X=number_slider_174, Y=number_slider_174, Z=number_slider_173)  # disabled
center_box_123 = CenterBox(Base=point_208, X=number_slider_176, Y=number_slider_176, Z=number_slider_175)  # disabled
custom_preview_121 = CustomPreview(Geometry=center_box_122, Material=colour_swatch_120)  # disabled
custom_preview_122 = CustomPreview(Geometry=center_box_123, Material=colour_swatch_121)  # disabled
custom_preview_123 = CustomPreview(Geometry=center_box_121, Material=colour_swatch_122)  # disabled

colour_swatch_123 = ColourSwatch(SwatchColor=RGBA(51, 133, 0, 139))  # disabled
colour_swatch_124 = ColourSwatch(SwatchColor=RGBA(36, 94, 0, 139))  # disabled
colour_swatch_125 = ColourSwatch(SwatchColor=RGB(71, 71, 71))  # disabled

deconstruct_99 = Deconstruct(Point=point_138)  # -> XComponent, YComponent, ZComponent; disabled
number_slider_177 = Slider(2, range=0..20)  # disabled
number_slider_178 = Slider(5, range=0..20)  # disabled
ghpython_script_87 = GhPythonScript(x=deconstruct_99.XComponent, y=deconstruct_99.YComponent, z=deconstruct_99.ZComponent)  # -> out, storagepoint, point1, point2; inputs x: list, y: list, z: list; disabled; same code as ghpython_script_74
number_slider_179 = Slider(2, range=0..20)  # disabled
number_slider_180 = Slider(5, range=0..20)  # disabled
number_slider_181 = Slider(2, range=0..20)  # disabled
number_slider_182 = Slider(5, range=0..20)  # disabled
point_209 = Point(ghpython_script_87.storagepoint)  # disabled
point_210 = Point(ghpython_script_87.point1)  # disabled
point_211 = Point(ghpython_script_87.point2)  # disabled
center_box_124 = CenterBox(Base=point_209, X=number_slider_178, Y=number_slider_178, Z=number_slider_177)  # disabled
center_box_125 = CenterBox(Base=point_210, X=number_slider_180, Y=number_slider_180, Z=number_slider_179)  # disabled
center_box_126 = CenterBox(Base=point_211, X=number_slider_182, Y=number_slider_182, Z=number_slider_181)  # disabled
custom_preview_124 = CustomPreview(Geometry=center_box_125, Material=colour_swatch_123)  # disabled
custom_preview_125 = CustomPreview(Geometry=center_box_126, Material=colour_swatch_124)  # disabled
custom_preview_126 = CustomPreview(Geometry=center_box_124, Material=colour_swatch_125)  # disabled

addition_6 = Addition(
    A=list_length_102,
    B=list_length_84,
    C=list_length_71,
    D=list_length_94,
    E=list_length_92,
    F=list_length_119,
    G=list_length_81,
    H=list_length_114,
    I=list_length_121,
    J=list_length_107,
    K=list_length_75,
    L=list_length_89,
    M=list_length_136,
    N=list_length_131)

addition_7 = Addition(
    A=list_length_60,
    B=list_length_65,
    C=list_length_21,
    D=list_length_6,
    E=list_length_36,
    F=list_length_50,
    G=list_length_41,
    H=list_length_12,
    I=list_length_46,
    J=list_length_22,
    K=list_length_24,
    L=list_length,
    M=list_length_13,
    N=list_length_57)
addition_8 = Addition(
    A=list_length_61,
    B=list_length_66,
    C=list_length_23,
    D=list_length_7,
    E=list_length_37,
    F=list_length_52,
    G=list_length_42,
    H=list_length_14,
    I=list_length_47,
    J=list_length_25,
    K=list_length_31,
    L=list_length_2,
    M=list_length_17,
    N=list_length_58)
addition_9 = Addition(
    A=list_length_62,
    B=list_length_67,
    C=list_length_26,
    D=list_length_8,
    E=list_length_38,
    F=list_length_53,
    G=list_length_43,
    H=list_length_15,
    I=list_length_48,
    J=list_length_28,
    K=list_length_33,
    L=list_length_3,
    M=list_length_18,
    N=list_length_56)
addition_10 = Addition(
    A=list_length_64,
    B=list_length_69,
    C=list_length_30,
    D=list_length_10,
    E=list_length_40,
    F=list_length_55,
    G=list_length_45,
    H=list_length_20,
    I=list_length_51,
    J=list_length_32,
    K=list_length_35,
    L=list_length_5,
    M=list_length_11,
    N=list_length_59)
addition_11 = Addition(
    A=list_length_63,
    B=list_length_68,
    C=list_length_27,
    D=list_length_9,
    E=list_length_39,
    F=list_length_54,
    G=list_length_44,
    H=list_length_16,
    I=list_length_49,
    J=list_length_29,
    K=list_length_34,
    L=list_length_4,
    M=list_length_19)

addition_12 = Addition(
    A=list_length_100,
    B=list_length_80,
    C=list_length_70,
    D=list_length_87,
    E=list_length_86,
    F=list_length_116,
    G=list_length_79,
    H=list_length_113,
    I=list_length_118,
    J=list_length_104,
    K=list_length_73,
    L=list_length_83,
    M=list_length_135,
    N=list_length_130)
addition_13 = Addition(
    A=list_length_103,
    B=list_length_85,
    C=list_length_72,
    D=list_length_95,
    E=list_length_93,
    F=list_length_120,
    G=list_length_82,
    H=list_length_115,
    I=list_length_122,
    J=list_length_108,
    K=list_length_76,
    L=list_length_90,
    M=list_length_137,
    N=list_length_132)
addition_14 = Addition(
    A=list_length_105,
    B=list_length_91,
    C=list_length_74,
    D=list_length_98,
    E=list_length_97,
    F=list_length_123,
    G=list_length_88,
    H=list_length_117,
    I=list_length_125,
    J=list_length_111,
    K=list_length_77,
    L=list_length_96,
    M=list_length_138,
    N=list_length_133)
addition_15 = Addition(
    A=list_length_124,
    B=list_length_110,
    C=list_length_78,
    D=list_length_109,
    E=list_length_101,
    F=list_length_127,
    G=list_length_106,
    H=list_length_128,
    I=list_length_129,
    J=list_length_126,
    K=list_length_99,
    L=list_length_112,
    M=list_length_139,
    N=list_length_134)
ghpython_script_88 = GhPythonScript(x=addition_7, y=addition_8, z=addition_9, u=addition_10, v=addition_11)  # -> out, a, b, c, d, e
# ---------- ghpython_script_88: Python ----------
__author__ = "laoma"
__version__ = "2022.03.24"

import rhinoscriptsyntax as rs
sum=x+y+z+u+v
a='Office:{0}%'.format('%.2f' %(x/sum*100))
b='restaurant:{0}%'.format('%.2f' %(y/sum*100))
c='commerce:{0}%'.format('%.2f' %(z/sum*100))
d='residence:{0}%'.format('%.2f' %(u/sum*100))
e='education:{0}%'.format('%.2f' %(v/sum*100))
# ---------- end ghpython_script_88 ----------
ghpython_script_89 = GhPythonScript(x=addition_6, y=addition_12, z=addition_13, u=addition_14, v=addition_15)  # -> out, a, b, c, d, e; same code as ghpython_script_88
panel_142 = Panel(ghpython_script_89.c)
panel_143 = Panel(ghpython_script_89.d)
panel_144 = Panel(ghpython_script_89.a)
panel_145 = Panel(ghpython_script_89.b)
panel_146 = Panel(ghpython_script_89.e)
panel_147 = Panel(ghpython_script_88.a)
panel_148 = Panel(ghpython_script_88.b)
panel_149 = Panel(ghpython_script_88.c)
panel_150 = Panel(ghpython_script_88.d)
panel_151 = Panel(ghpython_script_88.e)
ghpython_script_90 = GhPythonScript(x=addition_7, y=addition_8, z=addition_9, u=addition_10, v=addition_11)  # -> out, a, b, c, d, e, sum
# ---------- ghpython_script_90: Python ----------
__author__ = "laoma"
__version__ = "2022.03.24"

import rhinoscriptsyntax as rs
A=x*0.0013*20+(y*0.15*15)+(z*0.0008*20)+(u*0.005*8)+(v*0.0018*50)
B=x*0.001*20+(y*0.09*15)+(z*0.0006*20)+(u*0.003*8)+(v*0.001*50)
C=x*0.0063*20+(y*0.0008*15)+(z*0.0017*20)+(u*0.0003*8)+(v*0.009*50)
D=x*0.746*20+(y*0.375*15)+(z*0.221*20)+(u*1.113*8)+(v*0.294*50)
E=x*0.017*20+(y*0.005*15)+(z*0.55*20)+(u*0.021*8)+(v*0.007*50)
sum=A+B+C+D+E
a='food:{0}'.format('%.2f' %(A))
b='frozen food:{0}'.format('%.2f' %(B))
c='office supplies:{0}'.format('%.2f' %(C))
d='furniture:{0}'.format('%.2f' %(D))
e='daily necessities:{0}'.format('%.2f' %(E))
sum='total={0}'.format('%.2f' %(sum))
# ---------- end ghpython_script_90 ----------
ghpython_script_91 = GhPythonScript(x=addition_6, y=addition_12, z=addition_13, u=addition_14, v=addition_15)  # -> out, a, b, c, d, e, sum; same code as ghpython_script_90
panel_152 = Panel(ghpython_script_90.c)
panel_153 = Panel(ghpython_script_90.d)
panel_154 = Panel(ghpython_script_90.a)
panel_155 = Panel(ghpython_script_90.b)
panel_156 = Panel(ghpython_script_90.e)
panel_157 = Panel(ghpython_script_90.sum)
panel_158 = Panel(ghpython_script_91.a)
panel_159 = Panel(ghpython_script_91.c)
panel_160 = Panel(ghpython_script_91.d)
panel_161 = Panel(ghpython_script_91.e)
panel_162 = Panel(ghpython_script_91.b)
panel_163 = Panel(ghpython_script_91.sum)
